# Grasshopper definition Parcellation.gh (Grasshopper 1.0.7)

panel = Panel("11570808.366042163,150434.69007767955,11571189.44626358,150466.2314003953,11571299.74618863,150691.97031874265,11571321.91826833,150975.98091575954,11572214.620520376,150951.15753698954,11572062.073819272,150411.7817230856,11571553.776452176,150230.69294994636,11570861.573353108,149984.95296616724,11570780.800288131,150295.43069542275,11570808.366042163,150434.69007767955")
panel_2 = Panel("11571748.8102367")
panel_3 = Panel("150227.7540442719")
panel_4 = Panel("151023.58147943625")
panel_5 = Panel("11571869.965108456")
panel_6 = Panel("11569976.350055343,150928.4875541661,11570436.872397948,150930.0062049185,11570434.01708501,150757.38361289774,11569976.419378169,150756.01835358897,11569976.350055343,150928.4875541661")
ghpython_script = GhPythonScript()  # -> out, PC
# ---------- ghpython_script: Python ----------
###########################
####    Import Libs    ####
###########################
import Rhino.Geometry as rg
#import Rhino.RhinoDoc as rd
import Rhino.RhinoMath as rm

import ghpythonlib.components as ghc
import math

import clr
#clr.AddReferenceToFile("PlanktonGh.dll")
#clr.AddReferenceToFileAndPath("C:/Users/Anna Yenardi/OneDrive - Singapore University of Technology and Design/2022_UrbanDesignOptimization/03_Models/03_Web dev JS materials/2212_arcgis_trial/gh/PlanktonGh.dll")
#clr.AddReferenceToFileAndPath(r"C:\Users\jingz\AppData\Roaming\Grasshopper\Libraries\plankton\PlanktonGH.dll")
clr.AddReferenceToFileAndPath("C:/Users/Administrator/Desktop/Plankton/PlanktonGh.dll")
import PlanktonGh
clr.ImportExtensions(PlanktonGh.RhinoSupport)

# clr.AddReferenceToFile("Wrapper.dll")
# import Eigen.Wrapper

# from System.Collections.Generic import List

#clr.AddReference("CGAL.Wrapper.dll")
#import CGAL.Wrapper
from System.Collections.Generic import List


##########################
####    Processing    ####
##########################
class PC:
    class ProcessVertex:
        def __init__(self,vh,index): 
            self.vh = vh                    
            self.index = index 
            self.geometry = rg.Point3d(vh.X,vh.Y,vh.Z)      
            self.closestPoint = None                   
            self.crossField = None   
            
            self.distanceEverySegment = None   
            self.closestEdgeIndex = None     
            self.is_OnEdge = None
            self.is_MedialAxisVertex = None
            self.incident=[]
            self.standard=None
            self.corner=None

            self.const = None
            self.prev_onEdgeIndex = None
            self.next_onEdgeIndex = None
            self.prev_const = None
            self.next_const = None
            self.segmentLength = None
            
        def __del__(self):
            self.vh = None
            self.index = None
            self.crossField = None
            self.distanceEverySegment = None
            self.closestEdgeIndex = None
            self.is_OnEdge = None
            self.is_MedialAxisVertex = None
            
            self.distanceEverySegment = None   
            self.closestEdgeIndex = None     
            self.is_OnEdge = None
            self.is_MedialAxisVertex = None
            self.incident=None
            self.standard=None
            self.corner=None
            self.constraintA=None
            self.is_OnConstraintA = None

            self.const = None
            self.prev_onEdgeIndex = None
            self.next_onEdgeIndex = None
            self.prev_const = None
            self.next_const = None
            self.segmentLength = None
            
    class ProcessTriangle:
        def __init__(self,fh,index):  
            self.triangleFh = fh                   
            self.index = index 
            self.triangleVertices = None         
            self.triangleBoundary = None       
            self.centroid = None                       
            self.is_MedialAxis = None                      
            self.is_Singularity = None                     
        
        def __del__(self):
            self.triangleFh = None                   
            self.index = None 
            self.triangleVertices = None         
            self.triangleBoundary = None       
            self.centroid = None                       
            self.is_MedialAxis = None                      
            self.is_Singularity = None  
            
    class ProcessMesh:
        def __init__(self):
            self.vertexList = None
            self.triangleList = None
            self.triRemeshBoundary = None
            self.delaunayMesh= None
            self.halfEdgeMesh=None
            self.length=None
            self.singularities= None

        def __del__(self):
            self.vertexList = None
            self.triangleList = None
            self.triRemeshBoundary = None
            self.delaunayMesh= None
            self.halfEdgeMesh=None
            self.length=None
            
        def InitializeInput(self,input,length):
            
            print ("SimplifyVertices before "),len(input)
            input = PC.SimplifyVertices(input)
            input = PC.ConvertPolylineCurveToPolyline(input)
            print ("SimplifyVertices after "),len(input)
            mesh= rg.Mesh.CreateFromClosedPolyline(input)
            #print ("Convert a polyline into mesh, its ") ,mesh.IsValid
            
            ###Get the vertices, pop the last one
            inputVertices=[]
            for index in range(len(input)-1):
                inputVertices.append(input[index])
            

            ### Make Sure there is not too close points, pending to delect this  
            newPtList = []
            newPtList.append(inputVertices[0])
            for i in range(1,len(inputVertices) - 1,1):
                if inputVertices[i].DistanceTo(inputVertices[i+1]) < 0.01:
                    pass
                else:
                    newPtList.append(inputVertices[i])
            
            newPtList.append(inputVertices[-1])
            
            if newPtList[len(newPtList)-1].DistanceTo(newPtList[len(newPtList)-2]) < 0.01:
                newPtList.pop(len(newPtList)-2)
            ### Make Sure there is not too close points, pending to delect this  
            
    
            newPtList = List[rg.Point3d](newPtList)
            #try:
                #delaunayMesh = CGAL.Wrapper.GeometryProcessingMethods.CGAL_Remesh(newPtList,0.125,length,20) 
            #except:
                #for pt in newPtList:
                    #print pt.X,pt.Y,pt.Z
            #facecount=delaunayMesh.Faces.Count
            
            

#            while facecount<150:
#                length=length * 0.8
#                whileCount+=1
#                
#                delaunayMesh = CGAL.Wrapper.GeometryProcessingMethods.CGAL_Remesh(newPtList,0.125,length,20) 
#                facecount=delaunayMesh.Faces.Count
#                #print "Inside checking facecount:",facecount
#                if whileCount>10:
#                    break

            delaunayMesh, dual, creases= ghc.Kangaroo2Component.TriRemesh(
            geometry = mesh,
            sharp = True,
            features = inputVertices,
            length = length,
            iterations = 50,)
            
            whileCount = 0
            facecount=delaunayMesh.Faces.Count
            while facecount<100:
                
                length=length * 0.8
                whileCount+=1
                #print ("trying length: %f"%(length))
                delaunayMesh, dual, creases= ghc.Kangaroo2Component.TriRemesh(
                            geometry = mesh,
                            sharp = True,
                            features = inputVertices,
                            length = length,
                            iterations = 50,)
                if whileCount>5:
                    print ("I am going to break the while loop")
                    print ("currently the length is %f"%(length))
                    break
                try:
                    facecount=delaunayMesh.Faces.Count
                except:

                    print ("inputcurve")
                    for pt in input:
                        print (pt.X),",",(pt.Y),",",(pt.Z)
                    print ("mesh.Vertices")
                    for i in range(len(mesh.Vertices)):
                        print (mesh.Vertices[i])
                        
                    print ("mesh.Faces")
                    for i in range(len(mesh.Faces)):
                        print (mesh.Faces[i])
                        
                    print ("inputVertices")
                    for pt in inputVertices:
                        print (pt.X),",",(pt.Y),",",(pt.Z)
                    
                    
                    # if fail,try to regenerate the mesh
                    mesh= rg.Mesh.CreateFromClosedPolyline(input)
                    print ("Regenerate the mesh")
            
            halfEdgeMesh = delaunayMesh.ToPlanktonMesh()
            facecount=delaunayMesh.Faces.Count

            
            ###Get the offset boundary
            wxy_Plane=rg.Plane.WorldXY
            #tol = rd.ActiveDoc.ModelAbsoluteTolerance
            tol = 0.001
            triRemeshBoundary = input
            triRemeshBoundary_curve = input.ToPolylineCurve()
            
            try:
                offset1= triRemeshBoundary_curve.Offset(wxy_Plane,tol,tol,rg.CurveOffsetCornerStyle.Sharp)[0]
            except:
                for pt in input:
                    print pt.X,pt.Y,0
            offset2= triRemeshBoundary_curve.Offset(wxy_Plane,-tol,tol,rg.CurveOffsetCornerStyle.Sharp)[0]
            
            
            if offset1.GetLength() > offset2.GetLength() :
                offsetTriRemeshBoundary = offset1
            else:
                offsetTriRemeshBoundary = offset2
            
            faceList_HEM=halfEdgeMesh.Faces
            edgeList_HEM=halfEdgeMesh.Halfedges
            vertexList_HEM=halfEdgeMesh.Vertices
            
            
            ##################################
            ###store vertices in vertexList###
            ##################################
            processVertexList=[]
            for i in range(vertexList_HEM.Count):
                processVertex=PC.ProcessVertex(vertexList_HEM[i],i)
                processVertexList.append(processVertex)
            
            #closestEdgeIndices=[]
            #result = self.GetEdgeIndices(triRemeshBoundary)
            #newEdgeIndices =  result[0]
            #newEdgeSegments = result[1]

            ###add the rest info
            for processVertex in processVertexList:
                
                self.GetClosestPointOnOffsetBoundary(processVertex,offsetTriRemeshBoundary)
                self.CreateCrossField(processVertex)
                #self.GetDistanceToEverySegment(processVertex,newEdgeSegments)
                #self.GetClosestEdgeIndex(processVertex,newEdgeIndices)
                self.CheckVertexOnEdge(processVertex,halfEdgeMesh)
                
            self.RenewVerticesOnEdgeCrossfield_TangentMethod(processVertexList,halfEdgeMesh,input)
            
            ##################################
            ###   store faces in faceList  ###
            ##################################
            
            ###store triFace in faceList
            processTriangleList=[]
            for i in range(faceList_HEM.Count):
                processTriangle=PC.ProcessTriangle(faceList_HEM[i],i)
                processTriangleList.append(processTriangle)
            
            ###add the rest info
            for i in range(faceList_HEM.Count):
                threeVerticesIndices = faceList_HEM.GetVertices(i)
                try:
                    triangleVertices=[processVertexList[threeVerticesIndices[0]],processVertexList[threeVerticesIndices[1]],processVertexList[threeVerticesIndices[2]]]
                except:
                    print ("in initializeInput ")
                    print ("this lengthL"),length, (" face num"),halfEdgeMesh.Faces.Count
                    
                    
                processTriangleList[i].triangleVertices=triangleVertices
            
                self.GetTriangle(processTriangleList[i])
                self.GetTriangleCentroid(processTriangleList[i])
                #self.CheckMedialAxisTriangle(processTriangleList[i])
                
            

            #####################################
            ###   store all in to ProcessMesh ###
            #####################################
            
            
            self.vertexList = processVertexList
            self.triangleList = processTriangleList
            self.triRemeshBoundary = triRemeshBoundary
            self.delaunayMesh= delaunayMesh
            self.halfEdgeMesh= halfEdgeMesh
            self.length = length
            #print "pMesh recording:",length
            self.CalculateOriginalBigD()
            
            sinIndices,coefficients_Collection = self.GetSingularityTriangleInfo()
            singularities = self.Getsingularities(sinIndices,coefficients_Collection)

            self.singularities = singularities
            
            

       
        def CalculateOriginalBigD(self):
            
            for v in self.vertexList:
                vec = (v.crossField[0].X + 1j * v.crossField[0].Y) **4
                vecD = rg.Vector3d(vec.real,vec.imag,0)
                v.standard = vecD
            
        def GetBoundaryVertexIndices(self,HEM,curve):
            
            boundaryVIndices=[]
            
            for i in range(HEM.Vertices.Count):
                if HEM.Vertices.IsBoundary(i)==True:
                    startIndex = i
                    break
            try:
                boundaryVIndices.append(startIndex)
            except:
                print ("sth wrong in GetBoundaryVertexIndices")
                for i in range(HEM.Vertices.Count):
                    print (HEM.Vertices.IsBoundary(i))
                    print (HEM.Vertices[i].ToXYZ().X),",",(HEM.Vertices[i].ToXYZ().Y),",",(HEM.Vertices[i].ToXYZ().Z)
                
                print ("curve to be mesh")
                for pt in curve:
                    print (pt.X),",",(pt.Y),",",(pt.Z)
            set = HEM.Vertices.GetVertexNeighbours(startIndex)
            
            whileCount = 0
            while (len(boundaryVIndices)==1 or boundaryVIndices[len(boundaryVIndices)-1]!=boundaryVIndices[0]):
                whileCount+=1
                if whileCount>10000:
                    break
                curri=boundaryVIndices[len(boundaryVIndices)-1]
                set = HEM.Vertices.GetVertexNeighbours(curri)
                for index in set:
                    if HEM.Vertices.IsBoundary(index)==True:
                        boundaryVIndices.append(index)
                        break
            
            boundaryVIndices.pop()
            return boundaryVIndices
            
        def GetEdgeIndices(self,input):
            crv = self.MakeCounterClockwiseDirection(input)
            count=0
        
            ### get vertices
            vertices=[]
            for index in range(len(crv)-1):
                vertices.append(crv[index])
                
            edgeIndices=[]
            edgeSegments=[]
            
            for i in range(len(vertices)):
                if i==0:
                    vector1=rg.Vector3d(vertices[len(vertices)-1]-vertices[0])
                    vector2=rg.Vector3d(vertices[1]-vertices[0])    
                    edgeSegments.append(rg.Line(vertices[0],vertices[1]))     
                    
                elif i==len(vertices)-1:
                    vector1=rg.Vector3d(vertices[i-1]-vertices[len(vertices)-1])
                    vector2=rg.Vector3d(vertices[0]-vertices[len(vertices)-1])
                    edgeSegments.append(rg.Line(vertices[len(vertices)-1],vertices[0])) 
        
                else: 
                    vector1=rg.Vector3d(vertices[i-1]-vertices[i])
                    vector2=rg.Vector3d(vertices[i+1]-vertices[i])
                    edgeSegments.append(rg.Line(vertices[i],vertices[i+1])) 
                    
                angle = rm.ToDegrees(rg.Vector3d.VectorAngle(vector1,vector2))
                
                if rg.Vector3d.CrossProduct(vector1,vector2).Z>0:
                    angle=360-angle
                

                if angle<135 or angle>225:
                    count+=1
                
                edgeIndices.append(count)
                
            
            #[original,new]
            if edgeIndices[0]==1:
                for i in range(len(edgeIndices)):
                    edgeIndices[i]=edgeIndices[i]-1
            
            #check the seam position
            vector1=rg.Vector3d(vertices[len(vertices)-1]-vertices[0])
            vector2=rg.Vector3d(vertices[1]-vertices[0])
            
            angle = rm.ToDegrees(rg.Vector3d.VectorAngle(vector1,vector2))
            
            if rg.Vector3d.CrossProduct(vector1,vector2).Z>0:
                angle=360-angle
            
            lastIndex = edgeIndices[len(edgeIndices)-1]
            if angle>135 and angle<225 :
                for i in range(len(edgeIndices)):
                    if edgeIndices[i] ==lastIndex:
                        edgeIndices[i] =0
        
            return [edgeIndices,edgeSegments]
        
        @staticmethod
        def GetJoinedEdge(input,newIndex,edgeIndices):
            segments_curve = []
            segments_orginalIndex = []
            for i in range(len(edgeIndices)):
                if edgeIndices[i] == newIndex:
                    segments_curve.append(input.SegmentAt(i))
                    segments_orginalIndex.append(i)
            pts_curve = []
            
            maxIndex = len(edgeIndices)-1
            minIndex = 0
            
            if maxIndex in segments_orginalIndex and minIndex in segments_orginalIndex:
                # special case
                # sort the indices
                newOrder_Indices = []
                newOrder_Segments = []

                
                distToMax = []
                distToMin = []

                # caculate the distance
                for index in segments_orginalIndex:
                    distToMax.append(abs(index-maxIndex))
                    distToMin.append(abs(index-minIndex))

                # store the First part
                for i in range(len(segments_orginalIndex)):
                    if distToMax[i] < distToMin[i]:
                        newOrder_Indices.append(segments_orginalIndex[i])

                # store the Second part
                for i in range(len(segments_orginalIndex)):
                    if distToMin[i] < distToMax[i]:
                        newOrder_Indices.append(segments_orginalIndex[i])
                
                # store the geometry
                for i in newOrder_Indices:
                    newOrder_Segments.append(input.SegmentAt(i))
        
                
                for seg in newOrder_Segments:
                    pts_curve.append(seg.From)
                pts_curve.append(newOrder_Segments[-1].To)
                
                curve = rg.Polyline(pts_curve)
                
                return curve
            else:
                for seg in segments_curve:
                    pts_curve.append(seg.From)
                    
                pts_curve.append(segments_curve[-1].To)
                
                curve = rg.Polyline(pts_curve)
                
                return curve
            
        @staticmethod
        def GetNewEdges(input):
            edgeIndices,edges= PC.ProcessMesh().GetEdgeIndices(input)
            newEdges = []
            numEdge = max(edgeIndices) + 1
            
            for index in range(numEdge):
                newEdges.append(PC.ProcessMesh.GetJoinedEdge(input,index,edgeIndices))
            
            return newEdges
            
        def MakeCounterClockwiseDirection(self,inputPolyline):
            inputPolyline_copy = rg.Polyline(inputPolyline)
            inputPolylineCurve = inputPolyline_copy.ToPolylineCurve()
            if inputPolylineCurve.ClosedCurveOrientation().ToString() == "Clockwise":
                inputPolyline_copy.Reverse()
        
            else:
                pass
            
            return inputPolyline_copy
            
        def GetClosestPointOnOffsetBoundary (self,processVertex,offsettriRemeshBoundary):
            vertex = processVertex.geometry
            
            t=offsettriRemeshBoundary.ClosestPoint(vertex)[1]
            closestPoint=offsettriRemeshBoundary.PointAt(t)
            processVertex.closestPoint = closestPoint
            
        def CreateCrossField(self,processVertex):
            wxy_Plane=rg.Plane.WorldXY
            ZAxis=wxy_Plane.ZAxis
            
           
            vector_A = rg.Vector3d(processVertex.closestPoint - processVertex.geometry)
            vector_A.Unitize()
            vector_B = rg.Vector3d(vector_A)
            vector_C = rg.Vector3d(vector_A)
            vector_D = rg.Vector3d(vector_A)

            vector_B.Rotate(rm.ToRadians(90),ZAxis)
            vector_C.Rotate(rm.ToRadians(180),ZAxis)
            vector_D.Rotate(rm.ToRadians(270),ZAxis)
     
            processVertex.crossField = [vector_A,vector_B,vector_C,vector_D]
            
        def GetDistanceToEverySegment(self,processVertex,segments):
            distances=[]
        
            for i in range(len(segments)):
                distances.append(segments[i].DistanceTo(processVertex.geometry,True))
        
            processVertex.distanceEverySegment = distances
        
        def GetClosestEdgeIndex(self,processVertex,newEdgeIndices):
            minIndex = processVertex.distanceEverySegment.index(min(processVertex.distanceEverySegment))
            
            processVertex.closestEdgeIndex = newEdgeIndices[minIndex]
            
        def CheckVertexOnEdge(self,processVertex,HEM):
            if HEM.Vertices.IsBoundary(processVertex.index)==True:
                processVertex.is_OnEdge = 1
            else:
                processVertex.is_OnEdge = 0
                
        def RenewVerticesOnEdgeCrossfield(self,processVertexList,HEM,crv):
            boundaryVIndices=self.GetBoundaryVertexIndices(HEM,crv)
            OnEdgeVertices=[]
            OnEdgeVertices_Geo=[]
            for index in boundaryVIndices:
                OnEdgeVertices.append(processVertexList[index])
                OnEdgeVertices_Geo.append(processVertexList[index].geometry)
        
            #tol = rd.ActiveDoc.ModelAbsoluteTolerance
            tol = 0.001
            newPointList_1 = self.MakeOffsetPoly(OnEdgeVertices_Geo,tol)
            newPointList_2 = self.MakeOffsetPoly(OnEdgeVertices_Geo,-tol)
            
            polyline_1 = rg.Polyline(newPointList_1)
            polyline_2 = rg.Polyline(newPointList_2)
            
            if polyline_1.Length > polyline_2.Length :
                newPointList = newPointList_1
            else:
                newPointList = newPointList_2
        
            for i in range(len(OnEdgeVertices)):
                OnEdgeVertices[i].closestPoint=newPointList[i]
                self.CreateCrossField(OnEdgeVertices[i])
                
        def RenewVerticesOnEdgeCrossfield_TangentMethod_2(self,processVertexList,HEM,crv):
            boundaryVIndices=self.GetBoundaryVertexIndices(HEM,crv)
            OnEdgeVertices=[]
            OnEdgeVertices_Geo=[]
            for index in boundaryVIndices:
                OnEdgeVertices.append(processVertexList[index])
                OnEdgeVertices_Geo.append(processVertexList[index].geometry)
        
            #tol = rd.ActiveDoc.ModelAbsoluteTolerance
            tol = 0.001
            wxy_Plane=rg.Plane.WorldXY
            ZAxis=wxy_Plane.ZAxis
            for i in range(len(OnEdgeVertices_Geo)):
                if i!= 0 and i!= len(OnEdgeVertices_Geo)-1:
                    vec1 = rg.Vector3d(OnEdgeVertices_Geo[i+1]-OnEdgeVertices_Geo[i])
                    vec3 = rg.Vector3d(OnEdgeVertices_Geo[i-1]-OnEdgeVertices_Geo[i])
                elif i==0:
                    vec1 = rg.Vector3d(OnEdgeVertices_Geo[i+1]-OnEdgeVertices_Geo[i])
                    vec3 = rg.Vector3d(OnEdgeVertices_Geo[len(OnEdgeVertices_Geo)-1]-OnEdgeVertices_Geo[i])
                elif i==len(OnEdgeVertices_Geo)-1:
                    vec1 = rg.Vector3d(OnEdgeVertices_Geo[0] - OnEdgeVertices_Geo[i])
                    vec3 = rg.Vector3d(OnEdgeVertices_Geo[i-1] - OnEdgeVertices_Geo[i])
                
                #vec0 = rg.Vector3d(vec1)
                #vec0.Rotate(rm.ToRadians(90),ZAxis)
                #vec2 = rg.Vector3d(vec3)
                #vec2.Rotate(rm.ToRadians(90),ZAxis)
                vec1.Unitize()
                vec3.Unitize()
                vec0 = (vec1+vec3)
                vec2 = -(vec1+vec3)
                vec0.Unitize()
                vec1.Unitize()
                vec2.Unitize()
                vec3.Unitize()
                newCrossfield = [vec0,vec1,vec2,vec3]
                
                OnEdgeVertices[i].crossField = newCrossfield

        def RenewVerticesOnEdgeCrossfield_TangentMethod(self,processVertexList,HEM,crv):
            boundaryVIndices=self.GetBoundaryVertexIndices(HEM,crv)
            OnEdgeVertices=[]
            OnEdgeVertices_Geo=[]
            for index in boundaryVIndices:
                OnEdgeVertices.append(processVertexList[index])
                OnEdgeVertices_Geo.append(processVertexList[index].geometry)
        
            #tol = rd.ActiveDoc.ModelAbsoluteTolerance
            tol = 0.001
            wxy_Plane=rg.Plane.WorldXY
            ZAxis=wxy_Plane.ZAxis
            for i in range(len(OnEdgeVertices_Geo)):
                if i!= 0 and i!= len(OnEdgeVertices_Geo)-1:
                    vec1 = rg.Vector3d(OnEdgeVertices_Geo[i+1]-OnEdgeVertices_Geo[i])

                elif i==0:
                    vec1 = rg.Vector3d(OnEdgeVertices_Geo[i+1]-OnEdgeVertices_Geo[i])

                elif i==len(OnEdgeVertices_Geo)-1:
                    vec1 = rg.Vector3d(OnEdgeVertices_Geo[0] - OnEdgeVertices_Geo[i])

                
                vec0 = rg.Vector3d(vec1)
                vec2 = rg.Vector3d(vec1)
                vec3 = rg.Vector3d(vec1)
                
                vec0.Unitize()
                vec1.Unitize()
                vec2.Unitize()
                vec3.Unitize()
                
                vec0.Rotate(rm.ToRadians(-90),ZAxis)
                vec2.Rotate(rm.ToRadians(90),ZAxis)
                vec3.Rotate(rm.ToRadians(180),ZAxis)
                
                newCrossfield = [vec0,vec1,vec2,vec3]
                
                OnEdgeVertices[i].crossField = newCrossfield
                
        def NormalizeVec(self,x,y):
            distance = math.sqrt(x*x+y*y)
            return x/distance, y/distance
        
        def MakeOffsetPoly(self,inputVertices,offset,outer_ccw = 1):
            oldX =[]
            oldY =[]
            num_points = len(inputVertices)
            
            for i in range(num_points):
                oldX.append(inputVertices[i].X)
                oldY.append(inputVertices[i].Y)
                
            newX=[]
            newY=[]
            
            for curr in range(num_points):
                prev = (curr + num_points - 1) % num_points
                next = (curr + 1) % num_points
            
                vnX =  oldX[next] - oldX[curr]
                vnY =  oldY[next] - oldY[curr]
                vnnX, vnnY = self.NormalizeVec(vnX,vnY)
                nnnX = vnnY
                nnnY = -vnnX
            
                vpX =  oldX[curr] - oldX[prev]
                vpY =  oldY[curr] - oldY[prev]
                vpnX, vpnY = self.NormalizeVec(vpX,vpY)
                npnX = vpnY * outer_ccw
                npnY = -vpnX * outer_ccw
            
                bisX = (nnnX + npnX) * outer_ccw
                bisY = (nnnY + npnY) * outer_ccw
            
                bisnX, bisnY = self.NormalizeVec(bisX,  bisY)
                bislen = offset /  math.sqrt((1 + nnnX*npnX + nnnY*npnY)/2)
            
                newX.append(oldX[curr] + bislen * bisnX)
                newY.append(oldY[curr] + bislen * bisnY)
            
            outputVertices=[]
            for i in range(num_points):
                outputVertices.append(rg.Point3d(newX[i],newY[i],0))
            
            
            return outputVertices
            
        def GetTriangle(self,processTriangle):
            threeVertices = processTriangle.triangleVertices
            processTriangle.triangleBoundary =  rg.Polyline([threeVertices[0].geometry,threeVertices[1].geometry,threeVertices[2].geometry,threeVertices[0].geometry])
        
        def GetTriangleCentroid(self,processTriangle):
            processTriangle.centroid = processTriangle.triangleBoundary.CenterPoint()
        
        def CheckMedialAxisTriangle(self,processTriangle):
        
            a=processTriangle.triangleVertices[0]
            b=processTriangle.triangleVertices[1]
            c=processTriangle.triangleVertices[2]
            
            if a.closestEdgeIndex!=b.closestEdgeIndex or a.closestEdgeIndex!=c.closestEdgeIndex or b.closestEdgeIndex!=c.closestEdgeIndex:
                processTriangle.is_MedialAxis = 1
                a.is_MedialAxisVertex = 1
                b.is_MedialAxisVertex = 1
                c.is_MedialAxisVertex = 1
                
            else:
                processTriangle.is_MedialAxis = 0
                a.is_MedialAxisVertex = 0
                b.is_MedialAxisVertex = 0
                c.is_MedialAxisVertex = 0
      
        def CheckSingularity(self,processTriangle):
        
            a=processTriangle.triangleVertices[0]
            b=processTriangle.triangleVertices[1]
            c=processTriangle.triangleVertices[2]
            
            if a.closestEdgeIndex!=b.closestEdgeIndex and a.closestEdgeIndex!=c.closestEdgeIndex and b.closestEdgeIndex!=c.closestEdgeIndex:
                processTriangle.is_Singularity = 1
            else:
                processTriangle.is_Singularity = 0
                

        def GetSingularityTriangleInfo_Old(self):
            sinIndices = []
            coefficients_Collection = []
            for index in range(len(self.triangleList)):
                # get threeRelated
                processTriangle = self.triangleList[index]
                threeVertices = processTriangle.triangleVertices
                
                
                # find the minVec for every neighbor
                
                vi=threeVertices[0].geometry
                vj=threeVertices[1].geometry
                vk=threeVertices[2].geometry
                
                vecD_i = threeVertices[0].standard
                vecD_j = threeVertices[1].standard
                vecD_k = threeVertices[2].standard
                
                #Matrix A
                A = [vecD_i.X,vecD_j.X,vecD_k.X,vecD_i.Y,vecD_j.Y,vecD_k.Y,1.0,1.0,1.0]
                A = List[float](A)
                rankA = Eigen.Wrapper.OptimizationMethods.GetMatrixRank(3,3,A)
                
                
                #augmented Matrix A
                aA = [vecD_i.X,vecD_j.X,vecD_k.X,0.0,vecD_i.Y,vecD_j.Y,vecD_k.Y,0.0,1.0,1.0,1.0,1.0]
                aA = List[float](aA)
                rankaA = Eigen.Wrapper.OptimizationMethods.GetMatrixRank(3,4,aA)
                

                
                if rankA == rankaA: # there might be a singularity
                
                    A = [vecD_i.X,vecD_j.X,vecD_k.X,vecD_i.Y,vecD_j.Y,vecD_k.Y,1.0,1.0,1.0]
                    b = [0.0,0.0,1.0]
                    
                    A = List[float](A)
                    b = List[float](b)
                    
                    coefficients = Eigen.Wrapper.OptimizationMethods.SolveLinearSystem(3,3,A,b)
                    
                    if coefficients[0]>0 and coefficients[1]>0 and coefficients[2]>0:
                        sinIndices.append(index)
                        coefficients_Collection.append(coefficients)
                else:
                    pass
                    #print ("ranks are not equal")

            return sinIndices,coefficients_Collection

        def GetSingularityTriangleInfo(self):
            
            sinIndices = []
            coefficients_Collection = []
            for index in range(len(self.triangleList)):
                # get threeRelated
                processTriangle = self.triangleList[index]
                threeVertices = processTriangle.triangleVertices
                
                
                # find the minVec for every neighbor
                
                vi=threeVertices[0].geometry
                vj=threeVertices[1].geometry
                vk=threeVertices[2].geometry
                
                vecD_i = threeVertices[0].standard
                vecD_j = threeVertices[1].standard
                vecD_k = threeVertices[2].standard
                
                #Matrix A
                A = [[vecD_i.X,vecD_j.X,vecD_k.X],
                     [vecD_i.Y,vecD_j.Y,vecD_k.Y],
                     [1.0,1.0,1.0]]

                rankA = PC.ProcessMesh.Get3x3MatrixRank(A)
                
                
                #augmented Matrix A
                aA =[ [vecD_i.X,vecD_j.X,vecD_k.X,0.0],
                     [vecD_i.Y,vecD_j.Y,vecD_k.Y,0.0],
                     #[0.0,0.0,0.0,0.0,1.0]]
                     [1.0,1.0,1.0,1.0]]

                rankaA = PC.ProcessMesh.Get3x4MatrixRank(aA)
                
                
                
                if rankA == rankaA: # there might be a singularity
                    

                    #solverInput = [vecD_i.X,vecD_j.X,vecD_k.X,0.0, vecD_i.Y,vecD_j.Y,vecD_k.Y,0.0,1.0,1.0,1.0,1.0]
                    try:
                        coefficients = PC.ProcessMesh.Solve3x3Equations(vecD_i.X,vecD_j.X,vecD_k.X,0.0, vecD_i.Y,vecD_j.Y,vecD_k.Y,0.0,1.0,1.0,1.0,1.0)
                    except:
                        coefficients = [0,0,0]
                    
                    if coefficients[0]>0 and coefficients[1]>0 and coefficients[2]>0:
                        
                        sinIndices.append(index)
                        coefficients_Collection.append(coefficients)
                        
                else:
                    pass
                    #print ("ranks are not equal")

            return sinIndices,coefficients_Collection
            
        
        def Getsingularities(self,sinIndices,coefficients_Collection):
            fList = self.triangleList
            
            singularities = []
            
            if sinIndices != [] and coefficients_Collection!=[]:
                for i in range(len(sinIndices)):
                    fIndex = sinIndices[i]
                    threeVertices = fList[fIndex].triangleVertices
                    vi = threeVertices[0].geometry
                    vj = threeVertices[1].geometry
                    vk = threeVertices[2].geometry
                    
                    coefficients = coefficients_Collection[i]
                    coi = coefficients[0]
                    coj = coefficients[1]
                    cok = coefficients[2]
                    
                    singularity = vi*coi + vj*coj + vk*cok
                    singularities.append(singularity)
            
            return singularities
        
        ######################################################
        ################        Matrix         ###############
        ######################################################
        @staticmethod
        def Solve3x3Equations(a, b, c, d, e, f, g, h, i, j, k, l):
            """
            Solve a 3x3 system of equations using Cramer's rule.
            The system is in the form of:
                a * x + b * y + c * z = d
                e * x + f * y + g * z = h
                i * x + j * y + k * z = l
            where x, y, z are the variables to be solved for.
            """
            # Compute the determinant of the coefficient matrix
            det = a * (f * i - g * j) - b * (e * i - g * k) + c * (e * j - f * k)
            
            # Compute the determinant of the matrix formed by replacing each column of the coefficient matrix 
            # with the constants vector
            det_x = d * (f * i - g * j) - b * (h * i - g * l) + c * (h * j - f * l)
            det_y = a * (h * i - g * l) - d * (e * i - g * k) + c * (e * l - h * k)
            det_z = a * (f * l - h * j) - b * (e * l - h * k) + d * (e * j - f * k)
            
            # compute the value of x, y, z
            x = det_x / det
            y = det_y / det
            z = det_z / det
            return x, y, z
        
        @staticmethod
        def Get3x3MatrixRank(matrix):
            det = matrix[0][0] * (matrix[1][1] * matrix[2][2] - matrix[1][2] * matrix[2][1]) - matrix[0][1] * (matrix[1][0] * matrix[2][2] - matrix[1][2] * matrix[2][0]) + matrix[0][2] * (matrix[1][0] * matrix[2][1] - matrix[1][1] * matrix[2][0])
            if det == 0:
                return 2
            else:
                return 3
        
        @staticmethod
        def Get3x4MatrixRank_Wrong(matrix):
         
            num_rows = len(matrix)
            num_cols = len(matrix[0])
            rank = min(num_rows, num_cols)
        
            for i in range(num_rows):
                for j in range(i+1, num_cols):
                    if matrix[i][j] != 0:
                        rank -= 1
                        break

            return rank

        @staticmethod
        def Get3x4MatrixRank(matrix):
            num_rows = len(matrix)
            num_cols = len(matrix[0])
            rank = min(num_rows, num_cols)

            for i in range(num_rows):
                if matrix[i][i] != 0:
                    for j in range(i + 1, num_rows):
                        ratio = matrix[j][i] / matrix[i][i]
                        for k in range(i, num_cols):
                            matrix[j][k] -= ratio * matrix[i][k]
                else:
                    reduce = True
                    for j in range(i + 1, num_rows):
                        if matrix[j][i] != 0:
                            matrix[i], matrix[j] = matrix[j], matrix[i]
                            reduce = False
                            break
                    if reduce:
                        rank -= 1
                        for j in range(num_rows):
                            matrix[j][i] = matrix[j][num_cols - 1]
                        num_cols -= 1
                        i -= 1
            
            return rank


    @staticmethod
    def SimplifyVertices(poly):
        if isinstance(poly,rg.Curve):
            polyL = poly.TryGetPolyline()[1]
        elif isinstance(poly,rg.Polyline):
            polyL = poly
        
        newPtList = []
        segments = polyL.GetSegments()
        
        newPtList.append(polyL.First)
        for i in range(len(segments)-1):
            currSeg = segments[i]
            nextSeg = segments[i+1]
        
            vecA = rg.Vector3d(currSeg.To - currSeg.From)
            vecB = rg.Vector3d(nextSeg.To - nextSeg.From)
            
            if rg.Vector3d.VectorAngle(vecA,vecB) > 0.001:
                newPtList.append(nextSeg.From)
                
        newPtList.append(polyL.Last)
        simplifiedPolyL = rg.Polyline(newPtList)
        simplifiedPolyCrv = simplifiedPolyL.ToPolylineCurve()
        
        return simplifiedPolyCrv
                
    @staticmethod
    def ConvertPolylineCurveToPolyline(polyCrv):
        #convert back to polyline
        if isinstance(polyCrv,rg.PolylineCurve):
            pointCount = polyCrv.PointCount

        polyline = rg.Polyline(pointCount)
        for i in range(pointCount):
            polyline.Add(polyCrv.Point(i))
        return polyline
# ---------- end ghpython_script ----------
ghpython_script_2 = GhPythonScript()  # -> out, DM
# ---------- ghpython_script_2: Python ----------
###########################
####    Import Libs    ####
###########################
import Rhino.Geometry as rg
#import Rhino.RhinoDoc as rd
import Rhino.RhinoMath as rm
#import ghpythonlib.components as ghc





###########################
####    Data Mapping   ####
###########################
class DM:
    class MappingPixel:
        def __init__(self,pixel,rowIndex,columnIndex):
            self.pixel = pixel                             
            self.centroid = rg.AreaMassProperties.Compute(self.pixel).Centroid
            self.position = rg.Point3d(rowIndex,columnIndex,0)
            self.documentedTriangle = []   
        
        def __del__(self):
            self.pixel = None
            self.centroid = None
            self.position = None
            self.documentedTriangle = None
            #rh.RhinoApp.WriteLine("Kill a MappingPixel ")
    class MappingGrid:
        def __init__(self):
            self.grid = None                     
            self.rows = None                     
            self.columns = None
            self.orgin = None
            self.e = None
        
        def __del__(self):
            for i in range(self.rows):
                self.grid[i] = None
            self.grid = None
            self.columns = None
            self.rows = None
            self.orgin = None
            self.e = None
            #rh.RhinoApp.WriteLine("Kill a MappingGrid ")
            
        def GetSqaure(self,halfSize,Xcord,Ycord):
            
            pt1=rg.Point3d(Xcord - halfSize , Ycord - halfSize ,0)
            pt2=rg.Point3d(Xcord - halfSize , Ycord + halfSize ,0)
            pt3=rg.Point3d(Xcord + halfSize , Ycord + halfSize ,0)
            pt4=rg.Point3d(Xcord + halfSize , Ycord - halfSize ,0)
            
            #remember to add the last point
            return rg.Polyline([pt1,pt2,pt3,pt4,pt1]).ToPolylineCurve()
        
        def CreateMappingGrid(self,input,density=100,extendNum=5):
            # get BoundingBox
            obb = input.BoundingBox
            
            # get the edge length
            dist1 = obb.Max.X - obb.Min.X
            dist2 = obb.Max.Y - obb.Min.Y
            
            e1 = dist1/density
            e2 = dist2/density
            
            if e1<=e2:
                
                num1 = int(dist1/e1)
                num2 = int(int(dist2/e1)+1)
            
            else:
                num1 = int(int(dist1/e2)+1)
                num2 = int(dist2/e2)
                
            eMin = min([e1,e2])
            
            e=eMin
            
            ## set the orgin
            orginX = obb.Min.X - extendNum*e
            orginY = obb.Min.Y - extendNum*e
            
            #print obb.Min.X,obb.Min.Y
            ###########
            #so far all the info is prepared
            #orginX,orginY,e,num1,num2
        
        
            # create a store
            gridlist=[]
            
            for i in range(num1+extendNum*2):
               gridlist.append([])
        
            for rowIndex in range(num1+extendNum*2):
                for columnIndex in range(num2+extendNum*2):
                    mappingPixel = DM.MappingPixel(self.GetSqaure(e*0.5,rowIndex*e+orginX,columnIndex*e+orginY),rowIndex,columnIndex )
                    gridlist[rowIndex].append(mappingPixel)
                    
            self.grid = gridlist
            
            self.rows = num1+extendNum*2
            self.columns = num2+extendNum*2
            self.orgin = rg.Point3d(orginX,orginY,0)
            
            self.e = e
    

    
        ###################################################
        def GetTriangleDetectRegion(self,triangle,time=2):
            e = self.e
            # print "asd"
            # print triangle[0].X,triangle[0].Y,0
            # print triangle[1].X,triangle[1].Y,0
            # print triangle[2].X,triangle[2].Y,0
            # obb = ghc.BoundingBox(triangle,rg.Plane.WorldXY)[0].BoundingBox 
            
            Xs = [triangle[0].X,triangle[1].X,triangle[2].X]
            Ys = [triangle[0].Y,triangle[1].Y,triangle[2].Y]
            
            maxPt = rg.Point3d(max(Xs),max(Ys),0)
            minPt = rg.Point3d(min(Xs),min(Ys),0)

            minPt_New = rg.Point3d(minPt.X-time*e,minPt.Y-time*e,0)
            maxPt_New = rg.Point3d(maxPt.X+time*e,maxPt.Y+time*e,0)
            obbFlat = rg.Rectangle3d(rg.Plane.WorldXY,maxPt_New,minPt_New)
            
            
            startRowIndex,startColumnIndex = self.RemapPosition(minPt_New)
            endRowIndex,endColumnIndex = self.RemapPosition(maxPt_New)
            
            
            detectRegion = []
            for i in range(startRowIndex,endRowIndex,1):
                for j in range(startColumnIndex,endColumnIndex,1):
                    
                    detectRegion.append(self.grid[i][j])
            
            return detectRegion
        
        def GetTriangleDetectRegion_Old(self,centroid,detectRadius):


            intCentroidRow,intCentroidColumn= self.RemapPosition(centroid)
            
             
            newRowIndex=intCentroidRow-detectRadius
            newColumnIndex=intCentroidColumn-detectRadius
            
        
            detectRegion=[]
            
            for i in range(detectRadius*2):
                for j in range(detectRadius*2):
                    detectRegion.append(self.grid[newRowIndex][newColumnIndex+j])
                newRowIndex+=1
            
       
            return detectRegion
            
            
        def GetOverlappedTriangleIndex(self,processMesh,detectRadius=2):
            
            triangleList=processMesh.triangleList
            
            
            #################################
            ### calculate the overlapping ###
            #################################
            
            #tol = rd.ActiveDoc.ModelAbsoluteTolerance
            tol = 0.001
            for faceIndex in range(len(triangleList)):
                
                triangle=triangleList[faceIndex].triangleBoundary

                detectRegion=self.GetTriangleDetectRegion(triangle,detectRadius)

                triangle=triangleList[faceIndex].triangleBoundary

                    
                for detectPixel in detectRegion:
                    
                    if rg.Intersect.Intersection.CurveCurve(detectPixel.pixel, triangle.ToPolylineCurve(),tol,tol).Count!=0 or int(triangle.ToPolylineCurve().Contains(detectPixel.centroid))==1:

                        pixelPosition=detectPixel.position
                    
                        pixelLocation=(int(pixelPosition.X),int(pixelPosition.Y))
       
                        self.grid[pixelLocation[0]][pixelLocation[1]].documentedTriangle.append(faceIndex)
                        
             
        def RemapPosition(self,pt):
            orginX = self.orgin.X
            orginY = self.orgin.Y
            e = self.e
            
            remapX = int(round((pt.X-orginX)/e))
            remapY = int(round((pt.Y-orginY)/e))
            
            return (remapX,remapY)
# ---------- end ghpython_script_2 ----------

# ----
# Libs
ghpython_script_3 = GhPythonScript()  # -> out, SLG
# ---------- ghpython_script_3: Python ----------
###########################
####    Import Libs    ####
###########################
import Rhino.Geometry as rg
#import Rhino.RhinoDoc as rd
import Rhino.RhinoMath as rm


import random





######################################
####    Streamline Generation     ####
######################################
class SLG:
    #########################
    ########streamline#######
    #########################
    class StreamlineVertex:
        def __init__(self,vertex):
            self.geometry=vertex   
            
        def __del__(self):
            self.vertex=None
            
    class StreamlinePoint:
        def __init__(self,point):
            self.geometry=point   
            
        def __del__(self):
            self.point=None
            
    class Streamline:
        def __init__(self):
            self.startVertex = None              
            self.endVertex = None                  
            self.betweenPoints = []          
            #self.geometry = None
            
            self.scoreSingularity = None
            self.scoreContinuity = None
            self.scoreDivergence = None

            self.scoreEvenArea = None
            self.scoreElongation = None
            self.scoreCompactness = None
            self.scoreConvexity = None
            self.scoreOrientation = None
            
            self.evenAreaValue = None
            self.elongationPair = None
            self.areaPair = None
            self.convexityPair = None
            self.compactnessPair = None
            self.orientationPair = None
            
            score_Part1 = None
            score_Part2 = None
            self.scoreOverall = None
        
        def __del__(self):
            self.startVertex = None              
            self.endVertex = None                  
            self.betweenPoints = None          
            #self.geometry = None
            
            self.scoreSingularity = None
            self.scoreContinuity = None
            self.scoreDivergence = None
            self.scoreEvenArea = None
            self.scoreElongation = None
            self.scoreCompactness = None
            self.scoreConvexity = None
            self.scoreOrientation = None
            
            self.evenAreaValue = None
            self.elongationPair = None
            self.areaPair = None
            self.convexityPair = None
            self.compactnessPair = None
            self.orientationPair = None
            
            score_Part1 = None
            score_Part2 = None
            self.scoreOverall = None
            
        def GetGeometry(self):
            allPoints=[]
            
            allPoints.append(self.startVertex.geometry)
            for point in self.betweenPoints:
                
                allPoints.append(point.geometry)
            
            allPoints.append(self.endVertex.geometry)
            
            return rg.Polyline(allPoints)
        
        def CreateStreamlineInstance(self,streamline):
            streamlinePoints = [] 
            for i in range(len(streamline)):
                streamlinePoints.append(streamline[i])
            
            betweenPoints=[]

            for i in range(len(streamlinePoints)):
                if i==0:
                    self.startVertex = SLG.StreamlineVertex(streamlinePoints[i])
                elif i == len(streamlinePoints)-1:
                    self.endVertex = SLG.StreamlineVertex(streamlinePoints[i])
                
                else:
                    self.betweenPoints.append(SLG.StreamlinePoint(streamlinePoints[i]))
  
        def Reverse(self):
            temp=self.startVertex
            self.startVertex=self.endVertex
            self.endVertex=temp
            self.betweenPoints.reverse()
            
            
    class StreamlineNetwork:
        def __init__(self):
            self.network = []
            

        def DetectVertices(self,pointList,seedpointList,streamline,detectDistance):
                spL = seedpointList.list
                detectedVertices=[]
                if len(pointList)>1:
                    for seedpoint in spL:

                        pt=streamline.ClosestPoint (seedpoint.vh.geometry)
                        distance=seedpoint.vh.geometry.DistanceTo(pt)
                        if distance<=detectDistance:
                            detectedVertices.append(seedpoint)
                
                return detectedVertices
    
        def UpdateActivityStatus(self,processMesh,seedpointList,streamline,thisSeedpoint,tag):
            
            streamlineClosestPt=streamline.ClosestPoint(thisSeedpoint.vh.geometry)
            thisVector=rg.Vector3d(streamlineClosestPt-thisSeedpoint.vh.geometry)
            
            
            if thisSeedpoint.vh.crossField[0]!=None and thisVector.Length!=0:
                
                angle1=rm.ToDegrees(rg.Vector3d.VectorAngle(thisVector,thisSeedpoint.vh.crossField[0]))
                angle2=rm.ToDegrees(rg.Vector3d.VectorAngle(thisVector,thisSeedpoint.vh.crossField[1]))
                angle3=rm.ToDegrees(rg.Vector3d.VectorAngle(thisVector,thisSeedpoint.vh.crossField[2]))
                angle4=rm.ToDegrees(rg.Vector3d.VectorAngle(thisVector,thisSeedpoint.vh.crossField[3]))
                
                anglelist=[angle1,angle2,angle3,angle4]
                minAngleIndex=anglelist.index(min(anglelist))
        
                
                if minAngleIndex == 0 or minAngleIndex == 2:
                    thisSeedpoint.secondActivityStatus= False
                     
                    
                elif minAngleIndex == 1 or minAngleIndex == 3:
                    thisSeedpoint.firstActivityStatus= False
            
            #if its the startPoint
            elif thisSeedpoint.vh.crossField[0]==None or thisVector.Length==0:
                if tag=="first":
                    thisSeedpoint.firstActivityStatus=False
                    
                elif tag=="second":
                    thisSeedpoint.secondActivityStatus=False


        def UpdateSeedPointList(self,seedpointList,detectedVertices):
            spL = seedpointList.list
            
            for detectedVertex in detectedVertices:
                if detectedVertex.firstActivityStatus == False and  detectedVertex.secondActivityStatus == False :
                    detectedVertex.validity = False
                    if detectedVertex in spL:
                        spL.remove(detectedVertex)
                        
        def GetBarycentricCoefficient(self,threeVertices,ptX):
            #get the vertices of triangle
            pointA=threeVertices[0]
            pointB=threeVertices[1]
            pointC=threeVertices[2]
            
            #area of this triangle

            areaABC=rg.Vector3d.CrossProduct(rg.Vector3d(pointB-pointA) ,rg.Vector3d(pointC-pointA) ).Length *0.5
            
            #area of first subtriangle
            Nc=rg.Vector3d.CrossProduct(rg.Vector3d(pointB-pointA),rg.Vector3d(ptX-pointA))
            Ncc=rg.Vector3d.CrossProduct(rg.Vector3d(pointB-pointA),rg.Vector3d(pointC-pointA))
            mc=rg.Vector3d.Multiply(Nc,Ncc)
            
            if mc>=0:
                areaABX=0.5*Nc.Length
            
            else:
                areaABX=-0.5*Nc.Length
            
            coefficientc=areaABX/areaABC
            
            #area of second subtriangle
            Nb=rg.Vector3d.CrossProduct(rg.Vector3d(pointA-pointC),rg.Vector3d(ptX-pointC))
            Nbb=rg.Vector3d.CrossProduct(rg.Vector3d(pointA-pointC),rg.Vector3d(pointB-pointC))
            mb=rg.Vector3d.Multiply(Nb,Nbb)
            
            if mb>=0:
                areaAXC=0.5*Nb.Length
            
            else:
                areaAXC=-0.5*Nb.Length
            
            coefficientb=areaAXC/areaABC
            
            
            
            #area of third subtriangle
            Na=rg.Vector3d.CrossProduct(rg.Vector3d(pointC-pointB),rg.Vector3d(ptX-pointB))
            Naa=rg.Vector3d.CrossProduct(rg.Vector3d(pointC-pointB),rg.Vector3d(pointA-pointB))
            ma=rg.Vector3d.Multiply(Na,Naa)
            
            if ma>=0:
                areaXBC=0.5*Na.Length
            
            else:
                areaXBC=-0.5*Na.Length
            
            coefficienta=areaXBC/areaABC
            
            
            return (coefficienta,coefficientb,coefficientc)
        
            
        def GetNewVector(self,mappingGrid,processMesh,point,pointList):
            triRemeshBoundary =  processMesh.triRemeshBoundary.ToPolylineCurve()
            vList = processMesh.vertexList
            fList = processMesh.triangleList
            
        
            
            thisPointRow=int(round(point.X))
            thisPointColumn=int(round(point.Y))
            thisPointRow,thisPointColumn = mappingGrid.RemapPosition(point)
            coefficient=[]
            
            #situation:out of boundary
            #tol = rd.ActiveDoc.ModelAbsoluteTolerance
            tol = 0.001
            if int(triRemeshBoundary.Contains (point,rg.Plane.WorldXY,tol))==2:

                return None,None,"case4"
                
            #situation:out of canvas
            if thisPointRow > mappingGrid.rows or thisPointColumn > mappingGrid.columns or thisPointRow < 0 or thisPointColumn < 0:

                return None,None,"case4"

            if int(triRemeshBoundary.Contains (point,rg.Plane.WorldXY,tol))==3:

                return None,None,"case5"    # coincident

            for triangleIndex in mappingGrid.grid[thisPointRow][thisPointColumn].documentedTriangle:
                threeVertices = fList[triangleIndex].triangleVertices
                threeVertices_geo = [threeVertices[0].geometry,threeVertices[1].geometry,threeVertices[2].geometry]
                
                coefficients=self.GetBarycentricCoefficient(threeVertices_geo,point)
                
                if coefficients[0]>=0 and coefficients[1]>=0 and coefficients[2]>=0:
                    break
            
            
            u=float(coefficients[0])
            v=float(coefficients[1])
            w=float(coefficients[2])
            
            
            
            ptListLength=len(pointList)
            
            thisVector=rg.Vector3d(pointList[ptListLength-2]-pointList[ptListLength-1])
            
            vec_a,vec_b,vec_c = self.GetAccordingMaxVec(threeVertices,thisVector)
            newVector=u * vec_a + v * vec_b +w * vec_c
            newVector.Unitize()
            
            flag = "Normal"
            ##### medial axis case or concave case#####
            if fList[triangleIndex].is_MedialAxis == 1:
                flag = "Special"

            return newVector,triangleIndex,flag
            
        def GetAccordingMaxVec(self,threeVertices,thisVector):
            vertex_a = threeVertices[0]
            vertex_b = threeVertices[1]
            vertex_c = threeVertices[2]
            
            
            ###
            vectorangle1=rm.ToDegrees(rg.Vector3d.VectorAngle(thisVector,vertex_a.crossField[0]))
            vectorangle2=rm.ToDegrees(rg.Vector3d.VectorAngle(thisVector,vertex_a.crossField[1]))
            vectorangle3=rm.ToDegrees(rg.Vector3d.VectorAngle(thisVector,vertex_a.crossField[2]))
            vectorangle4=rm.ToDegrees(rg.Vector3d.VectorAngle(thisVector,vertex_a.crossField[3]))

            angleList = [vectorangle1,vectorangle2,vectorangle3,vectorangle4]
            maxAngleIndex=angleList.index(max(angleList))
            chosenVector_a =vertex_a.crossField[maxAngleIndex]
            ###
            vectorangle1=rm.ToDegrees(rg.Vector3d.VectorAngle(thisVector,vertex_b.crossField[0]))
            vectorangle2=rm.ToDegrees(rg.Vector3d.VectorAngle(thisVector,vertex_b.crossField[1]))
            vectorangle3=rm.ToDegrees(rg.Vector3d.VectorAngle(thisVector,vertex_b.crossField[2]))
            vectorangle4=rm.ToDegrees(rg.Vector3d.VectorAngle(thisVector,vertex_b.crossField[3]))
            
            angleList = [vectorangle1,vectorangle2,vectorangle3,vectorangle4]
            maxAngleIndex=angleList.index(max(angleList))
            chosenVector_b =vertex_b.crossField[maxAngleIndex]
            ###
            vectorangle1=rm.ToDegrees(rg.Vector3d.VectorAngle(thisVector,vertex_c.crossField[0]))
            vectorangle2=rm.ToDegrees(rg.Vector3d.VectorAngle(thisVector,vertex_c.crossField[1]))
            vectorangle3=rm.ToDegrees(rg.Vector3d.VectorAngle(thisVector,vertex_c.crossField[2]))
            vectorangle4=rm.ToDegrees(rg.Vector3d.VectorAngle(thisVector,vertex_c.crossField[3]))
            
            angleList = [vectorangle1,vectorangle2,vectorangle3,vectorangle4]
            maxAngleIndex=angleList.index(max(angleList))
            chosenVector_c =vertex_c.crossField[maxAngleIndex]
            
            return chosenVector_a,chosenVector_b,chosenVector_c

        def GetTempPoint_LowOrder(self,startPoint,dL,startPointVector):
            temppoint = rg.Point3d.Add(startPoint,startPointVector*dL)

            return temppoint
            
        def CalculateMaxAngle_NormalCase(self,processMesh,triangleIndex,pointList,newVector):
    
            ptListLength=len(pointList)
            thisVector=rg.Vector3d(pointList[ptListLength-2]-pointList[ptListLength-1])
        
            wxy_plane=rg.Plane.WorldXY
            ZAxis=wxy_plane.ZAxis
            
            
            vector1=newVector
            vector2 = rg.Vector3d(vector1)
            vector3 = rg.Vector3d(vector1)
            vector4 = rg.Vector3d(vector1)
            
            vector2.Rotate(rm.ToRadians(90),ZAxis)
            vector3.Rotate(rm.ToRadians(180),ZAxis)
            vector4.Rotate(rm.ToRadians(270),ZAxis)
            
            vectorangle1=rm.ToDegrees(rg.Vector3d.VectorAngle(thisVector,vector1))
            vectorangle2=rm.ToDegrees(rg.Vector3d.VectorAngle(thisVector,vector2))
            vectorangle3=rm.ToDegrees(rg.Vector3d.VectorAngle(thisVector,vector3))
            vectorangle4=rm.ToDegrees(rg.Vector3d.VectorAngle(thisVector,vector4))

            vectorList=[newVector,vector2,vector3,vector4]
            angleList = [vectorangle1,vectorangle2,vectorangle3,vectorangle4]

            maxAngleIndex=angleList.index(max(angleList))
        
            chosenVector=vectorList[maxAngleIndex]
            
            return chosenVector
            
        def CalculateMaxAngle_SpecialCase(self,processMesh,triangleIndex,pointList,newVector):
            
            
            fList = processMesh.triangleList
            
            ptListLength=len(pointList)
            thisVector=rg.Vector3d(pointList[ptListLength-2]-pointList[ptListLength-1])
    
            wxy_plane=rg.Plane.WorldXY
            ZAxis=wxy_plane.ZAxis
            
    
            vector13 = newVector 
            vector14 = rg.Vector3d(vector13)
            vector15 = rg.Vector3d(vector13)
            vector16 = rg.Vector3d(vector13)
            
            vector14.Rotate(rm.ToRadians(90),ZAxis)
            vector15.Rotate(rm.ToRadians(180),ZAxis)
            vector16.Rotate(rm.ToRadians(270),ZAxis)
            
            threeVertices = fList[triangleIndex].triangleVertices
            
            
     
            a=threeVertices[0]
            b=threeVertices[1]
            c=threeVertices[2]

            
            vector17=a.crossField[0]
            vector18=a.crossField[1]
            vector19=a.crossField[2]
            vector20=a.crossField[3]
            
            vector21=b.crossField[0]
            vector22=b.crossField[1]
            vector23=b.crossField[2]
            vector24=b.crossField[3]
            
            vector25=c.crossField[0]
            vector26=c.crossField[1]
            vector27=c.crossField[2]
            vector28=c.crossField[3]
            
            #################################################################
            vectorangle13=rm.ToDegrees(rg.Vector3d.VectorAngle(thisVector,vector13))
            vectorangle14=rm.ToDegrees(rg.Vector3d.VectorAngle(thisVector,vector14))
            vectorangle15=rm.ToDegrees(rg.Vector3d.VectorAngle(thisVector,vector15))
            vectorangle16=rm.ToDegrees(rg.Vector3d.VectorAngle(thisVector,vector16))
            vectorangle17=rm.ToDegrees(rg.Vector3d.VectorAngle(thisVector,vector17))
            vectorangle18=rm.ToDegrees(rg.Vector3d.VectorAngle(thisVector,vector18))
            vectorangle19=rm.ToDegrees(rg.Vector3d.VectorAngle(thisVector,vector19))
            vectorangle20=rm.ToDegrees(rg.Vector3d.VectorAngle(thisVector,vector20))
            vectorangle21=rm.ToDegrees(rg.Vector3d.VectorAngle(thisVector,vector21))
            vectorangle22=rm.ToDegrees(rg.Vector3d.VectorAngle(thisVector,vector22))
            vectorangle23=rm.ToDegrees(rg.Vector3d.VectorAngle(thisVector,vector23))
            vectorangle24=rm.ToDegrees(rg.Vector3d.VectorAngle(thisVector,vector24))
            vectorangle25=rm.ToDegrees(rg.Vector3d.VectorAngle(thisVector,vector25))
            vectorangle26=rm.ToDegrees(rg.Vector3d.VectorAngle(thisVector,vector26))
            vectorangle27=rm.ToDegrees(rg.Vector3d.VectorAngle(thisVector,vector27))
            vectorangle28=rm.ToDegrees(rg.Vector3d.VectorAngle(thisVector,vector28))
            
            

            vectorList=[vector13,vector14,vector15,vector16,vector17,vector18,vector19,vector20,vector21,vector22,vector23,vector24,vector25,vector26,vector27,vector28]
            angleList= [vectorangle13,vectorangle14,vectorangle15,vectorangle16,vectorangle17,vectorangle18,vectorangle19,vectorangle20,vectorangle21,vectorangle22,vectorangle23,vectorangle24,vectorangle25,vectorangle26,vectorangle27,vectorangle28]
            #print "use all " 

            # vectorList=[vector17,vector18,vector19,vector20,vector21,vector22,vector23,vector24,vector25,vector26,vector27,vector28]
            # angleList= [vectorangle17,vectorangle18,vectorangle19,vectorangle20,vectorangle21,vectorangle22,vectorangle23,vectorangle24,vectorangle25,vectorangle26,vectorangle27,vectorangle28]
            # print "dont use barycenter"    
            
            # vectorList=[vector13,vector14,vector15,vector16]
            # angleList= [vectorangle13,vectorangle14,vectorangle15,vectorangle16]
            # print "dont use orginal"

            maxAngleIndex=angleList.index(max(angleList))
    
            chosenVector=vectorList[maxAngleIndex]
            
            return chosenVector
            
            
        def GetStreamlinePointList(self,mappingGrid,processMesh,startPoint,choice,dL,threshold=400):
            #tol = rd.ActiveDoc.ModelAbsoluteTolerance
            tol = 0.001
            if choice!= "Specific":

                triRemeshBoundary =  processMesh.triRemeshBoundary
                pointList=[]
                pointList.append(startPoint.vh.geometry)
                startPointVector=startPoint.vh.crossField[choice]
                startPoint=startPoint.vh.geometry
            
            elif choice == "Specific":
                triRemeshBoundary =  processMesh.triRemeshBoundary
                wxy_Plane=rg.Plane.WorldXY

                
                triRemeshBoundary_curve = triRemeshBoundary.ToPolylineCurve()
                offset1= triRemeshBoundary_curve.Offset(wxy_Plane,tol,tol,rg.CurveOffsetCornerStyle.Sharp)[0]
                offset2= triRemeshBoundary_curve.Offset(wxy_Plane,-tol,tol,rg.CurveOffsetCornerStyle.Sharp)[0]
                
                
                if offset1.GetLength() > offset2.GetLength() :
                    offsetTriRemeshBoundary = offset1
                else:
                    offsetTriRemeshBoundary = offset2

                pointList=[]
                
                pointList.append(startPoint)
                t =offsetTriRemeshBoundary.ClosestPoint(startPoint)[1]
                closestPt = offsetTriRemeshBoundary.PointAt(t)
                startPointVector=rg.Vector3d(startPoint-closestPt)
                startPointVector.Unitize()
            
            
            ### start calculating new point
            newPoint=self.GetTempPoint_LowOrder(startPoint,dL,startPointVector)
            pointList.append(newPoint)
            
            
            ######avoid possible infinite situation.  otherwise it shoule be while GetNewVector(...)!=None
            for i in range(threshold):
                caseResult= self.GetNewVector(mappingGrid,processMesh,newPoint,pointList)
            
                newVector = caseResult[0]
                triangleIndex = caseResult[1]
                flag = caseResult[2]
                #meaning its concave or medial axis situation
                
                if flag == "Special":
                    
                    maxVector=self.CalculateMaxAngle_SpecialCase(processMesh,triangleIndex,pointList,newVector)
                    newPoint=self.GetTempPoint_LowOrder(newPoint,dL,maxVector)
        
                    pointList.append(newPoint)
                    
                elif flag == "Normal":

                    maxVector=self.CalculateMaxAngle_NormalCase(processMesh,triangleIndex,pointList,newVector)
                    newPoint=self.GetTempPoint_LowOrder(newPoint,dL,maxVector)
                    pointList.append(newPoint)
                
                #it goes out of boundary already
                elif flag =="case1" or flag =="case4":
                    line=rg.Line((pointList[len(pointList)-2]),(pointList[len(pointList)-1]))
                    
                  
                    for i in range(triRemeshBoundary.SegmentCount) :
                        
                        if rg.Intersect.Intersection.LineLine(triRemeshBoundary.SegmentAt(i),line,tol,True)[0]==True:
                            
                            #make sure the end is perpendicular 
                            thisSegement = triRemeshBoundary.SegmentAt(i)
                            #lastPoint = thisSegement.ClosestPoint (pointList[len(pointList)-2],True)
                            
                            t = rg.Intersect.Intersection.LineLine(thisSegement,line,tol,True)[1]
                            lastPoint=triRemeshBoundary.SegmentAt(i).PointAt(t)
                            
                            pointList.pop()
                            pointList.append(lastPoint)
                    
                    if pointList[len(pointList)-1].DistanceTo(pointList[len(pointList)-2]) < tol:
                            pointList.pop(len(pointList)-2)
                    
                    #print "case1,4", 
                    #for pt in pointList:
                        #print pt.X,pt.Y,0
                    break
                    
                elif flag=="case5":
                    coindicentPt = pointList[-1]
                    lastPt =triRemeshBoundary.ClosestPoint(coindicentPt)
                    pointList.pop()
                    pointList.append(lastPt)
                    #print "case5", pointList[0],pointList[-1]
                    break

                #step is too small and it intersect with boundary:
                #checkPolyL = rg.Polyline(pointList)
                checkPolyL = rg.Polyline([pointList[-2],pointList[-1]])
                if rg.Intersect.Intersection.CurveCurve(checkPolyL.ToPolylineCurve(),triRemeshBoundary.ToPolylineCurve(),tol,tol).Count >1:

                    # ptA = rg.Intersect.Intersection.CurveCurve(checkPolyL.ToPolylineCurve(),triRemeshBoundary.ToPolylineCurve(),tol,tol).Item[0].PointA
                    # ptB = rg.Intersect.Intersection.CurveCurve(checkPolyL.ToPolylineCurve(),triRemeshBoundary.ToPolylineCurve(),tol,tol).Item[1].PointA
                    # print "intersection PtA "
                    # print ptA.X,ptA.Y,ptA.Z
                    # print "intersection PtB "
                    # print ptB.X,ptB.Y,ptB.Z
                    # print "startPt"
                    # print startPoint.X,startPoint.Y,startPoint.Z
                    pointList.pop()
                    closestEndPt =rg.Intersect.Intersection.CurveCurve(checkPolyL.ToPolylineCurve(),triRemeshBoundary.ToPolylineCurve(),tol,tol).Item[0].PointA
                    pointList.append(closestEndPt)
                    #print "closestEndPt", closestEndPt.X, closestEndPt.Y, closestEndPt.Z
                    if pointList[len(pointList)-1].DistanceTo(pointList[len(pointList)-2]) < tol:
                            pointList.pop(len(pointList)-2)
                            
                    #print "last", pointList[0],pointList[-1]
                    break
                
            return pointList


        def GetJoinedStreamline(self,mappingGrid,processMesh,startPoint,vectorIndex_1,vectorIndex_2,dL):
            
            triRemeshBoundary =  processMesh.triRemeshBoundary
            
            pointList1=self.GetStreamlinePointList(mappingGrid,processMesh,startPoint,vectorIndex_1,dL,threshold=400)
            pointList2=self.GetStreamlinePointList(mappingGrid,processMesh,startPoint,vectorIndex_2,dL,threshold=400)
            
            
            #reverse direction and delete the overlapping point
            pointList1.reverse()
             
            if len(pointList1)>=1:
                pointList1.pop()
                
            pointList1.extend(pointList2)
            fullPointList=pointList1
            
            if len(fullPointList)>1:
        
                return fullPointList
            else:
                return None
                    
        def GetStreamlineNetwork_Random(self,mappingGrid,processMesh,seedpointList,detectDistance,dL):
            
            streamlines=[]
            
            spL=seedpointList.list

            #    for num in testnum:
            #for i in range(10):
            whileCount = 0
            while len(spL)>0:
                if whileCount>1000:
                    break
                restSeedpoint = []
                for i in range(len(spL)):
                    restSeedpoint.append(i)
                ######### testing loop  ##########
                randomindex=random.sample(restSeedpoint,1)[0]
                #tol = rd.ActiveDoc.ModelAbsoluteTolerance
                tol = 0.001
                startPoint = spL[randomindex]
                ##### first direction #####
                if startPoint.firstActivityStatus == True:
                    startPoint.firstActivityStatus = False
                    pointList1=self.GetJoinedStreamline(mappingGrid,processMesh,startPoint,0,2,dL)
                    
                    if pointList1!=None:
                        if len(pointList1)>1:
                            streamline1=rg.Polyline(pointList1)
                            
                            if rg.Intersect.Intersection.CurveSelf(streamline1.ToPolylineCurve(),tol).Count ==0:
                                streamlines.append(streamline1)
                                
                        
                        if rg.Intersect.Intersection.CurveSelf(streamline1.ToPolylineCurve(),tol).Count==0 and len(pointList1)>0:
                            changenote1=self.DetectVertices(pointList1,seedpointList,streamline1,detectDistance)
                        else:
                            changenote1=[]
                    
                        if len(changenote1)>0:
                            for thisSeedpoint in changenote1:
                                self.UpdateActivityStatus(processMesh,seedpointList,streamline1,thisSeedpoint,"first")
                        
                        self.UpdateSeedPointList(seedpointList,changenote1)

                ##### second direction #####
                if startPoint.secondActivityStatus == True:
                    startPoint.secondActivityStatus = False
                    pointList2 = self.GetJoinedStreamline(mappingGrid,processMesh,startPoint,1,3,dL)
                    
                    if pointList2!=None:
                        if len(pointList2)>1:
                            streamline2=rg.Polyline(pointList2)
                
                            if rg.Intersect.Intersection.CurveSelf(streamline2.ToPolylineCurve(),tol).Count ==0:
                                streamlines.append(streamline2)
                                
                        if rg.Intersect.Intersection.CurveSelf(streamline2.ToPolylineCurve(),tol).Count ==0 and len(pointList2)>0:
                            changenote2=self.DetectVertices(pointList2,seedpointList,streamline2,detectDistance)
                        
                        else:
                            changenote2=[]
                            
                        if len(changenote2)>0:
                            for thisSeedpoint in changenote2:
                                self.UpdateActivityStatus(processMesh,seedpointList,streamline2,thisSeedpoint,"second")
        
                        self.UpdateSeedPointList(seedpointList,changenote2)
            
                whileCount+=1
            return streamlines

        def GetStreamlineNetwork(self,mappingGrid,processMesh,seedpointList,detectDistance,dL):
            
            streamlines=[]
            
            spL=seedpointList.list

            #    for num in testnum:
            #for i in range(10):
            whileCount = 0
            while len(spL)>0:
                if whileCount>1000:
                    break
                restSeedpoint = []
                for i in range(len(spL)):
                    restSeedpoint.append(i)
                ######### testing loop  ##########
                randomindex = restSeedpoint[0]
                #tol = rd.ActiveDoc.ModelAbsoluteTolerance
                tol = 0.001
                startPoint = spL[randomindex]
                ##### first direction #####
                if startPoint.firstActivityStatus == True:
                    startPoint.firstActivityStatus = False
                    pointList1=self.GetJoinedStreamline(mappingGrid,processMesh,startPoint,0,2,dL)
                    
                    if pointList1!=None:
                        if len(pointList1)>1:
                            streamline1=rg.Polyline(pointList1)
                            
                            if rg.Intersect.Intersection.CurveSelf(streamline1.ToPolylineCurve(),tol).Count ==0:
                                streamlines.append(streamline1)
                                
                        
                        if rg.Intersect.Intersection.CurveSelf(streamline1.ToPolylineCurve(),tol).Count==0 and len(pointList1)>0:
                            changenote1=self.DetectVertices(pointList1,seedpointList,streamline1,detectDistance)
                        else:
                            changenote1=[]
                    
                        if len(changenote1)>0:
                            for thisSeedpoint in changenote1:
                                self.UpdateActivityStatus(processMesh,seedpointList,streamline1,thisSeedpoint,"first")
                        
                        self.UpdateSeedPointList(seedpointList,changenote1)

                ##### second direction #####
                if startPoint.secondActivityStatus == True:
                    startPoint.secondActivityStatus = False
                    pointList2 = self.GetJoinedStreamline(mappingGrid,processMesh,startPoint,1,3,dL)
                    
                    if pointList2!=None:
                        if len(pointList2)>1:
                            streamline2=rg.Polyline(pointList2)
                
                            if rg.Intersect.Intersection.CurveSelf(streamline2.ToPolylineCurve(),tol).Count ==0:
                                streamlines.append(streamline2)
                                
                        if rg.Intersect.Intersection.CurveSelf(streamline2.ToPolylineCurve(),tol).Count ==0 and len(pointList2)>0:
                            changenote2=self.DetectVertices(pointList2,seedpointList,streamline2,detectDistance)
                        
                        else:
                            changenote2=[]
                            
                        if len(changenote2)>0:
                            for thisSeedpoint in changenote2:
                                self.UpdateActivityStatus(processMesh,seedpointList,streamline2,thisSeedpoint,"second")
        
                        self.UpdateSeedPointList(seedpointList,changenote2)
            
                whileCount+=1
            #print "done once"
            return streamlines
        
        def GetStreamlineOnSpecificPoint(self,pt,mappingGrid,processMesh,dL):
        
            #tol=rd.ActiveDoc.ModelAbsoluteTolerance
            tol = 0.001
            startPoint=pt
            
            # this will only go for 1 direction
            pointList=self.GetStreamlinePointList(mappingGrid,processMesh,startPoint,"Specific",dL)

            if pointList!=None:
                if len(pointList)>1:
                    streamline=rg.Polyline(pointList)
                
                else:
                    streamline=None
            
            return streamline
            

    #########################
    ########Seedpoint########
    #########################
    
    class Seedpoint:
        def __init__(self,vh):
            self.vh = vh           
            self.firstActivityStatus = True
            self.secondActivityStatus = True
            self.validity = True
            
        def __def__(self):
            self.vh = None           
            self.firstActivityStatus = None
            self.secondActivityStatus = None
            self.validity = None
            
    class SeedpointList:
        def __init__(self):     #Rhino: list[Plankton.vh]    C++:OpenMesh:: VertexHandle
            self.list = None
            
        def __def__(self):
            self.list = None
            
        def CreateSeedpointList(self,processMesh,boolean_onEdge,boolean_onMa):
            seedpointList=[]
            vertexList = processMesh.vertexList
            
            if boolean_onEdge == 1 and boolean_onMa == 1:
                for vertex in vertexList:
                    if vertex.is_OnEdge != 1 and vertex.is_MedialAxisVertex != 1:
                        seedpoint=SLG.Seedpoint(vertex)
                        seedpointList.append(seedpoint)
                        
            
            elif boolean_onEdge == 0 and boolean_onMa == 1:
                for vertex in vertexList:
                    if  vertex.is_MedialAxisVertex != 1:
                        seedpoint=SLG.Seedpoint()
                        seedpoint.vh=vertex
                        seedpointList.append(seedpoint)
               
            elif boolean_onEdge == 1 and boolean_onMa == 0:
                for vertex in vertexList:
                    if  vertex.is_OnEdge != 1:
                        seedpoint=SLG.Seedpoint()
                        seedpoint.vh=vertex
                        seedpointList.append(seedpoint)
                        
            elif boolean_onEdge == 0 and boolean_onMa == 0:
                for vertex in vertexList:
                    seedpoint=SLG.Seedpoint()
                    seedpoint.vh=vertex
                    seedpointList.append(seedpoint)
            
            self.list = seedpointList
# ---------- end ghpython_script_3 ----------
ghpython_script_4 = GhPythonScript()  # -> out, EV
# ---------- ghpython_script_4: Python ----------
#!/usr/bin/python
# coding=utf-8
###########################
####    Import Libs    ####
###########################
import Rhino.Geometry as rg
#import Rhino.RhinoDoc as rd
import Rhino.RhinoMath as rm

import ghpythonlib.components as ghc
import math

import clr
#clr.AddReferenceToFile("Wrapper.dll")
# clr.AddReference("Wrapper.dll")
# import Eigen.Wrapper

from System.Collections.Generic import List

###########################
####    Evaluation     ####
###########################
class EV:
    ######################################################
    #########     Streamline Level Score     #############
    ######################################################
    
    @staticmethod
    ######################################################
    ##########           Continuity         ##############
    ######################################################
    def Score_Continuity(streamlines,degree,coefficient):
        scores=[]

        for streamline in streamlines:
            score=0
            
            streamlineVertices=[]
            for index in range(len(streamline)-1):
                streamlineVertices.append(streamline[index])

            
            #global values
            num=len(streamlineVertices)
            length=streamline.Length
            
            #Intermediate values
            direction = rg.Vector3d(0,0,0)
            newVec = rg.Vector3d(0,0,0)
            #mtol = rd.ActiveDoc.ModelAbsoluteTolerance
            mtol = 0.001
            #atol = rd.ActiveDoc.ModelAngleToleranceDegrees
            atol = 0.0174532925199
            for i in range(1,len(streamlineVertices)-1,1):
                direction = streamlineVertices[i]-streamlineVertices[i-1]
                newVec = streamlineVertices[i+1] - streamlineVertices[i]
                angle = rg.Vector3d.VectorAngle(newVec,direction)
                angle = rm.ToDegrees(angle)
                distance = streamlineVertices[i].DistanceTo(streamlineVertices[i+1])
                
                if distance <= (direction.Length +mtol) and angle< (degree+atol):
                    score+=1

            
            score=score/num
            
            score=score*(1/(length**coefficient))
        
            scores.append(score)
            

        return scores
    
    
    
    
    
    ######################################################
    ##########           Singularity        ##############
    ######################################################
    
    #abondoned
    @staticmethod
    def Score_Singularity_Abondoned(streamlines,processMesh):
        
        #collection singularities
        singularities = []
        
        for triangle in processMesh.triangleList:
            if triangle.is_Singularity == True:
                singularities.append(triangle.centroid)
        
        #print "len of singularities", len(singularities)
        distances=[]
        
        for i in range(len(streamlines)):
            distances.append([])
        
        for i in range(len(streamlines)):
            for j in range (len(singularities)):
                closestPt = streamlines[i].ClosestPoint(singularities[j])
                distance=closestPt.DistanceTo(singularities[j])
                distances[i].append(distance)
                
        
        shortestDistances=[]
        for i in range(len(distances)):
            shortestDistances.append(min(distances[i]))
            
        score = shortestDistances
        
        return score

    @staticmethod
    def GetSingularityTriangleInfo_Old(processMesh):
        sinIndices = []
        coefficients_Collection = []
        for index in range(len(processMesh.triangleList)):
            # get threeRelated
            processTriangle = processMesh.triangleList[index]
            threeVertices = processTriangle.triangleVertices
            
            
            # find the minVec for every neighbor
            
            vi=threeVertices[0].geometry
            vj=threeVertices[1].geometry
            vk=threeVertices[2].geometry
            
            vecD_i = threeVertices[0].standard
            vecD_j = threeVertices[1].standard
            vecD_k = threeVertices[2].standard
            
            #Matrix A
            A = [vecD_i.X,vecD_j.X,vecD_k.X,vecD_i.Y,vecD_j.Y,vecD_k.Y,1.0,1.0,1.0]
            A = List[float](A)
            rankA = Eigen.Wrapper.OptimizationMethods.GetMatrixRank(3,3,A)
            
            
            #augmented Matrix A
            aA = [vecD_i.X,vecD_j.X,vecD_k.X,0.0,vecD_i.Y,vecD_j.Y,vecD_k.Y,0.0,1.0,1.0,1.0,1.0]
            aA = List[float](aA)
            rankaA = Eigen.Wrapper.OptimizationMethods.GetMatrixRank(3,4,aA)
            

            
            if rankA == rankaA: # there might be a singularity
            
                A = [vecD_i.X,vecD_j.X,vecD_k.X,vecD_i.Y,vecD_j.Y,vecD_k.Y,1.0,1.0,1.0]
                b = [0.0,0.0,1.0]
                
                A = List[float](A)
                b = List[float](b)
                
                coefficients = Eigen.Wrapper.OptimizationMethods.SolveLinearSystem(3,3,A,b)
                
                if coefficients[0]>0 and coefficients[1]>0 and coefficients[2]>0:
                    sinIndices.append(index)
                    coefficients_Collection.append(coefficients)
            else:
                pass
                #print ("ranks are not equal")

        return sinIndices,coefficients_Collection
    
    @staticmethod
    def GetSingularityTriangleInfo(processMesh):
            sinIndices = []
            coefficients_Collection = []
            for index in range(len(processMesh.triangleList)):
                # get threeRelated
                processTriangle = processMesh.triangleList[index]
                threeVertices = processTriangle.triangleVertices
                
                
                # find the minVec for every neighbor
                
                vi=threeVertices[0].geometry
                vj=threeVertices[1].geometry
                vk=threeVertices[2].geometry
                
                vecD_i = threeVertices[0].standard
                vecD_j = threeVertices[1].standard
                vecD_k = threeVertices[2].standard
                
                #Matrix A
                A = [[vecD_i.X,vecD_j.X,vecD_k.X],
                     [vecD_i.Y,vecD_j.Y,vecD_k.Y],
                     [1.0,1.0,1.0]]

                rankA = EV.Get3x3MatrixRank(A)
                
                
                #augmented Matrix A
                aA =[ [vecD_i.X,vecD_j.X,vecD_k.X,0.0],
                     [vecD_i.Y,vecD_j.Y,vecD_k.Y,0.0],
                     [0.0,1.0,1.0,1.0,1.0]]

                rankaA = EV.Get3x4MatrixRank(aA)
                

                
                if rankA == rankaA: # there might be a singularity
                

                    #solverInput = [vecD_i.X,vecD_j.X,vecD_k.X,0.0, vecD_i.Y,vecD_j.Y,vecD_k.Y,0.0,1.0,1.0,1.0,1.0]
                    coefficients = EV.Solve3x3Equations(vecD_i.X,vecD_j.X,vecD_k.X,0.0, vecD_i.Y,vecD_j.Y,vecD_k.Y,0.0,1.0,1.0,1.0,1.0)
                    
                    if coefficients[0]>0 and coefficients[1]>0 and coefficients[2]>0:
                        sinIndices.append(index)
                        coefficients_Collection.append(coefficients)
                else:
                    pass
                    #print ("ranks are not equal")

            return sinIndices,coefficients_Collection
            
    @staticmethod
    def GetSingularites(processMesh,sinIndices,coefficients_Collection):
        fList = processMesh.triangleList
        
        singularities = []
        
        if sinIndices != [] and coefficients_Collection!=[]:
            for i in range(len(sinIndices)):
                fIndex = sinIndices[i]
                threeVertices = fList[fIndex].triangleVertices
                vi = threeVertices[0].geometry
                vj = threeVertices[1].geometry
                vk = threeVertices[2].geometry
                
                coefficients = coefficients_Collection[i]
                coi = coefficients[0]
                coj = coefficients[1]
                cok = coefficients[2]
                
                singularity = vi*coi + vj*coj + vk*cok
                singularities.append(singularity)
        
        return singularities
                
    @staticmethod
    def Score_Singularity(processMesh,streamlines):
        
        #sinIndices,coefficients_Collection = EV.GetSingularityTriangleInfo(processMesh)
        #singularities = EV.GetSingularites(processMesh,sinIndices,coefficients_Collection)
        singularities = processMesh.singularities
        #print "id inside Score_Singularity :",id(processMesh)
        distances =[]
        for i in range(len(streamlines)):
            distances.append([])
        shortestDistances = []
        
        if singularities != []:
            
            for i in range(len(streamlines)):
                for j in range(len(singularities)):
                    closestPt = streamlines[i].ClosestPoint(singularities[j])
                    distance = closestPt.DistanceTo(singularities[j])
                    distances[i].append(distance)
        
            for i in range(len(distances)):
                shortestDistances.append(min(distances[i]))
           
           
        else:
            for i in range(len(streamlines)):
                shortestDistances.append(0)
        
        scores = shortestDistances
        
        return scores
            

    

    ######################################################
    ##########           Divergence         ##############
    ######################################################
    
    ##############
    @staticmethod
    def GetBarycentricCoefficient(threeVertices,ptX):
        #get the vertices of triangle
        pointA=threeVertices[0]
        pointB=threeVertices[1]
        pointC=threeVertices[2]
        
        #area of this triangle

        areaABC=rg.Vector3d.CrossProduct(rg.Vector3d(pointB-pointA) ,rg.Vector3d(pointC-pointA) ).Length *0.5
        
        #area of first subtriangle
        Nc=rg.Vector3d.CrossProduct(rg.Vector3d(pointB-pointA),rg.Vector3d(ptX-pointA))
        Ncc=rg.Vector3d.CrossProduct(rg.Vector3d(pointB-pointA),rg.Vector3d(pointC-pointA))
        mc=rg.Vector3d.Multiply(Nc,Ncc)
        
        if mc>=0:
            areaABX=0.5*Nc.Length
        
        else:
            areaABX=-0.5*Nc.Length
        
        coefficientc=areaABX/areaABC
        
        #area of second subtriangle
        Nb=rg.Vector3d.CrossProduct(rg.Vector3d(pointA-pointC),rg.Vector3d(ptX-pointC))
        Nbb=rg.Vector3d.CrossProduct(rg.Vector3d(pointA-pointC),rg.Vector3d(pointB-pointC))
        mb=rg.Vector3d.Multiply(Nb,Nbb)
        
        if mb>=0:
            areaAXC=0.5*Nb.Length
        
        else:
            areaAXC=-0.5*Nb.Length
        
        coefficientb=areaAXC/areaABC
        
        
        
        #area of third subtriangle
        Na=rg.Vector3d.CrossProduct(rg.Vector3d(pointC-pointB),rg.Vector3d(ptX-pointB))
        Naa=rg.Vector3d.CrossProduct(rg.Vector3d(pointC-pointB),rg.Vector3d(pointA-pointB))
        ma=rg.Vector3d.Multiply(Na,Naa)
        
        if ma>=0:
            areaXBC=0.5*Na.Length
        
        else:
            areaXBC=-0.5*Na.Length
        
        coefficienta=areaXBC/areaABC
        
        
        return (coefficienta,coefficientb,coefficientc)
    
    #abondoned
    @staticmethod
    def GetNewVector_Inside(mappingGrid,processMesh,testPt):
        triRemeshBoundary =  processMesh.triRemeshBoundary
        vList = processMesh.vertexList
        fList = processMesh.triangleList
        
        thisPointRow=int(round(testPt.X))
        thisPointColumn=int(round(testPt.Y))
        thisPointRow,thisPointColumn = mappingGrid.RemapPosition(testPt)
        coefficient=[]
        
    
        for triangleIndex in mappingGrid.grid[thisPointRow][thisPointColumn].documentedTriangle:
            threeVertices = fList[triangleIndex].triangleVertices
            threeVertices_geo = [threeVertices[0].geometry,threeVertices[1].geometry,threeVertices[2].geometry]
            
            coefficients=EV.GetBarycentricCoefficient(threeVertices_geo,testPt)
            
            if coefficients[0]>=0 and coefficients[1]>=0 and coefficients[2]>=0:
                break
        
        
        u=float(coefficients[0])
        v=float(coefficients[1])
        w=float(coefficients[2])
        
        
        newVector=u * threeVertices[0].crossField[0]+threeVertices[1].crossField[0]+w * threeVertices[2].crossField[0]
        newVector.Unitize()
        
        
         ##### medial axis case or concave case#####
        if fList[triangleIndex].is_MedialAxis == 1:

            result=["medialaxiscase",triangleIndex,newVector]
            return result
            
        return newVector
    
    #abondoned
    @staticmethod
    def GetDivergenceVector(pointList,pointIndex,newVector):
        
            #ending situation
            if pointIndex==len(pointList)-1:
                thisvector = rg.Vector3d(pointList[pointIndex]-pointList[pointIndex-1])

            else:
                thisvector = rg.Vector3d(pointList[pointIndex+1]-pointList[pointIndex])


            wxy_Plane=rg.Plane.WorldXY
            ZAxis=wxy_Plane.ZAxis
            
    
            vector1=newVector
            vector2 = rg.Vector3d(vector1)
            vector3 = rg.Vector3d(vector1)
            vector4 = rg.Vector3d(vector1)
            
            vector2.Rotate(rm.ToRadians(90),ZAxis)
            vector3.Rotate(rm.ToRadians(180),ZAxis)
            vector4.Rotate(rm.ToRadians(270),ZAxis)
 
            
            vectorangle1=rm.ToDegrees(rg.Vector3d.VectorAngle(thisvector,vector1))
            vectorangle2=rm.ToDegrees(rg.Vector3d.VectorAngle(thisvector,vector2))
            vectorangle3=rm.ToDegrees(rg.Vector3d.VectorAngle(thisvector,vector3))
            vectorangle4=rm.ToDegrees(rg.Vector3d.VectorAngle(thisvector,vector4))
            
            vectorlist=[newVector,vector2,vector3,vector4]
            anglelist= [vectorangle1,vectorangle2,vectorangle3,vectorangle4]
    
            maxangleindex=anglelist.index(max(anglelist))
            minangleindex=anglelist.index(min(anglelist))
            
            maxvector=vectorlist[maxangleindex]
            minvector=vectorlist[minangleindex]
            
            vectorlist.remove(maxvector)
            vectorlist.remove(minvector)
            
            chosenVector=vectorlist[0]
            
            return chosenVector
    
    #abondoned
    @staticmethod
    def FlipVectors(vectorList):
        baseVector=vectorList[0]
        newVectorList=[]
        for vector in vectorList:
            vector_r = rg.Vector3d(vector.X,vector.Y,vector.Z)
            vectors=[vector,vector_r]
            angle1=rm.ToDegrees(rg.Vector3d.VectorAngle(baseVector,vectors[0]))
            angle2=rm.ToDegrees(rg.Vector3d.VectorAngle(baseVector,vectors[1]))
            
            if angle1>angle2:
                newVector=vectors[1]
            else:
                newVector=vectors[0]
            
            newVectorList.append(newVector)
        
        return newVectorList
    
    #abondoned
    @staticmethod
    def GetPerpendicularVectorLength(segment,vector):
        segment=segment.ToPolyline()
        endPoint=segment.First
        startPoint=segment.Last
        
        thisVector=rg.Vector3d(endPoint-startPoint)
        
        angle=rm.ToDegrees(rg.Vector3d.VectorAngle(thisVector,vector))
        
        if angle>90:
            angle=180-angle
        
        
        perpendicularVectorLength=math.sin((angle/180)*math.pi)*vector.Length
        
        return perpendicularVectorLength
    
    #abondoned
    @staticmethod
    def Score_Divergence_Abondoned(streamlines,mappingGrid,processMesh,factor=0.9):
        scores=[]
        
        for streamline in streamlines:
            #basicinfo

            
            
            pts=[]
            for index in range(len(streamline)-1):
                pts.append(streamline[index])
            
            ts=[]
            for pt in pts:
                t=streamline.ClosestParameter(pt)
                ts.append(t)
            
            segments = streamline.ToPolylineCurve().Split(ts)
            
        
            vectorsAnchorPts=[]
            
            chosenVectors=[]
            for pointIndex in range(1,len(pts),1):

                testPt=pts[pointIndex]
                vectorsAnchorPts.append(testPt)
                newVector= EV.GetNewVector_Inside(mappingGrid,processMesh,testPt)
                
                if type(newVector)==type([]):
                    newVector=newVector[2]
                
                if type(newVector)==type("str"):
                    break
                    
                chosenVector=EV.GetDivergenceVector(pts,pointIndex,newVector)
                chosenVectors.append(chosenVector)
            

            chosenVectors=EV.FlipVectors(chosenVectors)
            

            totalScore=0

            fullLength=streamline.Length
            
            
            for i in range(len(vectorsAnchorPts)):
        
                perpendicularVectorLength=EV.GetPerpendicularVectorLength(segments[i],chosenVectors[i])
                score=segments[i].GetLength()*perpendicularVectorLength
                totalScore+=score

            totalScore*=(1/fullLength)**factor
            
            scores.append(totalScore)
        
        return scores

    ##############
    
    ##### New updated #####
    @staticmethod
    def GetDividedPoints_ByCount(segment,divideNum):
        ts = segment.DivideByCount(divideNum,True)
        divPts = [] 
        for t in ts:
            divPts.append(segment.PointAt(t))
        return divPts
        
    @staticmethod
    def GetDividedPoints_ByLength(thisSLcurve,divideLength):
        
        thisSLcurve = thisSLcurve.ToPolylineCurve()
        if thisSLcurve.GetLength()< divideLength:
            ts = thisSLcurve.DivideByCount(2,True)
        else:
            ts = thisSLcurve.DivideByLength(divideLength,True)
            
        divPts = []
        for t in ts:
            divPts.append(thisSLcurve.PointAt(t))
        return divPts
        
    @staticmethod
    def GetTriangleArea(processMesh,triIndex):
        
        processTriangle = processMesh.triangleList[triIndex]
        triangle = processTriangle.triangleBoundary
        
        area = rg.AreaMassProperties.Compute(triangle.ToPolylineCurve()).Area
        return area
    
    @staticmethod
    def CheckTriangleIndex (processMesh,mappingGrid,thisPt):
        fList = processMesh.triangleList
        thisPointRow=int(round(thisPt.X))
        thisPointColumn=int(round(thisPt.Y))
        
        thisPointRow,thisPointColumn = mappingGrid.RemapPosition(thisPt)
        coefficient = []
        for triangleIndex in mappingGrid.grid[thisPointRow][thisPointColumn].documentedTriangle:
            threeVertices = fList[triangleIndex].triangleVertices
            threeVertices_geo = [threeVertices[0].geometry,threeVertices[1].geometry,threeVertices[2].geometry]
            coefficients=EV.GetBarycentricCoefficient(threeVertices_geo,thisPt)
            if coefficients[0]>=0 and coefficients[1]>=0 and coefficients[2]>=0:
                break
        
        #print "thisPointRow", thisPointRow, "thisPointColumn", thisPointColumn, "doc",mappingGrid.grid[thisPointRow][thisPointColumn].documentedTriangle
        #print "thisPt:"
        #print thisPt.X, thisPt.Y
        #print "pixel:"
        #print mappingGrid.grid[thisPointRow][thisPointColumn].centroid, mappingGrid.e
        
        u=float(coefficients[0])
        v=float(coefficients[1])
        w=float(coefficients[2])
        
        triIndex = triangleIndex 
        
        return triIndex
        
    @staticmethod
    def GetMinVector(processMesh,index,thisVec):
        vList = processMesh.vertexList
        
        vec0 = vList[index].crossField[0]
        vec1 = vList[index].crossField[1]
        vec2 = vList[index].crossField[2]
        vec3 = vList[index].crossField[3]
        
        vecs = [vec0,vec1,vec2,vec3]
        angles=[]
        angles.append(rg.Vector3d.VectorAngle(thisVec,vec0))
        angles.append(rg.Vector3d.VectorAngle(thisVec,vec1))
        angles.append(rg.Vector3d.VectorAngle(thisVec,vec2))
        angles.append(rg.Vector3d.VectorAngle(thisVec,vec3))
        
        minIndex = angles.index(min(angles))
        chosenVec = vecs[minIndex]
        
        return chosenVec
        
    @staticmethod
    def GetMinVector_FromProcessVertex(processVertex,thisVec):

        vec0 = processVertex.crossField[0]
        vec1 = processVertex.crossField[1]
        vec2 = processVertex.crossField[2]
        vec3 = processVertex.crossField[3]
        
        vecs = [vec0,vec1,vec2,vec3]
        angles=[]
        angles.append(rg.Vector3d.VectorAngle(thisVec,vec0))
        angles.append(rg.Vector3d.VectorAngle(thisVec,vec1))
        angles.append(rg.Vector3d.VectorAngle(thisVec,vec2))
        angles.append(rg.Vector3d.VectorAngle(thisVec,vec3))
        
        minIndex = angles.index(min(angles))
        chosenVec = vecs[minIndex]
        
        return chosenVec
        
    @staticmethod
    def CalculateOperatorValue(chosenPt,thisPt,chosenVec,thisVec):
        var_ptX = chosenPt.X - thisPt.X
        var_ptY = chosenPt.Y - thisPt.Y
                
        var_Vector = chosenVec - thisVec
    
        var_VectorX = var_Vector.X
        var_VectorY = var_Vector.Y
        
        
        operator = var_VectorX/var_ptX + var_VectorY/var_ptY
        
        return operator
    
    @staticmethod
    def Score_Divergence(processMesh,mappingGrid,streamlines,divLength):
        scores=[]
        #print " all streamlines"
        #for streamline in streamlines:
            #for pt in streamline:
                #print pt.X,pt.Y,pt.Z
            #print "----"
        for streamline in streamlines:
            divPts = EV.GetDividedPoints_ByLength(streamline,divLength)
            fullLength = streamline.Length
            factor = 0.9
            totalScore = 0

            for ptIndex in range(len(divPts)-1):
            
                thisPt = divPts[ptIndex]
                
                # check which triangle its in
                triIndex = EV.CheckTriangleIndex (processMesh,mappingGrid,thisPt)
                
                # get triangleArea
                triangleArea = EV.GetTriangleArea(processMesh,triIndex)
                
                # get threeRelated
                processTriangle = processMesh.triangleList[triIndex]
                threeVertices = processTriangle.triangleVertices

                
                # find the minVec for every neighbor
                thisVec=rg.Vector3d(divPts[ptIndex+1]-divPts[ptIndex])
                vi=threeVertices[0].geometry
                vj=threeVertices[1].geometry
                vk=threeVertices[2].geometry
                minVec_i = EV.GetMinVector_FromProcessVertex(threeVertices[0],thisVec)
                minVec_j = EV.GetMinVector_FromProcessVertex(threeVertices[1],thisVec)
                minVec_k = EV.GetMinVector_FromProcessVertex(threeVertices[2],thisVec)
                
                # get the surrounding triangles
                vN = rg.Vector3d(0,0,1)
                
                vkj_Vertical = rg.Vector3d.CrossProduct(rg.Vector3d(vk-vj),vN)
                vik_Vertical = rg.Vector3d.CrossProduct(rg.Vector3d(vi-vk),vN)
                vji_Vertical = rg.Vector3d.CrossProduct(rg.Vector3d(vj-vi),vN)
                
                operator = ((vkj_Vertical.X*minVec_i.X) + (vik_Vertical.X*minVec_j.X) + (vji_Vertical.X*minVec_k.X)
                        + (vkj_Vertical.Y*minVec_i.Y) + (vik_Vertical.Y*minVec_j.Y) + (vji_Vertical.Y*minVec_k.Y))/(2*triangleArea)
                
                operator=abs(operator)
                
                d = divPts[ptIndex].DistanceTo(divPts[ptIndex+1])
                score =operator*d
                totalScore+=score
                
            
            totalScore*=1/(fullLength**factor)
            scores.append(totalScore)
            
        return scores




    ######################################################
    ##########      Parcel Level Score      ##############
    ######################################################
    @staticmethod
    def EvaluateAreaRatio(polygons):
        polygon1=polygons[0]
        polygon2=polygons[1]

        area1=rg.AreaMassProperties.Compute(polygon1).Area
        area2=rg.AreaMassProperties.Compute(polygon2).Area
        
        areaPair= [area1,area2]

        ### smallArea/BigArea
        if area1>=area2:
            ratio = area2/area1
        else:
            ratio = area1/area2
            
        return ratio,areaPair
    
    @staticmethod
    def EvaluateOrientation(geo,idealOrientation):
        obb = EV.GetOBB(geo,5)
        obb = EV.MakeCounterClockwiseDirection(obb)
        #construct the local coordinate
        obbOrigin = None
        distance = []
        for i in range(len(obb)-1):
            distance.append(obb[i].DistanceTo(rg.Point3d(0,0,0)))
        
        
        
        ptIndex = distance.index(min(distance))
        obbOrigin =obb[ptIndex]
        
        
        if ptIndex != 0 and ptIndex != 3:
            Xend = obb[ptIndex+1]
            Yend = obb[ptIndex-1]
        
        elif ptIndex==0:
            Xend = obb[ptIndex+1]
            Yend = obb[3]
        elif ptIndex==3:
            
            Xend = obb[0]
            Yend = obb[ptIndex-1]
        
        obbXaxis = rg.Vector3d(Xend - obbOrigin)
        obbYaxis = rg.Vector3d(Yend - obbOrigin)
        
        globalXaxis = rg.Vector3d(1,0,0)
        globalYaxis = rg.Vector3d(0,1,0)
        
        
        #compare the longer obbedge
        if obbXaxis.Length >=obbYaxis.Length:
            compare = obbXaxis
        else:
            compare = obbYaxis
            
        angle = rg.Vector3d.VectorAngle(compare,globalXaxis)
        
        ### this is optional
        if angle > rm.HalfPI:
            angle = rm.TwoPI/2 - angle
                        
        return angle

    @staticmethod
    def EvaluateElongation(geo):
        box = EV.GetOBB(geo,5)
                
                
        edge1=box.SegmentAt(0)
        edge2=box.SegmentAt(1)
        
        if edge1.Length>edge2.Length:
            ratio=edge1.Length/edge2.Length
        
        else:
            ratio=edge2.Length/edge1.Length
        
        return ratio
        
    @staticmethod
    def EvaluateCompactness(geo): 
        return 4 * math.pi * rg.AreaMassProperties.Compute(geo).Area/geo.GetLength()**2
        
    @staticmethod
    def EvaluateConvexity(geo):
        
        
        ### random NurbsCurve instance 
        
        nc = rg.NurbsCurve.Create(False, 3, [rg.Point3d(0,0,0),rg.Point3d(0,2,0),rg.Point3d(2, 3, 0),rg.Point3d(4, 2, 0),rg.Point3d(4, 0, 0)])
    
        if type(geo) == type(rg.PolylineCurve()) or type(geo) == type(nc) or type(geo) == type(rg.PolyCurve()) :
            ts = []
            step = geo.Domain[1]/40
            for i in range(40):
            
                ts.append(step*i)

            pts = []
            for t in ts:
                pts.append(geo.PointAt(t))

            try:
                convexHull = ghc.ConvexHull(pts)[0]
                convexity = convexHull.GetLength()  / geo.GetLength()
            except:
                convexity = 0
                print "EvaluateConvexity sth wrong"
            
        else:
            geo = geo.ToPolyline()
            Vertices=[]
            for index in range(len(geo)-1):
                Vertices.append(geo[index])
            
            try:
                convexHull = ghc.ConvexHull(Vertices)[0]
                convexity = convexHull.GetLength()  / geo.Length
            except:
                convexity = 0
                
        return convexity
     
        
        return convexity

    @staticmethod
    def Score_ParcelLevel(streamlines,boundary,idealElongation,idealCompactness,idealConvexity,idealOrientation):
        
        ###This is to record the Difference to the Ideal Value
        discrepancies_area=[]
        discrepancies_elongation=[]
        discrepancies_compactness=[]
        discrepancies_convexity=[]
        discrepancies_orientation=[]
        
        ###This is to record datas for each Pair
        elongationPairCollection = []
        areaPairCollection = []
        convexityPairCollection = []
        compactnessPairCollection = []
        orientationPairCollection = []
        
        for i in range(len(streamlines)):
            
            
            polygons=EV.SplitPolygon(streamlines[i],boundary)
            
            ### check if the polygons valid
            checkTag1 = None
            checkTag2 = None
            if polygons !=None:
                checkTag1 = rg.AreaMassProperties.Compute(polygons[0])
                checkTag2 = rg.AreaMassProperties.Compute(polygons[1])
            if polygons !=None and checkTag1!=None and checkTag2!=None:

                ### EVEN AREA  ###
                ratio,areaPair = EV.EvaluateAreaRatio(polygons)
                areaPairCollection.append(areaPair)
                
                discrepancy_area=abs(ratio-1)          
                discrepancies_area.append(discrepancy_area)
                
                ###       ELONGATION       ###
                elongationPair = []
                discrepancy_elongation_pair=[]
                for geo in polygons:
                    ratio = EV.EvaluateElongation(geo)
                    
                    elongationPair.append(ratio)
                    discrepancy_elongation=abs(ratio-idealElongation)
                    
                    discrepancy_elongation_pair.append(discrepancy_elongation)

                elongationPairCollection.append(elongationPair) 
                discrepancies_elongation.append( (discrepancy_elongation_pair[0] + discrepancy_elongation_pair[1])/2 )  ### take the average
            
                ###       Compactness       ###
                compactnessPair = [] 
                discrepancy_compactness_pair=[]
                for geo in polygons:
                    
                    compactness = EV.EvaluateCompactness(geo)
                    compactnessPair.append(compactness)
                    discrepancy_compactness = abs(compactness-idealCompactness)
                    discrepancy_compactness_pair.append(discrepancy_compactness)
                    
                compactnessPairCollection.append(compactnessPair)
                discrepancies_compactness.append( (discrepancy_compactness_pair[0] + discrepancy_compactness_pair[1])/2 )   ### take the average
                
                ###       Convexity       ###
                convexityPair = []
                discrepancy_convexity_pair = []
                for geo in polygons:

                    convexity = EV.EvaluateConvexity(geo) 
                    convexityPair.append(convexity)
                    discrepancy_convexity = abs(convexity-idealConvexity)
                    discrepancy_convexity_pair.append(discrepancy_convexity)
                    
                convexityPairCollection.append(convexityPair)
                discrepancies_convexity.append( (discrepancy_convexity_pair[0] + discrepancy_convexity_pair[1])/2 )  ### take the average
                
                ###       Orientation       ###
                # idealOrientation = 0  - > meaning prefer N-S
                # idealOrientation = 1  - > meaning prefer W-E
                
                orientationPair = []
                discrepancy_orientation_pair = []
                for geo in polygons:
                    
                    orientation = EV.EvaluateOrientation(geo,idealOrientation)  # 0 -> NS, 1-> WS
                    orientationPair.append(orientation)
                    
                    # get the discrepancy
                    if orientation > rm.HalfPI:
                        orientation = rm.TwoPI/2 - orientation
            
                    if idealOrientation == 0: # prefer NS
                        discrepancy_orientation = abs(orientation - rm.HalfPI)
                    
                    elif idealOrientation == 1: # prefer WE
                        discrepancy_orientation = abs(orientation - 0)

                    discrepancy_orientation_pair.append(discrepancy_orientation)
                    
                orientationPairCollection.append(orientationPair)
                discrepancies_orientation.append( (discrepancy_orientation_pair[0] + discrepancy_orientation_pair[1])/2 )  ### take the average
                
            else:
                areaPair = [999999,999999]
                areaPairCollection.append(areaPair)
                discrepancies_area.append(999999)
                
                elongationPair = [999999,999999] 
                elongationPairCollection.append(elongationPair) 
                discrepancies_elongation.append( 999999 )  ### take the average
                  
                
                convexityPair =[999999,999999] 
                convexityPairCollection.append(convexityPair)
                discrepancies_convexity.append(999999 )  ### take the average
                
                
                compactnessPair = [999999,999999] 
                compactnessPairCollection.append(compactnessPair)
                discrepancies_compactness.append( 999999 )   ### take the average
                
                orientationPair = [999999,999999] 
                orientationPairCollection.append(orientationPair)
                discrepancies_orientation.append( 999999 )
       
        
                print ("SplitPolygon fails to split")
        return (discrepancies_area,discrepancies_elongation,discrepancies_compactness,discrepancies_convexity,discrepancies_orientation,elongationPairCollection,areaPairCollection,convexityPairCollection, compactnessPairCollection,orientationPairCollection)
      
      
      
      
    ######################################################
    ##########          OverAll Score      ##############
    ######################################################
    @staticmethod
    def GetOverallScore(a,b,c,d,e,f,g,h,weight):
        
        overallScore=[]
        for i in range(len(a)):
            overallScore.append(a[i]*weight[0]+b[i]*weight[1]+c[i]*weight[2]+d[i]*weight[3]+e[i]*weight[4]+f[i]*weight[5]+g[i]*weight[6]+h[i]*weight[7])
            
        return overallScore
    
    @staticmethod
    def GetScore_Part1(a,b,c,weight):
        
        score_Part1=[]
        
        for i in range(len(a)):
            score_Part1.append(a[i]*weight[0]+b[i]*weight[1]+c[i]*weight[2])
            
        return score_Part1
    
    @staticmethod
    def GetScore_Part2(d,e,f,g,h,weight):
        
        score_Part2=[]
        for i in range(len(d)):
            score_Part2.append(d[i]*weight[3]+e[i]*weight[4]+f[i]*weight[5]+g[i]*weight[6]+h[i]*weight[7])
            
        return score_Part2
    
    @staticmethod
    def GetScore_ParcelLevel(d,e,f,g,h,weight):
        
        score_Part2=[]
        for i in range(len(d)):
            score_Part2.append(d[i]*weight[0]+e[i]*weight[1]+f[i]*weight[2]+g[i]*weight[3]+h[i]*weight[4])
            
        return score_Part2
      
    ######################################################
    ##########         GEO_HelpFunc         ##############
    ######################################################
    @staticmethod
    def SplitPolygon(streamline,boundary):
        #if type(streamline) == type(rg.Polyline()):
            #print "inSplitPolygon" 
            #for pt in streamline:
                #print pt.X,pt.Y,0
            
        if type(streamline) == type(rg.Polyline()):
            streamline = streamline.ToPolylineCurve()
        if type(boundary) == type(rg.Polyline()):
            boundary = boundary.ToPolylineCurve()
        
        #print "inSplitPolygon,convert" 

        #print streamline.PointAtEnd.X,streamline.PointAtEnd.Y,0
        ### to fix tolerance
        streamline = streamline.Extend(rg.CurveEnd.Both,0.01,rg.CurveExtensionStyle.Line)
        tempCollection=[]
        tempCollection=[boundary,streamline]

        
        wxy_plane=rg.Plane.WorldXY
        #tol=rd.ActiveDoc.ModelAbsoluteTolerance
        tol = 0.001
        
        
        result=rg.Curve.CreateBooleanRegions(tempCollection,wxy_plane,False,tol)
        
        
        if result.PlanarCurveCount != 2:
            print ("SplitPolygon fails")
            print ("FAIL boundary:")
            for pt in boundary:
                print (pt.X), "," , (pt.Y), "," , (pt.Z)
                
            print ("FAIL streamline:")
            ts = streamline.DivideByLength(0.2,True)

            for t in ts:
                divpt = streamline.PointAt(t)
                print (divpt.X), "," , (divpt.Y), "," , (divpt.Z)
            return None
        
        try:    
            a=rg.CurveBooleanRegions.RegionCurves(result,0)[0]
            b=rg.CurveBooleanRegions.RegionCurves(result,1)[0]
        except:
            print ("fail to split")
            print ("FAIL boundary:")
            boundary = boundary.TryGetPolyline()[1]
            for pt in boundary:
                print (pt.X), "," , (pt.Y), "," , (pt.Z)
                
            print ("FAIL streamline:")
            streamline = streamline.TryGetPolyline()[1]
            
            for pt in streamline:
                print (pt.X), "," , (pt.Y), "," , (pt.Z)

            return None
        else:
            pass
        
        return[a,b]

    @staticmethod
    def MakeCounterClockwiseDirection(inputPolyline):
        inputPolyline_copy = rg.Polyline(inputPolyline)
        inputPolylineCurve = inputPolyline_copy.ToPolylineCurve()
        if inputPolylineCurve.ClosedCurveOrientation().ToString() == "Clockwise":
            inputPolyline_copy.Reverse()
    
        else:
            pass
        
        return inputPolyline_copy

    ### OBB 
    @staticmethod
    def CheckObjCoPlanarity(obj,tol=0.001):

        pt_list=[]
        
        rc,plane=obj.TryGetPlane(tol)
        if not rc: return
        nc = obj.ToNurbsCurve()
        if nc is None: return
        crv_pts=[nc.Points[i].Location for i in xrange(nc.Points.Count)]
        pt_list.extend(crv_pts)
            
        if rg.Point3d.ArePointsCoplanar(pt_list,tol):
            rc, plane = rg.Plane.FitPlaneToPoints(pt_list)
            if rc==rg.PlaneFitResult.Success: return plane
    
    @staticmethod
    def Objectbbox(geom,xform):
        if isinstance(geom,rg.Point):
            pt=geom.Location
            if xform: pt = xform * pt
            return rg.BoundingBox(pt,pt)
        if xform: return geom.GetBoundingBox(xform)
        return geom.GetBoundingBox(True)
    
    #gets a plane-aligned bounding box
    @staticmethod
    def BoundingBoxPlane(objs,plane,ret_pts=False,accurate=True):

        wxy_plane=rg.Plane.WorldXY

        
        xform = rg.Transform.ChangeBasis(wxy_plane, plane)
        bbox = rg.BoundingBox.Empty
        if type(objs) is list or type(objs) is tuple:
            for obj in objs:
                objectbbox = EV.Objectbbox(obj, xform)
                bbox = rg.BoundingBox.Union(bbox,objectbbox)
        else:
            objectbbox = EV.Objectbbox(objs, xform)
            bbox = rg.BoundingBox.Union(bbox,objectbbox)
            
        if not bbox.IsValid: return
        plane_to_world = rg.Transform.ChangeBasis(plane,wxy_plane)
        if ret_pts:
            corners = list(bbox.GetCorners())
            for pt in corners: pt.Transform(plane_to_world)
            return corners
        else:
            box=rg.Box(bbox)
            box.Transform(plane_to_world)
            return box
    
    #this is the main 2D bb calculation search function
    @staticmethod
    def PlanarMinBB(objs,plane,tot_ang,divs):
        inc=tot_ang/divs
        #rotate plane half total angle minus direction
        plane.Rotate(-tot_ang*0.5,plane.ZAxis,plane.Origin)
        bb = EV.BoundingBoxPlane(objs,plane)
        curr_plane=rg.Plane(plane)
        curr_area=EV.BoxArea(bb)
        #loop through angle increments
        for i in range(divs):
            plane.Rotate(inc,plane.ZAxis,plane.Origin)
            bb = EV.BoundingBoxPlane(objs,plane)
            new_area=EV.BoxArea(bb)
            if new_area<curr_area:

                curr_area=new_area
                curr_plane=rg.Plane(plane)
        return curr_plane, curr_area
    
    #2D planar bounding rectangle routine
    @staticmethod
    def MinBoundingRectanglePlane(obj,curr_plane,im_rep=False):
        #pass True argument above if you want to print intermediate results
        #initialize
        factor=0.01 #0.01 (1/100 of model abs tolerance)
        angle=math.pi*0.5 #start angle 90 degrees
        divs=90  #initial division 1 degree intervals
        #tol = rd.ActiveDoc.ModelAbsoluteTolerance
        tol = 0.001
        #get initial rough bounding box
        init_bb=EV.BoundingBoxPlane(obj,curr_plane,ret_pts=False)
        curr_area=EV.BoxArea(init_bb)

        #main calculation loop
        safe=10 #set safety limit at 10
        for i in range(safe):
            curr_plane,new_area = EV.PlanarMinBB(obj,curr_plane,angle,divs)
            #abort if area is 0 or extremely small
            #if new_area<tol*0.1:
                #print err_msg ; return
            #break out of loop if new area is the same as prev. area within limit
            if abs(curr_area-new_area)<factor*tol: break
            #otherwise, decrease increments and loop
            curr_area=new_area
            angle*=(1/divs)
            
            
        f_bb=EV.BoundingBoxPlane(obj,curr_plane,ret_pts=True)
        return f_bb,curr_area,i
    
    #used for planar bounding rectangle calculation
    @staticmethod
    def BoxArea(box):
        return (box.X[1]-box.X[0])*(box.Y[1]-box.Y[0])
    
    @staticmethod
    def GetOBB(G,N):
        
        obj = G
        plane=EV.CheckObjCoPlanarity(obj,tol=0.001)
        #launch planar bounding box routine
        f_bb,curr_area,passes=EV.MinBoundingRectanglePlane(obj,plane,False)
        #add polyline, report message
        bb=rg.Polyline([f_bb[0],f_bb[1],f_bb[2],f_bb[3],f_bb[0]])

        return bb
    
    
    ### ConvexHull
    @staticmethod
    def get_bottom_point(points):
        min_index = 0
        n = len(points)
        for i in range(0, n):
            if points[i][1] < points[min_index][1] or (points[i][1] == points[min_index][1] and points[i][0] < points[min_index][0]):
                min_index = i
        
        return min_index

    @staticmethod
    def sort_polar_angle_cos(points, center_point):
        #print "in  sort_polar_angle_cos"
        #print "center_point",center_point
        n = len(points)
        cos_value = []
        rank = []
        norm_list = []
        for i in range(0, n):
            point_ = points[i]
            #print i, point_
            point = [point_[0]-center_point[0], point_[1]-center_point[1]]
            rank.append(i)
            norm_value = math.sqrt(point[0]*point[0] + point[1]*point[1])
            norm_list.append(norm_value)
            if norm_value == 0:
                cos_value.append(1)
            else:
                cos_value.append(point[0] / norm_value)
        #print "rank",rank,n
        
        #print "asdasda"
        
        for i in range(0, n-1):
            index = i + 1
            while index > 0:
                print "index", index ,cos_value[index], cos_value[index-1],norm_list[index] ,norm_list[index-1], (cos_value[index] - cos_value[index-1] > 0.001 or (cos_value[index] - cos_value[index-1]<0.001 and norm_list[index] - norm_list[index-1]>0.001))
                if cos_value[index] - cos_value[index-1] > 0.001 or (cos_value[index] - cos_value[index-1]<0.001 and norm_list[index] - norm_list[index-1]>0.001):
                    temp = cos_value[index]
                    temp_rank = rank[index]
                    temp_norm = norm_list[index]
                    cos_value[index] = cos_value[index-1]
                    rank[index] = rank[index-1]
                    norm_list[index] = norm_list[index-1]
                    cos_value[index-1] = temp
                    rank[index-1] = temp_rank
                    norm_list[index-1] = temp_norm
                    index = index-1
      
                    #print "index:",index, temp,temp_rank,temp_norm
                else:
                    break
        sorted_points = []
        print "rank",rank
        print cos_value
        for i in rank:
            sorted_points.append(points[i])
        
        #print "sorted_points" 
        #print sorted_points
        return sorted_points
    
    @staticmethod
    def vector_angle(vector):
        norm_ = math.sqrt(vector[0]*vector[0] + vector[1]*vector[1])
        if norm_ == 0:
            return 0
     
        angle = math.acos(vector[0]/norm_)
        if vector[1] >= 0:
            return angle
        else:
            return 2*math.pi - angle
     
    @staticmethod
    def coss_multi(v1, v2):
        return v1[0]*v2[1] - v1[1]*v2[0]
     
    @staticmethod
    def graham_scan(points):

        bottom_index = EV.get_bottom_point(points)
        
        bottom_point = points.pop(bottom_index)
        sorted_points = EV.sort_polar_angle_cos(points, bottom_point)

        m = len(sorted_points)
        if m < 2:
            print("no enough points to form a hull")
            return None
     
        stack = []
        stack.append(bottom_point)
        stack.append(sorted_points[0])
        stack.append(sorted_points[1])

        for i in range(2, m):
            length = len(stack)
            top = stack[length-1]
            next_top = stack[length-2]
            #print length,top,next_top
            #print "----"
            
            v1 = [sorted_points[i][0]-next_top[0], sorted_points[i][1]-next_top[1]]
            v2 = [top[0]-next_top[0], top[1]-next_top[1]]
            
            while EV.coss_multi(v1, v2) >= 0:
                stack.pop()
                length = len(stack)
                #print stack, length
                top = stack[length-1]
                next_top = stack[length-2]
                v1 = [sorted_points[i][0] - next_top[0], sorted_points[i][1] - next_top[1]]
                v2 = [top[0] - next_top[0], top[1] - next_top[1]]
     
            stack.append(sorted_points[i])
     
            
        return stack
    
    @staticmethod
    def ConvertPoint3dTo2DNumList(ptList):
        ptList_2D = []
        for pt in ptList:
            ptList_2D.append([])
        
        for i in range(len(ptList)):
            ptList_2D[i]= [ptList[i].X,ptList[i].Y]
            
        return ptList_2D
    
    @staticmethod
    def Convert2DNumListToPoint3d(PtList_2D):
        ptList_3D = []
        for pt in PtList_2D:
            ptList_3D.append(rg.Point3d(pt[0],pt[1],0))
        
        return ptList_3D
        
    @staticmethod
    def GetConvexHull(ptList):
        print "in GetConvexHull"
        for pt in ptList:
            print pt.X,pt.Y,pt.Z
            
        ptList_2D = EV.ConvertPoint3dTo2DNumList(ptList)
        result = EV.graham_scan(ptList_2D)
        if result!=None:
            ptList_3D = EV.Convert2DNumListToPoint3d(result)
            ptList_3D.append(ptList_3D[0])
            convexHull = rg.Polyline(ptList_3D)
        else:
            convexHull = None
        return convexHull
    
    
    ######################################################
    ################ Sort info to Instance ###############
    ######################################################
    @staticmethod
    def RemapRange(numlist,tartgetdomainstart,tartgetdomainend):

        tartgetdomain=ghc.ConstructDomain(tartgetdomainstart,tartgetdomainend)
    
        maxnum=max(numlist)
    
        minnum=min(numlist)
        
        sourcerdomain=ghc.ConstructDomain(minnum,maxnum)
        
        newrange=ghc.RemapNumbers(numlist,sourcerdomain,tartgetdomain)[0]
        
        return newrange
    

        

    
    @staticmethod
    def GetAllScoreToInstance(SLG,mappingGrid,processMesh,streamlineNetwork,streamlines,dL,weight,idealOrientation):
        
        score_Divergence = EV.Score_Divergence(processMesh,mappingGrid,streamlines,20)
        
        score_Continuity = EV.Score_Continuity(streamlines,20,0.9) ### without setting dectect radius
        score_Singularity = EV.Score_Singularity(processMesh,streamlines)
        result = EV.Score_ParcelLevel(streamlines,processMesh.triRemeshBoundary,1.5,1,1,idealOrientation)
        score_EvenArea=result[0]
        score_Elongation=result[1]
        score_Compactness=result[2]
        score_Convexity=result[3]
        score_Orientation=result[4]
        
        
        elongationPairCollection=result[5]
        areaPairCollection=result[6]
        convexityPairCollection = result[7]
        compactnessPairCollection = result[8]
        orientationPairCollection = result[9]
        
        #Remap
        
        score_Divergence = EV.RemapRange(score_Divergence,0,1)    # currently this is not correct   
        
        score_Continuity = EV.RemapRange(score_Continuity,0,1)    # the larger the better
        score_Singularity = EV.RemapRange(score_Singularity,1,0)  # the closer (smaller value) the better
        
        score_EvenArea = EV.RemapRange(score_EvenArea,1,0)        # the smaller difference to 1， meaning its more even
        score_Elongation = EV.RemapRange(score_Elongation,1,0)    # the smaller difference to idealElongation， its better
        score_Compactness = EV.RemapRange(score_Compactness,1,0)    # the smaller difference to idealCompactness， its better
        score_Convexity = EV.RemapRange(score_Convexity,1,0)        # the smaller difference to idealConvexity， its better
        score_Orientation = EV.RemapRange(score_Orientation,1,0)     # the smaller difference, its better 
        
        
        score_Part1 = EV.GetScore_Part1(score_Divergence,score_Continuity,score_Singularity,weight)
        score_Part2 = EV.GetScore_Part2(score_EvenArea,score_Elongation,score_Compactness,score_Convexity,score_Orientation,weight)
        score_OverallScore = EV.GetOverallScore(score_Divergence,score_Continuity,score_Singularity,score_EvenArea,score_Elongation,score_Compactness,score_Convexity,score_Orientation,weight)
        
        
        #Assign to each instance
        for i in range(len(streamlines)):
            sl = SLG.Streamline()
            sl.CreateStreamlineInstance(streamlines[i])
            
            sl.scoreSingularity = score_Singularity[i]
            sl.scoreContinuity = score_Continuity[i]
            sl.scoreDivergence = score_Divergence[i]
            sl.scoreEvenArea = score_EvenArea[i]
            sl.scoreElongation = score_Elongation[i]
            sl.scoreCompactness = score_Compactness[i]
            sl.scoreConvexity = score_Convexity[i]
            sl.scoreOrientation = score_Orientation[i]
            
            sl.score_Part1 = score_Part1[i]
            sl.score_Part2 = score_Part2[i]
            sl.scoreOverall = score_OverallScore[i]
            
            sl.elongationPair = elongationPairCollection[i]
            sl.areaPair = areaPairCollection[i]
            sl.convexityPair = convexityPairCollection[i]
            sl.compactnessPair = compactnessPairCollection[i]
            sl.orientationPair = orientationPairCollection[i]
            
            if sl.areaPair[0] >= sl.areaPair[1]:
                sl.evenAreaValue = sl.areaPair[1]/sl.areaPair[0]
            else:
                sl.evenAreaValue = sl.areaPair[0]/sl.areaPair[1]
            
            streamlineNetwork.network.append(sl)
            
    @staticmethod
    def SortStreamlines_Overall(streamlineNetwork):
        
        list = streamlineNetwork.network
        
        sortedList = list
        num = len(list)

        for i in range(num):

            for j in range(i+1,num):

                if list[i].scoreOverall < sortedList[j].scoreOverall:
                    swp = sortedList[i]
                    sortedList[i] = sortedList[j]
                    sortedList[j] = swp

                        
        return sortedList
        
    @staticmethod
    def SortStreamlines_Streamline(streamlineNetwork):
        list = streamlineNetwork.network
        
        sortedList = list
        num = len(list)
        
        for i in range(num):
            for j in range(i+1,num):
                if sortedList[i].score_Part1<sortedList[j].score_Part1:
                    swp = sortedList[i]
                    sortedList[i] = sortedList[j]
                    sortedList[j] = swp
                    
        return sortedList
    
    @staticmethod
    def SortStreamlines_Parcel(streamlineNetwork):
        list = streamlineNetwork.network
        
        sortedList = list
        num = len(list)
        
        for i in range(num):
            for j in range(i+1,num):
                if sortedList[i].score_Part2<sortedList[j].score_Part2:
                    swp = sortedList[i]
                    sortedList[i] = sortedList[j]
                    sortedList[j] = swp
                    
        return sortedList 

    


    ######################################################
    ################        Matrix         ###############
    ######################################################
    @staticmethod
    def Solve3x3Equations(a, b, c, d, e, f, g, h, i, j, k, l):
        """
        Solve a 3x3 system of equations using Cramer's rule.
        The system is in the form of:
            a * x + b * y + c * z = d
            e * x + f * y + g * z = h
            i * x + j * y + k * z = l
        where x, y, z are the variables to be solved for.
        """
        # Compute the determinant of the coefficient matrix
        det = a * (f * i - g * j) - b * (e * i - g * k) + c * (e * j - f * k)
        
        # Compute the determinant of the matrix formed by replacing each column of the coefficient matrix 
        # with the constants vector
        det_x = d * (f * i - g * j) - b * (h * i - g * l) + c * (h * j - f * l)
        det_y = a * (h * i - g * l) - d * (e * i - g * k) + c * (e * l - h * k)
        det_z = a * (f * l - h * j) - b * (e * l - h * k) + d * (e * j - f * k)
        
        # compute the value of x, y, z
        x = det_x / det
        y = det_y / det
        z = det_z / det
        return x, y, z
    
    @staticmethod
    def Get3x3MatrixRank(matrix):
        det = matrix[0][0] * (matrix[1][1] * matrix[2][2] - matrix[1][2] * matrix[2][1]) - matrix[0][1] * (matrix[1][0] * matrix[2][2] - matrix[1][2] * matrix[2][0]) + matrix[0][2] * (matrix[1][0] * matrix[2][1] - matrix[1][1] * matrix[2][0])
        if det == 0:
            return 2
        else:
            return 3
    
    @staticmethod
    def Get3x4MatrixRank(matrix):
        num_rows = len(matrix)
        num_cols = len(matrix[0])
        rank = min(num_rows, num_cols)
    
        for i in range(num_rows):
            for j in range(i+1, num_cols):
                if matrix[i][j] != 0:
                    rank -= 1
                    break
        return rank
# ---------- end ghpython_script_4 ----------
ghpython_script_5 = GhPythonScript()  # -> out, WebApp_Func
# ---------- ghpython_script_5: Python ----------
import Rhino.Geometry as rg
#import Rhino.RhinoDoc as rd
import Rhino.RhinoMath as rm
import Rhino as rh

class WebApp_Func:
    
    #################################################################
    #################     Relocate and Scale    #####################
    #################################################################
    #region
    @staticmethod
    def RelocateGeo(geo,sourceCenter,tartgetCenter):
        xChange = sourceCenter.X - tartgetCenter.X
        yChange = sourceCenter.Y - tartgetCenter.Y
        zChange = sourceCenter.Z - tartgetCenter.Z

        ### polyline case
        if isinstance(geo, rg.Polyline):
            newPts = []
            for point in geo:
                newPts.append(rg.Point3d(point.X - xChange,point.Y - yChange ,point.Z - zChange))
                newPolyL = rg.Polyline(newPts)
                newGeo = newPolyL
        elif isinstance(geo, rg.Point3d):
            newPt = rg.Point3d(geo.X - xChange,geo.Y - yChange ,geo.Z - zChange)
            newGeo = newPt
        return newGeo

    @staticmethod
    def RelocateGeoToOrigin(geo,sourceCenter):
        tartgetCenter = rg.Point3d(0,0,0)
        
        if isinstance(geo, rg.Polyline):
            sourceCenter = rg.AreaMassProperties.Compute(geo.ToPolylineCurve()).Centroid
            newPolyL = WebApp_Func.RelocateGeo(geo,sourceCenter,tartgetCenter)
            newGeo = newPolyL
        
        elif isinstance(geo, rg.Point3d):
            
            
            newPt = WebApp_Func.RelocateGeo(geo,sourceCenter,tartgetCenter)
            newGeo = newPt
            
        return newGeo
        
    @staticmethod
    def RelocateGeoFromOrigin(geo,tartgetCenter):
    
        sourceCenter = rg.Point3d(0,0,0)
    
        if isinstance(geo, rg.Polyline) or isinstance(geo, rg.PolylineCurve) or isinstance(geo, rg.LineCurve) or isinstance(geo, rg.PolyCurve):
            newPolyL = WebApp_Func.RelocateGeo(geo,sourceCenter,tartgetCenter)
            newGeo = newPolyL
        elif isinstance(geo, rg.Point3d):
            newPt = WebApp_Func.RelocateGeo(geo,sourceCenter,tartgetCenter)
            newGeo = newPt
        return newGeo
    
    @staticmethod
    def RelocateGeo(geo,sourceCenter,tartgetCenter):
        xChange = sourceCenter.X - tartgetCenter.X
        yChange = sourceCenter.Y - tartgetCenter.Y
        zChange = sourceCenter.Z - tartgetCenter.Z
    
        ### polyline case
        if isinstance(geo, rg.Polyline):
            newPts = []
            for point in geo:
                newPts.append(rg.Point3d(point.X - xChange,point.Y - yChange ,point.Z - zChange))
                newPolyL = rg.Polyline(newPts)
                newGeo = newPolyL
                
        elif isinstance(geo, rg.PolylineCurve) or isinstance(geo, rg.LineCurve) or isinstance(geo, rg.PolyCurve):
            newGeo = geo
            movingVec = tartgetCenter- sourceCenter
            newGeo.Transform(rg.Transform.Translation(movingVec.X,movingVec.Y,movingVec.Z))
            
        elif isinstance(geo, rg.Point3d):
            newPt = rg.Point3d(geo.X - xChange,geo.Y - yChange ,geo.Z - zChange)
            newGeo = newPt
        return newGeo
    
    @staticmethod
    def MoveFromOriginAndScale(geo,targetPoint,scale):
        geo_New = WebApp_Func.RelocateGeoFromOrigin(geo,targetPoint)
        transform = rg.Transform.Scale(targetPoint,scale)
        geo_New.Transform(transform)
        return geo_New
    
    @staticmethod
    def MoveFromOriginAndScaleAllParcels(parcels,targetPoint,scale):
        newParcels = []
        for parcel in parcels:
            newParcels.append(WebApp_Func.MoveFromOriginAndScale(parcel,targetPoint,scale))
        return newParcels
    
    
    #endregion
    
    
    #########################################################
    #################     Untility     ######################
    #########################################################
    @staticmethod
    def OffsetInward(polyL,offsetDist):
        #convert to polylineCurve for offset
        polyLCrv = polyL.ToPolylineCurve()

        offset1= polyLCrv.Offset(wxy_Plane,offsetDist,0.001,rg.CurveOffsetCornerStyle.Sharp)[0]
        offset2= polyLCrv.Offset(wxy_Plane,-offsetDist,0.001,rg.CurveOffsetCornerStyle.Sharp)[0]
        if offset1.GetLength() < offset2.GetLength() :
            choice = offset1
        else:
            choice = offset2
            
        return choice
    
    @staticmethod
    def OffsetInwardPolyline(polyL,offsetDist):
        #convert to polylineCurve for offset
        polyLCrv = polyL.ToPolylineCurve()

        offset1= polyLCrv.Offset(wxy_Plane,offsetDist,0.001,rg.CurveOffsetCornerStyle.Sharp)[0]
        offset2= polyLCrv.Offset(wxy_Plane,-offsetDist,0.001,rg.CurveOffsetCornerStyle.Sharp)[0]
        if offset1.GetLength() < offset2.GetLength() :
            choice = offset1
        else:
            choice = offset2
            
        #convert back to polyline
        pointCount = choice.PointCount
        offsetPolyline = rg.Polyline(pointCount)
        for i in range(pointCount):
            offsetPolyline.Add(choice.Point(i))
            
        return offsetPolyline
    
    
    
    #########################################################
    #############   DracoCompression     ####################
    #########################################################
    @staticmethod
    def ConvertPolyLToMeshExtrusion(polyL):

        #convert to polylineCurve for offset
        polyLCrv = polyL.ToPolylineCurve()

        offset1= polyLCrv.Offset(wxy_Plane,tol,tol,rg.CurveOffsetCornerStyle.Sharp)[0]
        offset2= polyLCrv.Offset(wxy_Plane,-tol,tol,rg.CurveOffsetCornerStyle.Sharp)[0]
        if offset1.GetLength() > offset2.GetLength() :
            choice = offset1
        else:
            choice = offset2
        
        #convert back to polyline
        #pointCount = choice.PointCount;
        #offsetPolyline = rg.Polyline(pointCount);
        #for i in range(pointCount):
            #offsetPolyline.Add(choice.Point(i));


        #mesh = ghc.MeshBrep(brep,defaultMeshParams) # ?????
        #mesh = ghc.MeshBrep(brep)
        
        brep = ghc.Extrude(choice,rg.Vector3d(0,0,10))
        brep = ghc.CapHoles(brep)
        
        defaultMeshParams = rg.MeshingParameters.Default
        meshes = rg.Mesh.CreateFromBrep(brep, defaultMeshParams)
        return meshes #its a list

    @staticmethod
    def ConvertPolyLToMesh_Move(polyL):

        mesh= rg.Mesh.CreateFromClosedPolyline(polyL)
        movement = rg.Transform.Translation(0,0,10)
        mesh.Transform(movement)

        return mesh
    
    @staticmethod     
    def DracoCompression(mesh):
        options =  rh.FileIO.DracoCompressionOptions()
        options.CompressionLevel = 5
        options.IncludeTextureCoordinates = False
        options.IncludeVertexColors = False

        compressed = rh.FileIO.DracoCompression.Compress(mesh, options)
        base64Draco = compressed.ToBase64String()
        return base64Draco
    
    @staticmethod     
    def DracoCompression_MoveZ(polyL):
        mesh= rg.Mesh.CreateFromClosedPolyline(polyL)
        movement = rg.Transform.Translation(0,0,1)
        mesh.Transform(movement)
        options =  rh.FileIO.DracoCompressionOptions()
        options.CompressionLevel = 5
        options.IncludeTextureCoordinates = False
        options.IncludeVertexColors = False

        compressed = rh.FileIO.DracoCompression.Compress(mesh, options)
        base64Draco = compressed.ToBase64String()
        return base64Draco
    
    #########################################################
    #############     OutPut to JS       ####################
    #########################################################
    @staticmethod  
    def AssignWebTreeID(allNodes):
        count = 0
        for node in allNodes:
            node.webTreeID = count
            count+=1
    
    @staticmethod
    def StoreInfoIntoDict(allNodes,meshDracos):
        treeDict = {}

        for node in allNodes:
            key = node.webTreeID
            value = {}
            value["meshDraco"] = meshDracos[node.webTreeID]  #### currently its polyline 
            
            if node.parent != None:
                value["parent"] = node.parent.webTreeID  #### currently its polyline 
            else:
                value["parent"] = "None"
            
        
            childrenID = []
            if node.child_A!= None:
                childrenID.append(node.child_A.webTreeID)
            if node.child_B!= None:
                childrenID.append(node.child_B.webTreeID)
            if node.child_C!= None:
                childrenID.append(node.child_C.webTreeID)
                
            value["children"] = childrenID
            
            value["depth"] = node.depth
            treeDict[key] = value
        
        return treeDict
    
    @staticmethod
    def ExportToSperateDict(treeDict):
        IDList = []
        childrenList = []
        parentList = []
        depthList = []
        dracoList = []

        for key in treeDict.keys():
            IDList.append(key)
            childrenList.append(treeDict[key]["children"])
            parentList.append(treeDict[key]["parent"])
            depthList.append(treeDict[key]["depth"])
            dracoList.append(treeDict[key]["meshDraco"])
        
        return IDList,childrenList,parentList,depthList,dracoList
    
    @staticmethod
    def GetEvaluationValueList(EV,polyLs):
        areaList = []
        orientationList = []
        elongationList = []
        compactnessList = []
        convexityList = []
        
        for polyL in polyLs:
            
            ###convert type
            polyLCrv = polyL.ToPolylineCurve()
            
            area = rg.AreaMassProperties.Compute(polyLCrv).Area
            orientation =  rm.ToDegrees(EV.EvaluateOrientation(polyLCrv,0)) #angle against X-axis
            elongation = EV.EvaluateElongation(polyLCrv)
            compactness = EV.EvaluateCompactness(polyLCrv)
            convexity = EV.EvaluateCompactness(polyLCrv)
            
            areaList.append(area)
            orientationList.append(orientation)
            elongationList.append(elongation)
            compactnessList.append(compactness)
            convexityList.append(convexity)

        return areaList,orientationList,elongationList,compactnessList,convexityList
# ---------- end ghpython_script_5 ----------
ghpython_script_6 = GhPythonScript()  # -> out, PL
# ---------- ghpython_script_6: Python ----------
###########################
####    Import Libs    ####
###########################
import Rhino.Geometry as rg
#import Rhino.RhinoDoc as rd
import Rhino.RhinoMath as rm

import ghpythonlib.components as ghc
import math




###########################
####    Parcellation   ####
###########################
class PL:
    class ParcVertex:
        def __init__(self,vertex,ID):
            self.geometry = vertex     
            self.ID = ID 
            self.onBoundary = False 
            self.orginal = False 
            
        def __del__(self):
            self.geometry = None
            self.ID = None
            self.onBoundary = None 
            self.orginal = None 
            
        def DeepCopy(self):
            newParcV = PL.ParcVertex(self.geometry,self.ID)
            newParcV.onBoundary = self.onBoundary 
            newParcV.orginal = self.orginal 
            return newParcV

        def GetAllEdges_AsStartV(self,currEdict):
            allEdges = currEdict.values()
            edgeCollection = []
            for edge in allEdges:
                if edge.startVertex == self:
                    edgeCollection.append(edge)
            return edgeCollection
            
    class ParcPoint:
        def __init__(self,point,ID):
            self.geometry = point
            self.ID = ID 
            
        def __del__(self):
            self.geometry = None
            self.ID = None
            
        def DeepCopy(self):
            return PL.ParcPoint(self.geometry,self.ID)
    
    class ParcTurningPoint:
        def __init__(self,point,ID):
            self.geometry = point
            self.ID = ID 
            self.onBoundary = False 
            
        def __del__(self):
            self.geometry = None
            self.ID = None
            
        def DeepCopy(self):
            return PL.ParcTurningPoint(self.geometry,self.ID)
        
    class ParcResamplePoint:
        def __init__(self,point,ID):
            self.geometry = point
            self.ID = ID 
            self.turning = False
            self.onBoundary = False 
             
        def __del__(self):
            self.geometry = None
            self.ID = None
            
        def DeepCopy(self):
            return PL.ParcTurningPoint(self.geometry,self.ID)
        
    class ParcEdge:
        def __init__(self,ID):  
            
            self.startVertex = None              
            self.endVertex = None                   
            self.betweenPoints = []  
            self.turningPoints = []   
            self.resamplePoints = []  
            self.ID = ID
            self.twin = None
            self.twinID = None
            
            self.generation = None
            self.offsetDistance = 0
            self.hierarchy = None
            
            self.accessibility = True  ### currently for Access Point
            self.shrink = None
            
        def __del__(self):
            self.startVertex = None
            self.endVertex = None
            self.betweenPoints = None 
            self.ID = None
            self.twin = None
            self.twinID = None
        
            self.generation = None
            self.offsetDistance = None
            self.hierarchy = None
            
            self.accessibility = None  ### currently for Access Point
            self.shrink = None
            
            
            
        def FillInfo(self,list):
            for i in range(len(list)):
                if i == 0:
                    self.startVertex = list[0]
                elif i == len(list)-1:
                    self.endVertex = list[len(list)-1]
                else:
                    self.betweenPoints.append(list[i])
        
        def Reverse(self):
            temp=self.startVertex
            self.startVertex=self.endVertex
            self.endVertex=temp
            self.betweenPoints.reverse()
            
        def CreateTwin(self,ID):
            newEdge = PL.ParcEdge(ID)
            newEdge.startVertex = self.endVertex
            newEdge.endVertex = self.startVertex
            for i in range(len(self.betweenPoints)-1,-1,-1):

                newEdge.betweenPoints .append(self.betweenPoints[i])
            
            newEdge.twin = self
            newEdge.twinID = self.ID
            self.twin = newEdge
            self.twinID = ID
            
            return newEdge
                    
        def DeepCopy(self,PV_Dict):
            #Use Active PV_Dict
            #Add Edge 
            #Later need to redirect to get the twin address
            
            newEdge = PL.ParcEdge(self.ID)
            
            newEdge.startVertex = PV_Dict[self.startVertex.ID]
            newEdge.endVertex = PV_Dict[self.endVertex.ID]
            
            for bPt in self.betweenPoints:
                newEdge.betweenPoints.append(PV_Dict[bPt.ID])
            
            newEdge.twinID = self.twinID
            
            newEdge.generation = self.generation
            newEdge.offsetDistance = self.offsetDistance
            newEdge.hierarchy = self.hierarchy
            
            
            newEdge.accessibility = self.accessibility
            return newEdge
        
        def SplitEdge_Naked_Normal(self,shareEdge,newV,E_Dict,VP_Dict):
            
            #Check if newV is too close to exsiting V
            distToStart = newV.geometry.DistanceTo(self.startVertex.geometry)
            distToEnd = newV.geometry.DistanceTo(self.endVertex.geometry)
            if distToStart<0.01:
                theNewEdge = E_Dict[self.ID]
                newV =  theNewEdge.startVertex
                shareEdge.startVertex = newV
                print "VV too close happened!"

            elif distToEnd<0.01:
                theNewEdge = E_Dict[self.ID]

                newV =  theNewEdge.endVertex
                shareEdge.endVertex = newV
                print "VV too close happened!"

            currMaxID = max(E_Dict.Keys)
            newEdge_1 = PL.ParcEdge(currMaxID+1)
            newEdge_2 = PL.ParcEdge(currMaxID+2)
            
            newEdge_1.startVertex = self.startVertex
            newEdge_1.endVertex = newV
            
            newEdge_2.startVertex = newV
            newEdge_2.endVertex = self.endVertex
            
            E_Dict[newEdge_1.ID] = newEdge_1
            E_Dict[newEdge_2.ID] = newEdge_2
            
            # remove the split edge
            #print ("in SplitEdge_Naked_Normal")
            #print ("E_Dict.pop(self.ID): ", self.ID , id(E_Dict[self.ID]))
            E_Dict.pop(self.ID)
            
            # For road  
            newEdge_1.generation = self.generation
            newEdge_2.generation = self.generation
            newEdge_1.hierarchy = self.hierarchy 
            newEdge_2.hierarchy = self.hierarchy 
            
            
            newEdge_1.accessibility = self.accessibility
            newEdge_2.accessibility = self.accessibility
            
            if newEdge_1.startVertex== newEdge_1.endVertex:
                newEdge_1 = "invalid"
            if newEdge_2.startVertex == newEdge_2.endVertex:
                newEdge_2 = "invalid"

            return newEdge_1,newEdge_2
        
        def SplitEdge_Shared_Normal(self,shareEdge,newV,E_Dict,VP_Dict,indexPair):
            #Check if newV is too close to exsiting V
            distToStart = newV.geometry.DistanceTo(self.startVertex.geometry)
            distToEnd = newV.geometry.DistanceTo(self.endVertex.geometry)
            
            if distToStart<0.01:
                theNewEdge = E_Dict[self.ID]
                newV =  theNewEdge.startVertex
                shareEdge.startVertex = newV
                print "VV too close happened!"
                #print newV.geometry.X,newV.geometry.Y,0
            elif distToEnd<0.01:
                theNewEdge = E_Dict[self.ID]
                newV =  theNewEdge.endVertex
                shareEdge.endVertex = newV
                print "VV too close happened!"
                #print newV.geometry.X,newV.geometry.Y,0
            
 
            currMaxID = max(E_Dict.keys())
            all = self.GetVPInstance()

            #ID gap for their twins
            newEdge_1 = PL.ParcEdge(currMaxID+1)
            newEdge_2 = PL.ParcEdge(currMaxID+3)
            
            #fill info for newEdge_1
            newEdge_1.startVertex = self.startVertex
            newEdge_1.endVertex = newV
            
            for i in range(len(all)):
                if i!=0 and i !=len(all)-1 and i <= indexPair[0]:
                    newEdge_1.betweenPoints.append(all[i])
                    
            ### check if the last seg length
            if newEdge_1.betweenPoints != []:
                dist = newEdge_1.betweenPoints[-1].geometry.DistanceTo(newV.geometry)
                if dist < 0.01:
                    print "VP too close happened!"
                    #print newEdge_1.betweenPoints[-1].geometry.X,newEdge_1.betweenPoints[-1].geometry.Y,newEdge_1.betweenPoints[-1].geometry.Z
                    newEdge_1.betweenPoints.pop() 
                    
                    
            #fill info for newEdge_2
            newEdge_2.startVertex = newV
            newEdge_2.endVertex = self.endVertex
            
            
            for i in range(len(all)):
                if i!=0 and i !=len(all)-1 and i >= indexPair[1]:
                    newEdge_2.betweenPoints.append(all[i])
                    
            ### check if the last seg length
            if newEdge_2.betweenPoints != []:
                dist = newEdge_2.betweenPoints[0].geometry.DistanceTo(newV.geometry)
                if dist < 0.01:
                    print "VP too close happened!"
                    #print newEdge_2.betweenPoints[-1].geometry.X,newEdge_2.betweenPoints[-1].geometry.Y,newEdge_2.betweenPoints[-1].geometry.Z
 
                    newEdge_2.betweenPoints.pop(0) 
                    
                
            #create twins
            newEdge_1_twin = newEdge_1.CreateTwin(currMaxID+2)
            newEdge_2_twin = newEdge_2.CreateTwin(currMaxID+4)
            
            #store in Dict
            E_Dict[newEdge_1.ID] = newEdge_1
            E_Dict[newEdge_1_twin.ID] = newEdge_1_twin
            E_Dict[newEdge_2.ID] = newEdge_2
            E_Dict[newEdge_2_twin.ID] = newEdge_2_twin
            
            #remove the split edge
            #print ("in SplitEdge_Shared_Normal")
            #print ("E_Dict.pop(self.ID): ", self.ID , id(E_Dict[self.ID]))
            E_Dict.pop(self.ID)
            
            
            # For road  
            newEdge_1.generation = self.generation
            newEdge_1_twin.generation = self.generation
            newEdge_2.generation = self.generation
            newEdge_2_twin.generation = self.generation
            
            newEdge_1.hierarchy = self.hierarchy 
            newEdge_1_twin.hierarchy = self.hierarchy 
            newEdge_2.hierarchy = self.hierarchy 
            newEdge_2_twin.hierarchy = self.hierarchy 
            
            newEdge_1.accessibility = self.accessibility
            newEdge_1_twin.accessibility = self.accessibility
            newEdge_2.accessibility = self.accessibility
            newEdge_2_twin.accessibility = self.accessibility
            
            
            if newEdge_1.startVertex== newEdge_1.endVertex:
                newEdge_1 = "invalid"
            if newEdge_2.startVertex== newEdge_2.endVertex:
                newEdge_2 = "invalid"
            if newEdge_1_twin.startVertex== newEdge_1_twin.endVertex:
                newEdge_1_twin = "invalid"
            if newEdge_2_twin.startVertex== newEdge_2_twin.endVertex:
                newEdge_2_twin = "invalid"
                
            return newEdge_1,newEdge_1_twin,newEdge_2,newEdge_2_twin
           
            
        def SplitEdge_Naked_Special(self,shareEdge,newV_Start,newV_End,E_Dict,VP_Dict):
            #Check if newV is too close to exsiting V
            distToStart = newV.geometry.DistanceTo(self.startVertex.geometry)
            distToEnd = newV.geometry.DistanceTo(self.endVertex.geometry)
            if distToStart<0.01:
                theNewEdge = E_Dict[self.ID]
                newV =  theNewEdge.startVertex
                shareEdge.startVertex = newV
                print "VV too close happened!_Special"
            elif distToEnd<0.01:
                theNewEdge = E_Dict[self.ID]
                newV =  theNewEdge.endVertex
                shareEdge.endVertex = newV
                print "VV too close happened!_Special"
            currMaxID = max(E_Dict.Keys)
            newEdge_1 = PL.ParcEdge(currMaxID+1)
            newEdge_2 = PL.ParcEdge(currMaxID+2)
            newEdge_3 = PL.ParcEdge(currMaxID+3)
            
            newEdge_1.startVertex = self.startVertex
            newEdge_1.endVertex = newV_End
            
            newEdge_2.startVertex = newV_End
            newEdge_2.endVertex = newV_Start
            
            newEdge_3.startVertex = newV_Start
            newEdge_3.endVertex = self.endVertex
            
            E_Dict[newEdge_1.ID] = newEdge_1
            E_Dict[newEdge_2.ID] = newEdge_2
            E_Dict[newEdge_3.ID] = newEdge_3
            
            #remove the split edge
            del E_Dict[self.ID]
            
            
            # For road  
            newEdge_1.generation = self.generation
            newEdge_2.generation = self.generation
            newEdge_3.generation = self.generation

            newEdge_1.hierarchy = self.hierarchy 
            newEdge_1_twin.hierarchy = self.hierarchy 
            newEdge_2.hierarchy = self.hierarchy 
            newEdge_2_twin.hierarchy = self.hierarchy 
            newEdge_3.hierarchy = self.hierarchy 
            newEdge_3_twin.hierarchy = self.hierarchy 
            
            newEdge_1.accessibility = self.accessibility
            newEdge_2.accessibility = self.accessibility
            newEdge_3.accessibility = self.accessibility
            
            if newEdge_1.startVertex== newEdge_1.endVertex:
                newEdge_1 = "invalid"
            if newEdge_2.startVertex== newEdge_2.endVertex:
                newEdge_2 = "invalid"
            if newEdge_3.startVertex== newEdge_3.endVertex:
                newEdge_3 = "invalid"
            return newEdge_1,newEdge_2,newEdge_3
        
        def SplitEdge_Shared_Special(self,shareEdge,newV_Start,newV_End,E_Dict,VP_Dict,startIndexPair,endIndexPair):
            
            #Check if newV is too close to exsiting V
            distToStart = newV_Start.geometry.DistanceTo(self.startVertex.geometry)
            distToEnd = newV_Start.geometry.DistanceTo(self.endVertex.geometry)
            
            if distToStart<0.01:
                theNewEdge = E_Dict[self.ID]
                newV_Start =theNewEdge.startVertex
                shareEdge.startVertex = newV_Start
                print "VV too close happened!_Special"
            elif distToEnd<0.01:
                theNewEdge = E_Dict[self.ID]
                newV_End =theNewEdge.endVertex
                shareEdge.endVertex = newV_End
                print "VV too close happened!_Special"    

                
            currMaxID = max(E_Dict.Keys)
            all = self.GetVPInstance()
            
            #ID gap for their twins
            newEdge_1 = PL.ParcEdge(currMaxID+1)
            newEdge_2 = PL.ParcEdge(currMaxID+3)
            newEdge_3 = PL.ParcEdge(currMaxID+5)
            
            #fill info for newEdge_1
            newEdge_1.startVertex = self.startVertex
            newEdge_1.endVertex = newV_End
            
            for i in range(len(all)):
                if i!=0 and i !=len(all)-1 and i <= endIndexPair[0]:
                    newEdge_1.betweenPoints.append(all[i])
            
            
            ### check if the last seg length
            if newEdge_1.betweenPoints != []:
                dist = newEdge_1.betweenPoints[-1].geometry.DistanceTo(newV_End.geometry)
                if dist < 0.01:
                    newEdge_1.betweenPoints.pop() 
                    print "VP too close happened!_Special"


            #fill info for newEdge_2
            newEdge_2.startVertex = newV_End
            newEdge_2.endVertex = newV_Start
            
            for i in range(len(all)):
                if i!=0 and i!=len(all)-1 and i >= endIndexPair[1] and i <= startIndexPair[0]:
                    newEdge_2.betweenPoints.append(all[i])
            
            ### check if the last seg length
            if newEdge_2.betweenPoints != []:
                dist = newEdge_2.betweenPoints[0].geometry.DistanceTo(newV_End.geometry)
                if dist < 0.01:
                    newEdge_2.betweenPoints.pop(0) 
                    print "VP too close happened!_Special"
            
            if newEdge_2.betweenPoints != []:
                dist = newEdge_2.betweenPoints[-1].geometry.DistanceTo(newV_Start.geometry)
                if dist < 0.01:
                    newEdge_2.betweenPoints.pop() 
                    print "VP too close happened!_Special"
            
               
            #fill info for newEdge_3
            newEdge_3.startVertex = newV_Start
            newEdge_3.endVertex = self.endVertex
            
            for i in range(len(all)):
                if i!=0 and i !=len(all)-1 and i >= startIndexPair[1]:
                    newEdge_3.betweenPoints.append(all[i])
           
           
            ### check if the last seg length
            if newEdge_3.betweenPoints != []:
                dist = newEdge_3.betweenPoints[0].geometry.DistanceTo(newV_Start.geometry)
                if dist < 0.01:
                    newEdge_3.betweenPoints.pop(0) 
                    print "VP too close happened!_Special"    
                
                     
            #create twins
            newEdge_1_twin = newEdge_1.CreateTwin(currMaxID+2)
            newEdge_2_twin = newEdge_2.CreateTwin(currMaxID+4)
            newEdge_3_twin = newEdge_3.CreateTwin(currMaxID+6)
            
            #store in Dict
            E_Dict[newEdge_1.ID] = newEdge_1
            E_Dict[newEdge_1_twin.ID] = newEdge_1_twin
            E_Dict[newEdge_2.ID] = newEdge_2
            E_Dict[newEdge_2_twin.ID] = newEdge_2_twin
            E_Dict[newEdge_3.ID] = newEdge_3
            E_Dict[newEdge_3_twin.ID] = newEdge_3_twin
            
            #remove the split edge
            del E_Dict[self.ID]
            
            # For road 
            newEdge_1.generation = self.generation
            newEdge_1_twin.generation = self.generation
            newEdge_2.generation = self.generation
            newEdge_2_twin.generation = self.generation
            newEdge_3.generation = self.generation
            newEdge_3_twin.generation = self.generation
            
            
             
            newEdge_1.accessibility = self.accessibility
            newEdge_1_twin.accessibility = self.accessibility
            newEdge_2.accessibility = self.accessibility
            newEdge_2_twin.accessibility = self.accessibility
            newEdge_3.accessibility = self.accessibility
            newEdge_3_twin.accessibility = self.accessibility

            newEdge_1.hierarchy = self.hierarchy 
            newEdge_1_twin.hierarchy = self.hierarchy 
            newEdge_2.hierarchy = self.hierarchy 
            newEdge_2_twin.hierarchy = self.hierarchy 
            newEdge_3.hierarchy = self.hierarchy 
            newEdge_3_twin.hierarchy = self.hierarchy 
            

            if newEdge_1.startVertex== newEdge_1.endVertex:
                newEdge_1 = "invalid"
            if newEdge_2.startVertex== newEdge_2.endVertex:
                newEdge_2 = "invalid"
            if newEdge_3.startVertex== newEdge_3.endVertex:
                newEdge_3 = "invalid"
                
            if newEdge_1_twin.startVertex== newEdge_1_twin.endVertex:
                newEdge_1_twin = "invalid"
            if newEdge_2_twin.startVertex== newEdge_2_twin.endVertex:
                newEdge_2_twin = "invalid"
            if newEdge_3_twin.startVertex== newEdge_3_twin.endVertex:
                newEdge_3_twin = "invalid"
                
            return newEdge_1,newEdge_1_twin,newEdge_2,newEdge_2_twin,newEdge_3,newEdge_3_twin
        
        def GetGeometry(self):
            allPoints=[]
            
            
            allPoints.append(self.startVertex.geometry)
            
            if self.betweenPoints != []:
                for point in self.betweenPoints:
                    allPoints.append(point.geometry)
                    
            allPoints.append(self.endVertex.geometry)
            
            return rg.Polyline(allPoints)
        
        def GetGeometry_SimplifiedWithResamplePoints(self):
            allPoints=[]
            
            
            allPoints.append(self.startVertex.geometry)
            
            if self.resamplePoints != []:
                for point in self.resamplePoints:
                    allPoints.append(point.geometry)
                    
            allPoints.append(self.endVertex.geometry)
            
            return rg.Polyline(allPoints)
        
        def GetGeometry_Simplified(self):
            return rg.Line(self.startVertex.geometry,self.endVertex.geometry)
        
        def GetGeometry_SimplifiedWithTurningPoints(self):
            v_Geo = []
            v_Geo.append(self.startVertex.geometry)
            if self.turningPoints!=[]:
                for tPt in self.turningPoints:   
                    v_Geo.append(tPt.geometry)
            
            v_Geo.append(self.endVertex.geometry)
            
            if len(v_Geo) == 2:
                newPolyL = rg.Polyline(2)
                newPolyL.Add(v_Geo[0])
                newPolyL.Add(v_Geo[1])
                return newPolyL
            else:
                return rg.Polyline(v_Geo)
            
            
            
        def GetVPInstance(self):
            allPoints=[]
            allPoints.append(self.startVertex)
            
            if self.betweenPoints != None:
                for point in self.betweenPoints:
                    allPoints.append(point)
            
            ### small differentfrom the parcFace method, need to get the last vertex 
            allPoints.append(self.endVertex)
            return allPoints
                    
        def GetVPID(self):
            allPoints=[]
            allPoints.append(self.startVertex.ID)
            
            if self.betweenPoints != None:
                for point in self.betweenPoints:
                    allPoints.append(point.ID)
            
            ### small differentfrom the parcFace method, need to get the last vertex 
            allPoints.append(self.endVertex.ID)
            return allPoints
            
    class ParcFace:
        def __init__(self):
            self.processMesh = None
            
            self.vertices = []          
            self.edges = []                           
            self.area = None
            self.elongation = None
            self.SortedSL = None
            
            self.startPt = None
            self.specificStreamline = None
            
            
            # tree info
            self.alive = True
            self.identity = None
            self.child_A = None
            self.child_B = None
            self.child_C = None  ### This is to store Dead Node, if this is not None, child A and B must be None
            
            self.parent = None
            self.depth = None
            self.neighbors=[] 
            #self.mutualVP={} 
            self.mutualE_P={} 
            self.mutualP_E={}
            self.situation = 0   #decide which method is going to use
            self.triangleSize = None #the triangleSize that is used for remesh
            
        def __del__(self):
            self.vertices = None          
            self.edges = None                          
            self.geometery = None
            self.area = None
            self.elongation = None
            self.sortedSL = None
            self.specificStreamline = None
            self.status = ["Proceed"]
            
            # tree info
            self.alive = None
            self.identity = None
            self.child_A = None
            self.child_B = None
            self.child_C = None
            
            self.parent = None
            self.depth = None
            self.neighbors=[] 
            #self.mutualVP={} 
            self.mutualE_P = None
            self.mutualP_E = None
            self.situation = 0   #decide which method is going to use
            self.triangleSize = None #the triangleSize that is used for remesh
        
        def DeepCopy(self,VP_Dict,E_Dict):
            newParcFace = PL.ParcFace()
            
            newParcFace.identity = self.identity
            for edge in self.edges:
                #Add vertices 
                newParcFace.AddFaceV(VP_Dict[edge.startVertex.ID])
                
                
                #Add Edge 
                newEdge = E_Dict[edge.ID]
                
                    #print ("doing newEdge = E_Dict[edge.ID], edge.ID:"),edge.ID
                    #return "something wrong......."
               
                newParcFace.edges.append(newEdge)
            
            newParcFace.SortedSL = self.SortedSL
            newParcFace.specificStreamline = self.specificStreamline 
            
            newParcFace.alive = self.alive
            
            newParcFace.child_A = self.child_A
            newParcFace.child_B = self.child_B
            newParcFace.child_C = self.child_C    ### This is to store Dead Node
            
            newParcFace.parent = self.parent     # parent is correct , no need to change
            
            #if self.alive == False:
                #newParcFace.depth = self.depth +1        ### this might cause +2: from working - >solution, from solution -> working
            #else:
            newParcFace.depth = self.depth 
                
            newParcFace.neighbors = []
            for neigbor in self.neighbors:
                newParcFace.neighbors.append(neigbor)
            # neighbors is linking to previous depth, need to relink ### be careful, this need to append one by one
            
            newParcFace.mutualE_P = {}
            for key in self.mutualE_P:
                newParcFace.mutualE_P[key] = self.mutualE_P[key]

            newParcFace.mutualP_E = {}
            for key in self.mutualP_E:
                newParcFace.mutualP_E[key] = self.mutualP_E[key]

            newParcFace.situation = self.situation
            newParcFace.triangleSize = self.triangleSize

            if self.startPt != None:
                startPtID = self.startPt.ID
                newParcFace.startPt = VP_Dict[startPtID]
            
            #print "in deepcopy"
            #print "orginal ", id(self), len(self.vertices),len(self.edges),self.edges
            #print "new ", id(newParcFace), len(newParcFace.vertices),len(newParcFace.edges),self.edges
            return newParcFace
            
        def AddFaceV(self,item):
            self.vertices.append(item)
            #print "add vertex",item.ID
            

        def FormParcFace_First(self,input,hierarchyInput):
            #The first input only have vertices
            input,tag = self.MakeCounterClockwiseDirection(input)
            useHierarchy = [cat for cat in hierarchyInput]
            if tag == 0:
                pass
            elif tag ==1:
                useHierarchy.reverse()
            inputVertices=[]
            for index in range(len(input)-1):
                inputVertices.append(input[index])
                
            vertices=[]
            for index in range(len(inputVertices)):
                vertex = PL.ParcVertex(inputVertices[index],index)
                vertex.original = True
                vertices.append(vertex)
                

            self.vertices = vertices
            
            edges=[]
            
            edgeCount = 0
            for i in range(len(self.vertices)):
                edge=PL.ParcEdge(edgeCount)
                
                edge.generation = "Naked" ### for road hierarchy
                try:
                    edge.hierarchy = useHierarchy[i]
                except:
                    edge.hierarchy = None
                if i !=len(self.vertices)-1:
                    edge.startVertex = self.vertices[i]
                    edge.endVertex = self.vertices[i+1]
                    
                else:
                    edge.startVertex = self.vertices[i]
                    edge.endVertex = self.vertices[0]
                edges.append(edge)
                
                edgeCount+=1
            
            
                
            self.edges=edges
            self.depth = 0
            
        ### GetGeometry 
        def GetGeometry(self):
            all=[]
            
            for edge in self.edges:
                all.append(edge.startVertex.geometry)
                
                for point in edge.betweenPoints:
                    all.append(point.geometry)
            

            all.append(self.vertices[0].geometry)
            
            return rg.Polyline(all)
        
        def GetGeometry_Simplified(self): 

            vertices = self.vertices
            v_Geo = [v.geometry for v in vertices]
            v_Geo.append(v_Geo[0])
            
            return rg.Polyline(v_Geo)

        def GetGeometry_SimplifiedWithTurningPoints(self): 
            v_Geo = []
            for edge in self.edges:
                
                v_Geo.append(edge.startVertex.geometry)
                if edge.turningPoints!=[]:
                    for tPt in edge.turningPoints:
                            
                        v_Geo.append(tPt.geometry)
            
            v_Geo.append(v_Geo[0])

            return rg.Polyline(v_Geo)
    
        def GetGeometry_SimplifiedWithResamplePoints(self):
            v_Geo = []
            for edge in self.edges:
                
                v_Geo.append(edge.startVertex.geometry)
                if edge.resamplePoints!=[]:
                    for rPt in edge.resamplePoints:
                            
                        v_Geo.append(rPt.geometry)
            
            v_Geo.append(v_Geo[0])

            return rg.Polyline(v_Geo)
        
        ### Get V P E
        def GetVPID(self):
            all=[]
            
            for edge in self.edges:
                all.append(edge.startVertex.ID)
                
                for point in edge.betweenPoints:
                    all.append(point.ID)
                    
            #all.append(self.vertices[0].ID)
            return all
            
        def GetVPInstance(self):
            all=[]
            
            for edge in self.edges:
                all.append(edge.startVertex)
                
                for point in edge.betweenPoints:
                    all.append(point)
                    
            #all.append(self.vertices[0])
            return all
            
        def GetVPGeo(self):
            all=[]
            
            for edge in self.edges:
                all.append(edge.startVertex.geometry)
                for point in edge.betweenPoints:
                    all.append(point.geometry)
            
            return all
        

        def GetVPID_SimplifiedWithResamplePoints(self):
            all=[]
            
            for edge in self.edges:
                all.append(edge.startVertex.ID)
                
                for point in edge.resamplePoints:
                    all.append(point.ID)
                    
            #all.append(self.vertices[0].ID)
            return all
        
        def GetVPInstance_SimplifiedWithResamplePoints(self):
            all=[]
            
            for edge in self.edges:
                all.append(edge.startVertex)
                
                for point in edge.resamplePoints:
                    all.append(point)
                    
            #all.append(self.vertices[0])
            return all
        
        def GetVPGeo_SimplifiedWithResamplePoints(self):
            all=[]
            
            for edge in self.edges:
                all.append(edge.startVertex.geometry)
                for point in edge.resamplePoints:
                    all.append(point.geometry)
            
            return all
        
        def GetVPID_SimplifiedWithTurningPoints(self):
            all=[]
            
            for edge in self.edges:
                all.append(edge.startVertex.ID)
                
                for point in edge.turningPoints:
                    all.append(point.ID)
                    
            #all.append(self.vertices[0].ID)
            return all
        
        def GetVPInstance_SimplifiedWithTurningPoints(self):
            all=[]
            
            for edge in self.edges:
                all.append(edge.startVertex)
                
                for point in edge.turningPoints:
                    all.append(point)
                    
            #all.append(self.vertices[0])
            return all
        
        def GetVPGeo_SimplifiedWithTurningPoints(self):
            all=[]
            
            for edge in self.edges:
                all.append(edge.startVertex.geometry)
                for point in edge.turningPoints:
                    all.append(point.geometry)
            
            return all
            
        
        def GetEID(self):
            all=[]
            for edge in self.edges:
                
                all.append(edge.ID)
            return all
            
        def GetEInstance(self):
            all=[]
            for edge in self.edges:
                all.append(edge)
            return all
            
        def MakeCounterClockwiseDirection(self,inputPolyline):
            inputPolyline_copy = rg.Polyline(inputPolyline)
            inputPolylineCurve = inputPolyline_copy.ToPolylineCurve()
            if inputPolylineCurve.ClosedCurveOrientation().ToString() == "Clockwise":
                inputPolyline_copy.Reverse()
                tag = 1
            else:
                tag = 0
                pass
            
            return inputPolyline_copy,tag

        def UpdateAffectedInfo_Normal(self,shareEdge,affectedEdge,newEdges,currEDict,choice):
            ### step1: Get the affectedEdge'twin 
            ### step2: Detect the insert position(id or indices) on this edge, get the pair
            
            ### step3: insert the new vertex to vertices List
            ### step4: insert new Edges , be careful ,these should be the twin version, delete the affected edge
            ### step5: remove the affected Edge from currE dict (also the tiwn)
        
            #tol = rd.ActiveDoc.ModelAbsoluteTolerance
            tol = 0.001
            ### STEP1
            targetEdge = affectedEdge.twin
            if choice == "start":
                checkPt = shareEdge.startVertex
            elif choice == "end":
                checkPt = shareEdge.endVertex
                
            ### STEP2
            if len(targetEdge.betweenPoints) == 0:
                pass
                ### impossible, only the boundary edge has no betweenPoints
            
            elif len(targetEdge.betweenPoints) != 0:
                all = targetEdge.GetVPInstance()

                for i in range(len(all)-1):
                    segment = rg.Line(all[i].geometry,all[+1].geometry)
                    if segment.DistanceTo(checkPt.geometry,True)<tol:
                        insertPair = [i,i+1] ### this is index on Edge, not ID
                    

            ### STEP3
            startID = targetEdge.startVertex.ID
            #endID = targetEdge.endVertex.ID
            allVertexIndices = self.GetVPID()
 
            startIDIndex = allVertexIndices.index(startID)
            self.vertices.insert(startIDIndex+1,checkPt)
            
            ### STEP4
            edgeReplaceIndex = self.edges.index(targetEdge)
            self.edges.insert(edgeReplaceIndex,newEdges[3])  ### insert the twin one
            self.edges.insert(edgeReplaceIndex+1,newEdges[1]) ### insert the twin one
            self.edges.remove(targetEdge)  ### remove the old one
            
            ### STEP5
            #print "targetEdge:",targetEdge,targetEdge.ID
            
            #if targetEdge.twin !=None:
                #print "targetEdge.twin:",targetEdge.twin,targetEdge.twin.ID
            
            #for key in currEDict:
                #print key
            #print ("removing edge ID",targetEdge.ID)
            
            #print ("in UpdateAffectedInfo_Normal"),
            #print ("treating this node :"), id(self)
            #print ("E_Dict.pop(targetEdge.ID): "), targetEdge.ID ,("E_Dict.pop(targetEdge.address): "), id(currEDict[targetEdge.ID])
            currEDict.pop(targetEdge.ID)
            ##### has been remove when constructing the children of currNode
            #if targetEdge.twin !=None:
                #currEDict.pop(targetEdge.twin.ID)
                
        def UpdateAffectedInfo_Special(self,shareEdge,affectedEdge,newEdges,startSplitPointPair,endSplitPointPair,currEDict):
            ### step1: Get the affectedEdge'twin 
            ### step2: Get the insert position(id or indices) on this edge,insert the new vertex to vertices List
            ### step3: insert new Edges , be careful ,these should be the twin version, delete the affected edge
            ### step4: remove the affected Edge from currE dict, also its t
        
            #tol = rd.ActiveDoc.ModelAbsoluteTolerance
            tol = 0.001
            ### STEP1
            targetEdge = affectedEdge.twin
            
                
            ### STEP2
            if len(targetEdge.betweenPoints) == 0:
                pass
                ### impossible, only the boundary edge has no betweenPoints
            num = len(targetEdge.GetVPID())
            firstInsertIndex = num - startSplitPointPair[1]
            secondInsertIndex = num - endSplitPointPair[1]  

            self.vertices.insert(firstInsertIndex,shareEdge.startVertex)
            self.vertices.insert(secondInsertIndex,shareEdge.endVertex)
            
            ### STEP4
            edgeReplaceIndex = self.edges.index(targetEdge)
            self.edges.insert(edgeReplaceIndex,newEdges[5])  ### insert the twin one
            #print "inserting  " ,newEdges[5].ID
            self.edges.insert(edgeReplaceIndex+1,newEdges[3]) ### insert the twin one
            #print "inserting  " ,newEdges[3].ID
            self.edges.insert(edgeReplaceIndex+2,newEdges[1]) ### insert the twin one
            #print "inserting  " ,newEdges[1].ID
            
            self.edges.remove(targetEdge)  ### remove the old one
            
            ### STEP5

            currEDict.pop(targetEdge.ID)
            #if targetEdge.twin !=None:
                #currEDict.pop(targetEdge.twin.ID)
            
            

    ##########################
    ###    Inaccessible    ### 
    ##########################
    #@staticmethod
    #def MarkInaccessibleEdges(self,indices):
        #for inaccessibleIndex in indices:
            #self.edges[inaccessibleIndex].accessibility = False
# ---------- end ghpython_script_6 ----------
ghpython_script_7 = GhPythonScript()  # -> out, SPF
# ---------- ghpython_script_7: Python ----------
###########################
####    Import Libs    ####
###########################
import Rhino.Geometry as rg
#import Rhino.RhinoDoc as rd
import Rhino.RhinoMath as rm
import Rhino.RhinoApp as ra

from collections import deque 
import Queue
import math

class SPF:
    ######################################
    ####            Debug           ####
    ######################################
    @staticmethod 
    def PrintCurrQAddress(currQ):
        address = []
        for node in currQ:
            address.append(id(node))
        print (address)

    @staticmethod 
    def PrintDictionaryAddress(redirectMap):
        collection = []
        for key in redirectMap:
            collection.append(str(id(key))+":"+str(id(redirectMap[key])))

        print (collection)

    @staticmethod 
    def PrintDictionaryAddress_VPE(dict):
        collection = []
        for key in dict:

            collection.append(str(key)+":"+str(id(dict[key])))
        print (collection)
            
    @staticmethod 
    def PrintCurrNodeNeighbors(currNode):
        ids = []
        for neighbor in currNode.neighbors:
            ids.append(id(neighbor))
        print (ids)
    
    @staticmethod
    def PrintThisNodeP_E(Node):
        print ("this Node address: "), id(Node),
        for key in Node.mutualP_E.keys():
            print ("this neighbor address: "), id(key), ("this edge address: "), id(Node.mutualP_E[key]), ("this edge ID: "), Node.mutualP_E[key].ID

    @staticmethod
    def PrintThisNodeE_P(Node):
        print ("this Node address: "), id(Node),
        for key in Node.mutualE_P.keys():
            print ("this edge address: "), id(key),("this edge ID: "),key.ID , ("this neighbor address: "), id(Node.mutualE_P[key])
            
    @staticmethod         
    def PrintAllEdgeIDinCurrQ(currQ):
        IDs = []
        for node in currQ:
             edges =    node.edges
             for edge in edges:
                 if edge.ID not in  IDs:
                        IDs.append(edge.ID)
        
        print (IDs)
        
    @staticmethod 
    def PrintAllNodesAddress(root):
        address = []
        if(root==None):
            return
    
        queue =Queue.Queue()
        queue.put(root)
        
        while (queue.empty()!=True):
            node = queue.get()
            address.append(id(node))
            
            if (node.child_A != None ):
                queue.put(node.child_A)
            
            if (node.child_B != None ):
                queue.put(node.child_B) 
            
            if (node.child_C != None ):
                queue.put(node.child_C) 
        
        print(address)    
    
    @staticmethod 
    def PrintAllNodesAlive(root):
        alives = []
        if(root==None):
            return
    
        queue =Queue.Queue()
        queue.put(root)
        
        while (queue.empty()!=True):
            node = queue.get()
            alives.append(node.alive)
            
            if (node.child_A != None ):
                queue.put(node.child_A)
            
            if (node.child_B != None ):
                queue.put(node.child_B) 
            
            if (node.child_C != None ):
                queue.put(node.child_C) 
        
        print(alives)    
        
    @staticmethod 
    def CheckRedirectParentChildren(redirectMap,currQ,p0):
        print ("CurrRedirectMap:")
        SPF.PrintDictionaryAddress(redirectMap)
        print ("CurrQAddress:")
        SPF.PrintCurrQAddress(currQ)
        
        print ("before Redirection:")
        SPF.PrintAllNodesAddress(p0)
        ##############SPF.RedirectParentChildren(currQ,redirectMap)   replace
        print ("after Redirection:")
        SPF.PrintAllNodesAddress(p0)
        
    @staticmethod 
    def PrintThisDepthNodeAddrss(collection):
        address = []
        for node in collection: 
            address.append(id(node))
        
        print (address)

    @staticmethod 
    def PrintThisDepthNodeAlive(collection):
        alives = []
        for node in collection: 
            alives.append(node.alive)
        
        print (alives)
  
  
    @staticmethod
    def PrintNeighborInfo(node):

        neighbors = node.neighbors
        address_neighbors = []
        for n in neighbors:
            address_neighbors.append(id(n))
        
        print (id(node)),address_neighbors   
        mutualE_P = node.mutualE_P
        # print ("printing mutualE_P")
        # for key in mutualE_P:
        #     print (key.ID), ":", id(mutualE_P[key])
        # print ("--------------------------------------------")
        # print ("printing mutualP_E")
        mutualP_E = node.mutualP_E
        for key in mutualP_E:
            
            print (id(key)), ":", mutualP_E[key].ID
    
    @staticmethod
    def TraversePrintNeighbor(root):
        
        if(root==None):
            return
    
        queue =Queue.Queue()
        queue.put(root)
        
        while (queue.empty()!=True):
            node = queue.get()
            neighborsAddress = []
            if node.neighbors!=[]:
                for i in range(len(node.neighbors)):
                    neighborsAddress.append(id(node.neighbors[i]))
                    
            if node.neighbors!=[]:        
                print ("this node ID: "),id(node),"its neighbors:",neighborsAddress
                
            else:
                print ("this node ID: "),id(node),"no neighbors"
            
                    
            if (node.child_A != None ):
                queue.put(node.child_A)
            
            if (node.child_B != None ):
                queue.put(node.child_B) 
                
            if (node.child_C != None ):
                queue.put(node.child_C) 
        
    @staticmethod 
    def PrintThisVPDepth(thisVP,collection_VP):
        depth = []
        for i in range(len(collection_VP)):
            if thisVP in collection_VP[i].values():
                depth.append(i)
        
        print (depth)
        
    @staticmethod 
    def PrintThisEDepth(thisE,collection_E):
        depth = []
        for i in range(len(collection_E)):
            if thisE in collection_E[i].values():
                depth.append(i)
        
        print (depth)     
    

    @staticmethod
    def CheckCurrQDepth(currQ):
        depths = []
        for node in currQ:
            depths.append(node.depth)   
        print (depths) 
           
    @staticmethod
    def CheckCurrQAlives(currQ):       
        alives = []
        for node in currQ:
            alives.append(node.alive)   
        print (alives) 
    ######################################
    ####            PreView           ####
    ######################################
    @staticmethod
    def ShowCurrPts(currVP_Dict):
        pts=[]
        
        keys = currVP_Dict.Keys
        for ID in keys:
            pts.append(currVP_Dict[ID].geometry)
            
        indices = []
        for ID in keys:
            indices.append(currVP_Dict[ID].ID)
        return pts,indices
    
    @staticmethod
    def ShowCurrEdge(currE_Dict):
        edges=[]
        
        keys = currE_Dict.Keys

        
        for ID in keys:
            edges.append(currE_Dict[ID].GetGeometry())
            
        indices = []
        for ID in keys:
            indices.append(currE_Dict[ID].ID)
        return edges,indices
    
    @staticmethod
    def ShowCurrParcFace(currQ):
        parcels = []
        address = []
        for node in currQ:
            parcels.append(node.GetGeometry())
            address.append(id(node))
        
        return parcels,address
    
    
    ############################################################################
    ####            Import Chekcing to ensure the address correct           ####
    ############################################################################
    @staticmethod 
    def CheckIfEdgeCorrect(currQ,currE_Dict):
        EInstances = [] 
        for parcFace in currQ:
            temp = parcFace.GetEInstance()
            EInstances.extend(temp)
            
        EInstances = set(EInstances)
        new_Dict = {}
        for edge in EInstances:
            new_Dict[edge.ID]=edge
            
        print ("currEdict"),
        SPF.PrintDictionaryAddress_VPE(currE_Dict)
        print ("edges in currQ"),
        SPF.PrintDictionaryAddress_VPE(new_Dict)
        
        if len(currE_Dict.keys()) != len(new_Dict.keys()):
            return False
        else :
            return True

    @staticmethod
    def CheckIfCurrQNeighborsInCurrQ(currQ):
        tag = None
        currQIDs = []
        for node in currQ:
            currQIDs.append(id(node))
            
        for node in currQ:
            ids = []
            for neighbor in node.neighbors:
                ids.append((id(neighbor)))
            for ID in ids:
                if ID not in currQIDs:
                    print ("this node : "), id(node),"'s neigbor not in currQ, ", "id: ",ID
                    tag =1
        if tag ==1:
            return False
        else:
            return True
    
    @staticmethod
    def CheckIfAllNodesDead(currQ):
        checkAlive = []
        for node in currQ:
            checkAlive.append(node.alive)
        if True not in checkAlive:
            return True
        else:
            return False

    @staticmethod
    def CheckIfP_EAndE_PCorrect(currQ):
        tag = 0
        for node in currQ:
            ### check if num are the same
            numNeighbor = len(node.neighbors)
            numP_E = len(node.mutualP_E.keys())
            numE_P = len(node.mutualE_P.keys())
            
            if numNeighbor == numP_E and numP_E == numE_P and numE_P == numNeighbor:
                pass
            else:
                print ("numNeighbor,numP_E,numE_P"),numNeighbor,numP_E,numE_P
                tag = 1
                SPF.PrintThisNodeE_P(node)
                SPF.PrintThisNodeP_E(node)
                
        if tag == 0:
            return True
        elif tag == 1:
            return False
            
            
    ######################################
    ####            SpeedUp           ####
    ######################################
    @staticmethod
    def KillNodesInAdvance(currQ,minArea):
        for node in currQ:
            if node.alive == True:
                parcelGeo = node.GetGeometry()
                if rg.AreaMassProperties.Compute(parcelGeo.ToPolylineCurve()).Area < 2*minArea:
                    node.alive == False
                    #print "kill one node"
                    
    ######################################
    ####          Tree Data           ####
    ######################################
    @staticmethod
    def InsertValue(splitResult,newTriangleSize,Q):
        
        thisNode = Q[0]
        parcel_A = splitResult[0]
        parcel_B = splitResult[1]
        
        parcel_A.triangleSize = newTriangleSize
        parcel_B.triangleSize = newTriangleSize
        
        # The left child of the current Node is used if its available
        if thisNode.child_A == None:
            thisNode.child_A = parcel_A
            thisNode.child_A.parent=thisNode
            
            
            thisNode.child_A.depth = thisNode.child_A.parent.depth+1
            Q.append(parcel_A)
            
        if thisNode.child_B == None:
            thisNode.child_B = parcel_B
            thisNode.child_B.parent=thisNode
            thisNode.child_B.depth = thisNode.child_B.parent.depth+1
            Q.append(parcel_B)
        
        #succeed and pop  
        Q.popleft()

    @staticmethod
    def FindTheBottomElements_LevelOrder(root):
        
        bottomElements = []
        if(root==None):
            return
        
        queue =Queue.Queue()
        queue.put(root)
        
        while (queue.empty()!=True):
            node = queue.get()
            #print (node)
            if node.child_A == None and node.child_B == None and node.child_C == None:
                bottomElements.append(node)
            
            if (node.child_A != None ):
                queue.put(node.child_A)
            
            if (node.child_B != None ):
                queue.put(node.child_B)
                
            if (node.child_C != None ):
                queue.put(node.child_C)
                
        return bottomElements

    @staticmethod
    def FindTheBottomElements_LevelOrder_Q(root):
        
        bottomElements = deque()
        if(root==None):
            return
        
        queue =Queue.Queue()
        queue.put(root)
        
        while (queue.empty()!=True):
            node = queue.get()
            if node.child_A == None and node.child_B == None and node.child_C == None:  
                bottomElements.append(node)
            
            if (node.child_A != None ): 
                queue.put(node.child_A)
            
            if (node.child_B != None ):
                queue.put(node.child_B)
                
            if (node.child_C != None ):
                queue.put(node.child_C)
                
        return bottomElements
        
    @staticmethod
    def CheckNeighbor(thisParcFace, comparedParcFace):
        c_Edges = comparedParcFace.edges
        this_Edges =thisParcFace.edges

        for edge in this_Edges:
            
            if edge in c_Edges or edge.twin in c_Edges:
                thisParcFace.neighbors.append(comparedParcFace)
                comparedParcFace.neighbors.append(thisParcFace)
                
                thisParcFace.mutualP_E[comparedParcFace] = edge
                thisParcFace.mutualE_P[edge] = comparedParcFace
                
                comparedParcFace.mutualP_E[thisParcFace] = edge
                comparedParcFace.mutualE_P[edge] = thisParcFace
                break
    
    @staticmethod
    def RemoveInvalidNeighbor(thisParcFace,currQ):
        #print ("IN RemoveInvalidNeighbor")
       # print ("should remove "),id(thisParcFace)
        for node in currQ:
            #print ("node:"),id(node)
            #print ("thisnode's neighbor"), SPF.PrintCurrNodeNeighbors(node)
            if thisParcFace in node.neighbors:
                # remove from neighbors
                node.neighbors.remove(thisParcFace)

                # remove from mutualE_P,mutualP_E
                removedE = node.mutualP_E[thisParcFace]
                removedP = thisParcFace
                
                #print ("this Node address"), id(node)
                #print ("removedE "),"address: ",id(removedE),"ID: ",removedE.ID,("removedP"),id(removedP)
                
                try:
                    if node.mutualE_P[removedE] == removedP:   ### because RedirectNeigbor might have updated this dict!!!
                        node.mutualE_P.pop(removedE)
                
                except:
                    print ("mutualE_P.")
                    SPF.PrintThisNodeE_P(node)
                    print ("mutualP_E.")
                    SPF.PrintThisNodeP_E(node)
                    print ("mistake in RemoveInvalidNeighbor")
                    print (node.mutualP_E[removedP])
                    print ("thisnode's neighbor"), SPF.PrintCurrNodeNeighbors(node)
                    print ("currNode Address"), SPF.PrintCurrQAddress(currQ)
                
                node.mutualP_E.pop(removedP)
                
    
                
                #print (node.mutualE_P)
                #print (node.mutualP_E)
                

    
    @staticmethod
    def TraverseCollectAllNodes(root):
        allNodes = []
        if(root==None):
            return
    
        queue =Queue.Queue()
        queue.put(root)
        
        while (queue.empty()!=True):
            node = queue.get()
            allNodes.append(node)
            
                    
            if (node.child_A != None ):
                queue.put(node.child_A)
            
            if (node.child_B != None ):
                queue.put(node.child_B) 
                
            if (node.child_C != None ):
                queue.put(node.child_C)     
                
        return allNodes
         
    ######################################
    ####           DeepCopy           ####
    ######################################
    @staticmethod
    def GetDeepCopyDict_VP(currQ):
        VPInstances = [] 
        for parcFace in currQ:
            temp = parcFace.GetVPInstance()
            VPInstances.extend(temp)
            
        VPInstances = set(VPInstances)
        
        
        new_Dict = {}
        for item in VPInstances:
            new_Dict[item.ID] = item.DeepCopy()
        return new_Dict
    
    @staticmethod
    def GetDeepCopyDict_E(currQ,newVPDict,collection_E):
        EInstances = [] 
        for parcFace in currQ:
            temp = parcFace.GetEInstance()
            EInstances.extend(temp)
            
        EInstances = set(EInstances)

        
        new_Dict = {}
        for edge in EInstances:
            new_Dict[edge.ID] = edge.DeepCopy(newVPDict)
            
            
        #RedirectToTwinEdge
        #for key in new_Dict:
            #print key
            #if new_Dict[key].twinID!=None:
                #print key,new_Dict[key].twinID
            
        for key in new_Dict:
            
            if new_Dict[key].twinID!=None:
                try:
                    new_Dict[key].twin = new_Dict[new_Dict[key].twinID]
                    
                except:
                    print ("something wrong with GetDeepCopyDict_E")
                    #print ("this is the new E Dict")
                    #print (new_Dict)
                    print (key),"is finding twinID",new_Dict[key].twinID
                    for parcFace in currQ:
                        Es = parcFace.GetEInstance()
                        for edge in Es:
                            if edge.ID == key: 
                                print ("thisNodeAddress: "), id(parcFace)
                                print ("thisNode's parent Address: "), id(parcFace.parent)
                                print ("thisNodeDepth: "), parcFace.depth
                                #allVP = parcFace.GetVPInstance()
                                #for vp in allVP:
                                    #print (vp.geometry)
                                #print ("thisEdgeStart: "), edge.startVertex.geometry,("thisEdgeEnd: "), edge.endVertex.geometry
                                SPF.PrintCurrQAddress(currQ)
                                depths = []
                                for node in currQ:
                                    depths.append(node.depth)   
                                print (depths) 
                                alives = []
                                for node in currQ:
                                    alives.append(node.alive)   
                                print (alives) 
                                print (parcFace.situation   )
                                print ("currEdict")
                                SPF.PrintDictionaryAddress_VPE(collection_E[-1])
                                print ("newEdict by Einstances")
                                SPF.PrintDictionaryAddress_VPE(new_Dict)
                                #print (parcFace.startPt.geometry    )
                                
                                
                    return ("shit happens")
                else:
                    pass
                    
            
        return new_Dict
    
    @staticmethod
    def GetDeepCopyParcFace(currQ,newVPDict,newEDict,redirectMap):
    
        newParcFaces = []
        for parcFace in currQ:
            newParcFaces.append(parcFace.DeepCopy(newVPDict,newEDict))
            
        for i in range(len(newParcFaces)):
            #insert both key:value and value:key
            redirectMap[newParcFaces[i]] = currQ[i] 
            redirectMap[currQ[i]] = newParcFaces[i]
        # this is for the working space
        
        return newParcFaces
    
    @staticmethod
    def GetDeepCopyParcFace_Q(currQ,newVPDict,newEDict,redirectMap):
        
        newParcFaces = deque()
        
        #print "currQ",currQ
        #print ("in GetDeepCopyParcFace_Q")
        for parcFace in currQ:
            newParcFace = parcFace.DeepCopy(newVPDict,newEDict)
            #if newParcFace.alive == False:
               # newParcFace.depth = newParcFace.depth +1
            #print ("the solution node, "),id(parcFace), ("copy to a new working node "),id(newParcFace)
            newParcFaces.append(newParcFace)
            
        for i in range(len(newParcFaces)):
            #insert both key:value and value:key
            redirectMap[newParcFaces[i]] = currQ[i] 
            redirectMap[currQ[i]] = newParcFaces[i]
        
        #print "newCOpy",newParcFaces
        #print "redirectMap",redirectMap
        # this is for the working space
        return newParcFaces
    
    
    
    
    ######################################
    ####           Redirect           ####
    ######################################
    @staticmethod
    def RedirectParentChildren(currQ,redirectMap):
        for parcFace in currQ:
            ### If this is a dead node, let the origianl node become its parent, depth has +1 already
            if parcFace.alive == False:
                #print ("In RedirectParentChildren treating this node:" ,id(parcFace))
                #print ("before, this node's parent is :" ,id(parcFace.parent))
                #print ("identity: "),parcFace.identity
                
                if parcFace.identity =="A":
                    parcFace.parent = parcFace.parent.child_A
                    
                elif parcFace.identity =="B":
                    parcFace.parent = parcFace.parent.child_B
                
                elif parcFace.identity =="C":
                    parcFace.parent = parcFace.parent.child_C
                
                parcFace.identity = "C"    
                #print ("after, this node's parent is :" ,id(parcFace.parent))
                ### No Matter A or B , just attach to A    
                parcFace.parent.child_C = parcFace    

        
    ###redirect the parcFaces to find the real parents

            elif parcFace.alive == True:
                #print ("inCurrQ:"),id(parcFace), "'s parent is : ", id(parcFace.parent)
                if parcFace.parent!=None:
                    #rediect parent
                    parcFace.parent  = redirectMap[parcFace.parent]
                    #rediect children
                    
                    if parcFace.identity =="A":
                        parcFace.parent.child_A = parcFace
                    
                    elif parcFace.identity =="B":
                        parcFace.parent.child_B = parcFace

    @staticmethod
    def RedirectNeighbors(currQ,newEDict,redirectMap):
        ### this is after deepcopy all the parcFaces in this depth
        ### redirect the parcFaces to find the real parents
        
        ### correct the parcFace's neighbors, let them point to current DeepCopy parcFace
        ### correct each parcFace's mutualE, let them point to current DeepCopy Edge 
        
        for parcFace in currQ:
            
            # update the "neighbors" 
            for i in range(len(parcFace.neighbors)):
                thisNeighbor = parcFace.neighbors[i] 
                parcFace.neighbors[i] = redirectMap[thisNeighbor]
                #print ("before redirection:"),id(parcFace),"'s neighbor is :",id(thisNeighbor)
                #print ("after redirection:"),id(parcFace),"'s neighbor is :",id(redirectMap[thisNeighbor])  
                
                 
            # update the "mutualP_E" 
            for key in parcFace.mutualP_E.Keys:
                edgeID = parcFace.mutualP_E[key].ID
                newMutualEdge = newEDict[edgeID]
                
                newParcFace = redirectMap[key]
                
                # add the new map
                parcFace.mutualP_E[newParcFace]=newMutualEdge
                
                # del the old one
                parcFace.mutualP_E.pop(key)
            
            # update the "mutualE_P" 
            for key in parcFace.mutualE_P.Keys:
                edgeID = key.ID
                newMutualEdge = newEDict[edgeID]
                
                newParcFace = redirectMap[parcFace.mutualE_P[key]]

                # add the new map
                parcFace.mutualE_P[newMutualEdge]=newParcFace
                
                # del the old one
                parcFace.mutualE_P.pop(key)

    @staticmethod
    def GetAffectedParcFace(parcFace,startEdge,endEdge,p0,collection_F,currQ,redirectMap):
        # get this parcFace's neighbors
        
        allNeighbors= parcFace.neighbors
        
        start_PF = None
        end_PF = None
        
        try:
            for neighbor in allNeighbors:
                if neighbor.mutualP_E[parcFace] == startEdge or neighbor.mutualP_E[parcFace] == startEdge.twin:
                    start_PF=neighbor
                    break

        except:
            print ("something wrong in GetAffectedParcFace")
            print ("this node(later be removed) depth:"),parcFace.depth, ("this (later be removed) address:"),id(parcFace)
            print ("this neighbor depth:"),neighbor.depth, ("this neighbor address:"),id(neighbor)
            print ("currQ ")
            SPF.PrintCurrQAddress(currQ)
            print ("this neighbor info ")
            SPF.PrintNeighborInfo(neighbor)
            SPF.CheckIfCurrQNeighborsInCurrQ(currQ)
            SPF.PrintDictionaryAddress(redirectMap)
            for i in range(len(collection_F)):
                print ("ThisDepth address")
                SPF.PrintThisDepthNodeAddrss(collection_F[i])
                SPF.PrintThisDepthNodeAlive(collection_F[i])
            return "shit happens"
        else:
            pass
        
        try:
            for neighbor in allNeighbors:
                if neighbor.mutualP_E[parcFace] == endEdge or neighbor.mutualP_E[parcFace] == endEdge.twin:
                    end_PF=neighbor
                    break
            
        except:
            print ("something wrong in GetAffectedParcFace")
            print ("this node depth:"),parcFace.depth, ("this node address:"),id(parcFace)
            print ("this neighbor depth:"),neighbor.depth, ("this neighbor address:"),id(neighbor)
            print ("currQ ")
            SPF.PrintCurrQAddress(currQ)
            
            SPF.CheckIfCurrQNeighborsInCurrQ(currQ)
            for i in range(len(collection_F)):
                print ("ThisDepth address")
                SPF.PrintThisDepthNodeAddrss(collection_F[i])
            return "shit happens"
        else:
            pass
            
        if start_PF != None:
            start_PF.situation = 1
            
        if end_PF != None:
            end_PF.situation = 1
            
        return start_PF,end_PF

    @staticmethod
    def GetAffectedParcFace_Constrained(parcFace,endEdge,p0,collection_F,currQ,redirectMap):
        # get this parcFace's neighbors
        
        allNeighbors= parcFace.neighbors

        end_PF = None
        
        for neighbor in allNeighbors:
            try:
                if neighbor.mutualP_E[parcFace] == endEdge or neighbor.mutualP_E[parcFace] == endEdge.twin:
                    end_PF=neighbor
                    break
            except:
                print ("something wrong in GetAffectedParcFace")
                print ("this node depth:"),parcFace.depth, ("this node address:"),id(parcFace)
                print ("this neighbor depth:"),neighbor.depth, ("this neighbor address:"),id(neighbor)
                print ("currQ ")
                SPF.PrintCurrQAddress(currQ)
                SPF.PrintDictionaryAddress(redirectMap)
                SPF.CheckIfCurrQNeighborsInCurrQ(currQ)
                for i in range(len(collection_F)):
                    print ("ThisDepth address")
                    SPF.PrintThisDepthNodeAddrss(collection_F[i])
        
                
          
                return "shit happens"  
            else:
                pass
        if end_PF != None:
            end_PF.situation = 1
            
        return end_PF


    @staticmethod
    def StoreAffectedPoint(parcFace,streamline):
        #tol = rd.ActiveDoc.ModelAbsoluteTolerance
        tol = 0.001
        sl_Geo = streamline.GetGeometry().ToPolylineCurve()
        parcel_Geo = parcFace.GetGeometry().ToPolylineCurve()
        
        pt = rg.Intersect.Intersection.CurveCurve(sl_Geo,parcel_Geo,tol,tol).Item[0].PointA
        parcFace.startPt = pt
       


    ######################################
    ####      Geometry Processing     ####
    ######################################
    @staticmethod
    def DetectLocation(parcFace,streamline):
        
        
        #tol = rd.ActiveDoc.ModelAbsoluteTolerance
        tol = 0.01 # simplify with cause discrepancy, so this one is set bigger 
        currEdges = parcFace.edges
        
        
        #SPF.HitBoundary(parcFace,streamline,10)
        
        ############### detect startpoint and endpoint location ###############
        
        ###first round locate
        ###locate edge
        startEdge=None
        endEdge=None
        startEdgeIndex=None
        endEdgeIndex=None
        startSplitPointPair=[]
        endSplitPointPair=[]
    
        for i in range(len(currEdges)):
            if startEdge==None:
                closestPt = currEdges[i].GetGeometry().ClosestPoint(streamline.startVertex.geometry)
                if closestPt.DistanceTo(streamline.startVertex.geometry) <=tol: #tol a bit weird here , so i change it to value
                    startEdge=currEdges[i]
                    startEdgeIndex = i
                
            if endEdge==None:
                closestPt = currEdges[i].GetGeometry().ClosestPoint(streamline.endVertex.geometry)
                if closestPt.DistanceTo(streamline.endVertex.geometry) <=tol:
                    endEdge=currEdges[i]
                    endEdgeIndex = i
                    
            if startEdge and endEdge:
                break
                
        #######################
        ####  Normal  case ####
        #######################
        if startEdgeIndex!=endEdgeIndex:
            flag=0  # to check if its special case 
            #classify the startEdge and endEdge to 1st touch egde and 2nd touch edge

            if startEdgeIndex>endEdgeIndex:
                streamline.Reverse()
                
                temp=startEdgeIndex
                startEdgeIndex=endEdgeIndex
                endEdgeIndex=temp
                
                temp=startEdge
                startEdge=endEdge
                endEdge=temp
            
            ####second round locate

        
            # if startEdge instance has "between points", conduct second round 
            
            try:
                if len(startEdge.betweenPoints)!=0:
                    all = startEdge.GetVPInstance()
                    
                    for i in range(len(all)-1):
    
                        segment=rg.Line(all[i].geometry,all[i+1].geometry)
                        if segment.DistanceTo(streamline.startVertex.geometry,True)<tol:   #tol a bit weird here , so i change it to value
                            
                            #print "DetectLocation" 
                            #print "hello",segment.DistanceTo(streamline.startVertex.geometry,True)
                            #print "start"
                            #print streamline.startVertex.geometry.X,streamline.startVertex.geometry.Y,0
                            #print "thisSeg"
                            #for v in all:
                                #print v.geometry.X,v.geometry.Y,0
                            startSplitPointPair=[i,i+1]
                            break
            except:
                print ("Inside DetectLocation: startEdge Error")
                for i in range(len(currEdges)):
                    closestPt = currEdges[i].GetGeometry().ClosestPoint(streamline.startVertex.geometry)
                    print (i),(closestPt.DistanceTo(streamline.startVertex.geometry)) ,"tol",tol
       
                #print ("startEdge:"), i
                #print (startEdge.startVertex.geometry.X),",",startEdge.startVertex.geometry.Y,",",startEdge.startVertex.geometry.Z
                #for point in startEdge.betweenPoints:
                   # print (point.geometry.X),",",point.geometry.Y,",",point.geometry.Z
                #print (startEdge.endVertex.geometry.X),",",startEdge.endVertex.geometry.Y,",",startEdge.endVertex.geometry.Z
                print ("(startEdgeIndex),startEdge"),(startEdgeIndex),startEdge
                print ("streamline,startVertex")
                print (streamline.startVertex.geometry.X),",",streamline.startVertex.geometry.Y,",",streamline.startVertex.geometry.Z
                
                for i in range(len(parcFace.edges)):
                    print ("edge:"), i
                    print (parcFace.edges[i].startVertex.geometry.X),",",parcFace.edges[i].startVertex.geometry.Y,",",parcFace.edges[i].startVertex.geometry.Z
                    for point in parcFace.edges[i].betweenPoints:
                        print (point.geometry.X),",",point.geometry.Y,",",point.geometry.Z
                    print (parcFace.edges[i].endVertex.geometry.X),",",parcFace.edges[i].endVertex.geometry.Y,",",parcFace.edges[i].endVertex.geometry.Z

                    
                print ("streamline")
                print (streamline.startVertex.geometry.X),",",streamline.startVertex.geometry.Y,",",streamline.startVertex.geometry.Z
                for point in streamline.betweenPoints:
                    print (point.geometry.X),",",point.geometry.Y,",",point.geometry.Z
                print (streamline.endVertex.geometry.X),",",streamline.endVertex.geometry.Y,",",streamline.endVertex.geometry.Z

   
            # if endEdge instance has "between points", conduct second round 
    
            if len(endEdge.betweenPoints)!=0:
                all = endEdge.GetVPInstance()
                for i in range(len(all)-1):
                    
                    segment=rg.Line(all[i].geometry,all[i+1].geometry)
                    if segment.DistanceTo(streamline.endVertex.geometry,True)<tol:
                        endSplitPointPair=[i,i+1]
                        break
                        
        #######################
        #### sepecial case ####
        #######################
        elif startEdgeIndex == endEdgeIndex:
            flag=1
            # sort the streamline order first
            comparedPosition=startEdge.startVertex.geometry
            
            streamlineStartPosition = streamline.startVertex.geometry
            streamlineEndPosition = streamline.endVertex.geometry
    
            
            distance1 = streamlineStartPosition.DistanceTo(comparedPosition)
            distance2 = streamlineEndPosition.DistanceTo(comparedPosition)
            
            if distance1 < distance2:
                streamline.Reverse()
            
    
            # in this case startedge will be split into 3 parts, which means I will store 4 indices here
            if len(startEdge.betweenPoints)!=0:
                all = startEdge.GetVPInstance()
                for i in range(len(all)-1):
                    segment=rg.Line(all[i].geometry,all[i+1].geometry)
                    if segment.DistanceTo(streamline.startVertex.geometry,True)<tol:
                        startSplitPointPair=[i,i+1]
    
            if len(endEdge.betweenPoints)!=0:
                for i in range(len(all)-1):
                    segment=rg.Line(all[i].geometry,all[i+1].geometry)
                    if segment.DistanceTo(streamline.endVertex.geometry,True)<tol:
                        endSplitPointPair=[i,i+1]
                        
        return startEdge,endEdge,startEdgeIndex,endEdgeIndex,startSplitPointPair,endSplitPointPair,flag

    @staticmethod
    def GetStartPtInfo(thisNode):
        for i in range(len(thisNode.edges)):
            edge = thisNode.edges[i]
            if edge.endVertex == thisNode.startPt:
                startPt_PrevE = edge
                startPt_PrevE_Index = i

            if edge.startVertex == thisNode.startPt:
                startPt_NextE = edge
                startPt_NextE_Index = i
        
        
        return [startPt_PrevE_Index,startPt_NextE_Index]
    
    
    @staticmethod
    def DetectLocation_Constrained(parcFace,streamline):
        #### Only Need to Detect The end
        
        #tol = rd.ActiveDoc.ModelAbsoluteTolerance
        tol = 0.01 # change because of simplification
        currEdges = parcFace.edges

        ############### detect startpoint and endpoint location ###############
        
        ###first round locate
        ###locate edge

        endEdge=None
        endEdgeIndex=None
        endSplitPointPair=[]
    
        for i in range(len(currEdges)):
                
            if endEdge==None:
                closestPt = currEdges[i].GetGeometry().ClosestPoint(streamline.endVertex.geometry)
                if closestPt.DistanceTo(streamline.endVertex.geometry) <=tol:
                    endEdge=currEdges[i]
                    endEdgeIndex = i
                    
            if endEdge:
                break


        # if endEdge instance has "between points", conduct second round 
        if len(endEdge.betweenPoints)!=0:
            all = endEdge.GetVPInstance()
            for i in range(len(all)-1):
                
                segment=rg.Line(all[i].geometry,all[i+1].geometry)
                if segment.DistanceTo(streamline.endVertex.geometry,True)<tol:
                    
                    endSplitPointPair=[i,i+1]
                        
       
        return endEdge,endEdgeIndex,endSplitPointPair
    
    @staticmethod
    def GetNewShare(PL,thisNode,sl,VP_Dict,E_Dict,startEdge,endEdge):
        # the new shared list order is same as the corrected streamline
        
        currVPIDs=[]
        for ID in VP_Dict.keys():
            currVPIDs.append(ID)
        currMaxVPID = max(currVPIDs)
       
        newShareList = []
        
        ### initialze streamline to parc vertex and point
        for i in range(len(sl.GetGeometry())):
            pts = sl.GetGeometry()
            if i == 0:
                newShareList.append(PL.ParcVertex(pts[0],currMaxVPID+i+1))
            elif i == len(sl.GetGeometry())-1:
                newShareList.append(PL.ParcVertex(pts[len(sl.GetGeometry())-1],currMaxVPID+i+1))
            else:
                newShareList.append(PL.ParcPoint(pts[i],currMaxVPID+i+1))
        
        ### initialze the twin parcEdge
        currEIDs=[]
        for ID in E_Dict.keys():
            currEIDs.append(ID)
            currMaxEID = max(currEIDs)
        
        newEdge = PL.ParcEdge(currMaxEID+1)
        newEdge.FillInfo(newShareList)
        newEdge_twin = newEdge.CreateTwin(newEdge.ID+1)
        
        ### store in current dict
        SPF.ExtendCurrVPDict(VP_Dict,newShareList)
        SPF.ExtendCurrEDict(E_Dict,newEdge)
        SPF.ExtendCurrEDict(E_Dict,newEdge_twin)
        
        ### For road
        newEdge.generation = thisNode.depth
        newEdge_twin.generation = thisNode.depth
        
        ### Check If vertex on the boundary, if so ,update "onBoundary"
        if startEdge.generation == "Naked":
            newEdge.startVertex.onBoundary = True
            
        if endEdge.generation == "Naked":
            newEdge.endVertex.onBoundary = True
        return newEdge,newEdge_twin

    @staticmethod
    def GetNewShare_Constrained(PL,thisNode,sl,VP_Dict,E_Dict):
        # the new shared list order is same as the corrected streamline
        
        currVPIDs=[]
        for ID in VP_Dict.keys():
            currVPIDs.append(ID)
        currMaxVPID = max(currVPIDs)
       
        newShareList = []
        
        ### initialze streamline to parc vertex and point
        for i in range(len(sl.GetGeometry())):
            pts = sl.GetGeometry()
            if i == 0:
                newShareList.append(thisNode.startPt)
            elif i == len(sl.GetGeometry())-1:
                newShareList.append(PL.ParcVertex(pts[len(sl.GetGeometry())-1],currMaxVPID+i))
            else:
                newShareList.append(PL.ParcPoint(pts[i],currMaxVPID+i))
        
        ### initialze the twin parcEdge
        currEIDs=[]
        for ID in E_Dict.keys():
            currEIDs.append(ID)
            currMaxEID = max(currEIDs)
        
        newEdge = PL.ParcEdge(currMaxEID+1)
        newEdge.FillInfo(newShareList)
        newEdge_twin = newEdge.CreateTwin(newEdge.ID+1)
        
        ### store in current dict
        #Before extention, remove the first exsiting one
        
        newShareList.remove(thisNode.startPt)
        SPF.ExtendCurrVPDict(VP_Dict,newShareList)
        SPF.ExtendCurrEDict(E_Dict,newEdge)
        SPF.ExtendCurrEDict(E_Dict,newEdge_twin)
        
        newEdge.generation = thisNode.depth
        newEdge_twin.generation = thisNode.depth
        
        ### Check If vertex on the boundary, if so ,update "onBoundary"  -> this add outside
        
        return newEdge,newEdge_twin
    
    @staticmethod
    def ConstructNewParcel_Normal(PL,parcFace,VP_Dict,E_Dict,shareEdge,shareEdge_twin,startEdge,endEdge,startEdgeIndex,endEdgeIndex,startSplitPointPair,endSplitPointPair):
        #print "in ConstructNewParcel_Normal", startEdge,endEdge
        p1,p2,splitEdges_Start, splitEdges_End= SPF.Construct_NormalCase(PL,parcFace,VP_Dict,E_Dict,shareEdge,shareEdge_twin,startEdge,endEdge,startEdgeIndex,endEdgeIndex,startSplitPointPair,endSplitPointPair)
        #fill the relationship here
        p1.identity = "A"
        p2.identity = "B"
        
        #fill neighbors relationship
        p1.neighbors.append(p2)
        p2.neighbors.append(p1)
        
        
        p1.mutualP_E[p2] = shareEdge
        p1.mutualE_P[shareEdge] = p2
        
        p2.mutualP_E[p1] = shareEdge_twin
        p2.mutualE_P[shareEdge_twin] = p1
  
        return p1,p2,splitEdges_Start, splitEdges_End

    @staticmethod
    def ConstructNewParcel_Special(PL,parcFace,VP_Dict,E_Dict,shareEdge,shareEdge_twin,startEdge,endEdge,startEdgeIndex,endEdgeIndex,startSplitPointPair,endSplitPointPair):

        p1,p2,splitEdges_Special= SPF.Construct_SpecialCase(PL,parcFace,VP_Dict,E_Dict,shareEdge,shareEdge_twin,startEdge,endEdge,startEdgeIndex,endEdgeIndex,startSplitPointPair,endSplitPointPair)
        #fill the relationship here
        p1.identity = "A"
        p2.identity = "B"
        
        #fill neighbors relationship
        p1.neighbors.append(p2)
        p2.neighbors.append(p1)
        
        
        p1.mutualP_E[p2] = shareEdge
        p1.mutualE_P[shareEdge] = p2
        
        p2.mutualP_E[p1] = shareEdge_twin
        p2.mutualE_P[shareEdge_twin] = p1
  
        return p1,p2,splitEdges_Special

            
    @staticmethod
    def Construct_Constrained(PL,thisNode,startIndexPair,endEdgeIndex,shareEdge,shareEdge_twin,newEdges):

        numEdge = len(thisNode.edges)
        edges = thisNode.edges
        
        ### collect edges in corret order
        slice1 = []
        slice2 = []

        if endEdgeIndex>max(startIndexPair) and endEdgeIndex == numEdge-1:
            slice1.append(shareEdge)
            slice1.append(newEdges[1])
            for i in range(0,startIndexPair[1],1):
                slice1.append(edges[i]) 
            
            for i in range(startIndexPair[1],endEdgeIndex,1):
                slice2.append(edges[i]) 
            slice2.append(newEdges[0])
            slice2.append(shareEdge_twin)
        
        elif endEdgeIndex>max(startIndexPair) and endEdgeIndex != numEdge-1:
            slice1.append(shareEdge)
            slice1.append(newEdges[1])
            for i in range(endEdgeIndex+1,numEdge,1):
                slice1.append(edges[i])
            
            for i in range(0,startIndexPair[1],1):
                slice1.append(edges[i]) 
            
            for i in range(startIndexPair[1],endEdgeIndex,1):
                slice2.append(edges[i]) 
            slice2.append(newEdges[0])
            slice2.append(shareEdge_twin)
            
        elif 0 not in startIndexPair and endEdgeIndex<max(startIndexPair):
            slice1.append(shareEdge)
            slice1.append(newEdges[1])
            for i in range(endEdgeIndex+1,startIndexPair[1],1):
                slice1.append(edges[i])
            
            for i in range(startIndexPair[1],numEdge,1):
                slice2.append(edges[i])
            
            for i in range(0,endEdgeIndex,1):
                slice2.append(edges[i])
                
            slice2.append(newEdges[0])
            slice2.append(shareEdge_twin)
        
        elif 0 in startIndexPair:
            slice1.append(shareEdge)
            slice1.append(newEdges[1])
            for i in range(endEdgeIndex+1,numEdge,1):
                slice1.append(edges[i])
                
            for i in range(0,endEdgeIndex,1):
                slice2.append(edges[i])
        
            slice2.append(newEdges[0])
            
        ### construct parcels
        parcel_1=PL.ParcFace()
        for edge in slice1:
            if edge!="invalid": #VV to close
                parcel_1.AddFaceV(edge.startVertex)
                parcel_1.edges.append(edge)
        
        parcel_2=PL.ParcFace()
        for edge in slice2:
            if edge!="invalid": #VV to close
                parcel_2.AddFaceV(edge.startVertex)
                parcel_2.edges.append(edge)
            
        
        #fill the relationship here
        parcel_1.identity = "A"
        parcel_2.identity = "B"
        
        #fill neighbors relationship
        parcel_1.neighbors.append(parcel_2)
        parcel_2.neighbors.append(parcel_1)
        
        
        parcel_1.mutualP_E[parcel_2] = shareEdge
        parcel_1.mutualE_P[shareEdge] = parcel_2
        
        parcel_2.mutualP_E[parcel_1] = shareEdge_twin
        parcel_2.mutualE_P[shareEdge_twin] = parcel_1
        

        return parcel_1,parcel_2
    
    
    
    
    @staticmethod
    def Construct_NormalCase(PL,parcFace,VP_Dict,E_Dict,shareEdge,shareEdge_twin,startEdge,endEdge,startEdgeIndex,endEdgeIndex,startSplitPointPair,endSplitPointPair):
        #print startEdge,endEdge,startEdgeIndex,endEdgeIndex,startSplitPointPair,endSplitPointPair
        currEdges =parcFace.edges
        #slice the vertices list into 3 segments
        slice_0=[]
        slice_1=[]
        slice_2=[]
        
        for edgeIndex in range(len(currEdges)):
            if edgeIndex < startEdgeIndex:
                slice_0.append(edgeIndex)
            
            elif edgeIndex > startEdgeIndex and edgeIndex < endEdgeIndex:
                slice_1.append(edgeIndex)
                
            elif edgeIndex > endEdgeIndex:
                slice_2.append(edgeIndex)
                
        
        
        
        slice_2.extend(slice_0)
        firstHalf = slice_2
        secondHalf = slice_1
        
        
        ############### prepare the splitEdge ###############
        splitEdges_Start = []
        splitEdges_End= []
        if startEdge.generation == "Naked":
            splitResult = startEdge.SplitEdge_Naked_Normal(shareEdge,shareEdge.startVertex,E_Dict,VP_Dict)
            subEdge_Start_0 = splitResult[0]
            subEdge_Start_1 = splitResult[1]
            splitEdges_Start = [subEdge_Start_0,subEdge_Start_1]
            
        elif startEdge.generation != "Naked":
            splitResult = startEdge.SplitEdge_Shared_Normal(shareEdge,shareEdge.startVertex,E_Dict,VP_Dict,startSplitPointPair)
            subEdge_Start_a = splitResult[0]
            subEdge_Start_a_twin = splitResult[1]
            subEdge_Start_b = splitResult[2]
            subEdge_Start_b_twin = splitResult[3]
            splitEdges_Start = [subEdge_Start_a,subEdge_Start_a_twin,subEdge_Start_b,subEdge_Start_b_twin]
            
        if endEdge.generation == "Naked":
            splitResult = endEdge.SplitEdge_Naked_Normal(shareEdge,shareEdge.endVertex,E_Dict,VP_Dict)
            subEdge_End_0 = splitResult[0]
            subEdge_End_1 = splitResult[1]
            splitEdges_End = [subEdge_End_0,subEdge_End_1]
            

        elif endEdge.generation != "Naked":
            splitResult = endEdge.SplitEdge_Shared_Normal(shareEdge,shareEdge.endVertex,E_Dict,VP_Dict,endSplitPointPair)
            subEdge_End_a = splitResult[0]
            subEdge_End_a_twin = splitResult[1]
            subEdge_End_b = splitResult[2]
            subEdge_End_b_twin = splitResult[3]
            splitEdges_End = [subEdge_End_a,subEdge_End_a_twin,subEdge_End_b,subEdge_End_b_twin]
            
            
        ############### construct new parcel ###############
        parcel_1=PL.ParcFace()
        
        ########################
        ###  from streamline 
        ########################
        ### add 2 verties
        
        #if abs(shareEdge.startVertex.geometry.X - -12.1437911977  ) <0.01:
            #print "bug 1"
            
        #if abs(shareEdge.endVertex.geometry.X - -12.1437911977  ) <0.01:
            #print "bug 2" , shareEdge.endVertex.ID
            #print "shareEdge.endVertex ID",shareEdge.endVertex.ID 
            #print "shareEdge address",id(shareEdge)
        #if shareEdge.startVertex not in parcel_1.vertices:  ### avoid VV to close
        parcel_1.AddFaceV(shareEdge.startVertex)
            
        #if shareEdge.endVertex not in parcel_1.vertices:  ### avoid VV to close
        parcel_1.AddFaceV(shareEdge.endVertex)
        
        

        ### add 1 edge
        parcel_1.edges.append(shareEdge)
        
        ########################
        ### when it hit endEdge 
        ########################
        ### add 1 vertex 
        #if endEdge.endVertex not in parcel_1.vertices:  ### avoid VV to close
        parcel_1.AddFaceV(VP_Dict[endEdge.endVertex.ID])


        ### add 1 edge 
        if endEdge.generation == "Naked" and subEdge_End_1!="invalid": # VV to close,edge invalid
            parcel_1.edges.append(subEdge_End_1)
            #print '!!!!!!!!!!!!!!!!',subEdge_End_1.ID
            
        elif endEdge.generation != "Naked" and subEdge_End_b!="invalid":
            parcel_1.edges.append(subEdge_End_b)
            #print '!!!!!!!!!!!!!!!!',subEdge_End_b.ID
            
        
        ########################
        ### from firstHalf
        ########################
        
        ### add vertices and edges
        for i in range(len(firstHalf)):
            thisEdge = currEdges[firstHalf[i]]
            #if VP_Dict[thisEdge.endVertex.ID] not in parcel_1.vertices:  ### avoid VV to close
            parcel_1.AddFaceV(VP_Dict[thisEdge.endVertex.ID])
            newEdge = E_Dict[thisEdge.ID]
            parcel_1.edges.append(newEdge)
        
        ############################
        ### when it hit startEdge
        ############################
        
        ### no need to add verteices

        if startEdge.generation == "Naked" and subEdge_Start_0!="invalid":
            parcel_1.edges.append(subEdge_Start_0)
            
        elif startEdge.generation != "Naked" and subEdge_Start_a!="invalid":
            parcel_1.edges.append(subEdge_Start_a)
        

        ###################
        ###form parcel_2###
        ###################
        parcel_2=PL.ParcFace()
        
        ########################
        ### when it hit startEdge
        ########################
        ### add 2 vertices 
        #if shareEdge.startVertex not in parcel_2.vertices:
        parcel_2.AddFaceV(shareEdge.startVertex)
        #if startEdge.endVertex not in parcel_2.vertices:
        parcel_2.AddFaceV(VP_Dict[startEdge.endVertex.ID])
        
        ### add 1 edge
        if startEdge.generation == "Naked" and subEdge_Start_1!="invalid":
            parcel_2.edges.append(subEdge_Start_1)
        elif startEdge.generation != "Naked" and subEdge_Start_b!="invalid":
            parcel_2.edges.append(subEdge_Start_b)
    
  
        ########################
        ### from secondHalf
        ########################
        ### add vertices and edges
        for i in range(len(secondHalf)):
            thisEdge = currEdges[secondHalf[i]]
            #if VP_Dict[thisEdge.endVertex.ID] not in parcel_2.vertices:  ### avoid VV to close
            parcel_2.AddFaceV(VP_Dict[thisEdge.endVertex.ID])
            newEdge=E_Dict[thisEdge.ID]
            parcel_2.edges.append(newEdge)

            
        ########################
        ### when it hit endEdge
        ########################
        
        ### add 1 vertex
        if shareEdge.endVertex not in parcel_2.vertices:
            parcel_2.AddFaceV(shareEdge.endVertex)
    
        ### add 1 edge
        if endEdge.generation == "Naked" and subEdge_End_0!="invalid":
            parcel_2.edges.append(subEdge_End_0)
    
        elif endEdge.generation != "Naked" and subEdge_End_a!="invalid":
            parcel_2.edges.append(subEdge_End_a)
        
        ########################
        ###  from streamline
        ########################

        ### no need to add vertex
        ### add 1 edge
        
        parcel_2.edges.append(shareEdge_twin)
        

        p1=parcel_1
        p2=parcel_2
        
        

        return p1,p2,splitEdges_Start,splitEdges_End
    
    @staticmethod
    def Construct_SpecialCase(PL,parcFace,VP_Dict,E_Dict,shareEdge,shareEdge_twin,startEdge,endEdge,startEdgeIndex,endEdgeIndex,startSplitPointPair,endSplitPointPair):
        print ("warning: a special split case")
        currEdges =parcFace.edges
        #slice the vertices list into 2 segments
        slice_0=[]
        slice_1=[]
        
        for edgeIndex in range(len(currEdges)):
            if edgeIndex < startEdgeIndex:
                slice_0.append(edgeIndex)
            
            elif edgeIndex > startEdgeIndex:
                slice_1.append(edgeIndex)
                
        slice_1.extend(slice_0)
        restIndices = slice_1
        
        
        newV_Start=shareEdge.startVertex
        ########## prepar the splitEdge ##########
        if startEdge.generation == "Naked" and endEdge.generation == "Naked":
            splitEdges_Special = []
            splitResult = startEdge.SplitEdge_Naked_Special(shareEdge.startVertex,shareEdge.endVertex,E_Dict,VP_Dict)
            subEdge_0 = splitResult[0]
            subEdge_1 = splitResult[1]
            subEdge_2 = splitResult[2]
            splitEdges_Special = [subEdge_0,subEdge_1,subEdge_2]
        
        else:
            splitResult = startEdge.SplitEdge_Shared_Special(shareEdge.startVertex,shareEdge.endVertex,E_Dict,VP_Dict,startSplitPointPair,endSplitPointPair)
            subEdge_a = splitResult[0]
            subEdge_a_twin = splitResult[1]
            subEdge_b = splitResult[2]
            subEdge_b_twin = splitResult[3]
            subEdge_c = splitResult[4]
            subEdge_c_twin = splitResult[5]
            splitEdges_Special = [subEdge_a,subEdge_a_twin,subEdge_b,subEdge_b_twin,subEdge_c,subEdge_c_twin]

        ###################
        ###form parcel_1###
        ###################
        parcel_1=PL.ParcFace()
        
        ##########################
        ###  from streamline
        ##########################
        ### add 2 verties
        parcel_1.AddFaceV(shareEdge.startVertex)
        parcel_1.AddFaceV(shareEdge.endVertex)

        ### add 1 edge
        parcel_1.edges.append(shareEdge)
        
        ##########################
        ### when it hit startEdge/endEdge
        ##########################
        if startEdge.generation == "Naked" and endEdge.generation == "Naked" and subEdge_1!="invalid":
            parcel_1.edges.append(subEdge_1)
            #print ("subEdge_1"),subEdge_1.startVertex.ID
            #print ("subEdge_1"),subEdge_1.endVertex.ID
        elif startEdge.generation != "Naked" and endEdge.generation != "Naked" and subEdge_b!="invalid":
            
            parcel_1.edges.append(subEdge_b)

        print ("finish one")
        ###################
        ###form parcel_2###
        ###################
        
        parcel_2=PL.ParcFace()
        ######################################
        ### when it hit startEdge/endEdge
        ######################################
        parcel_2.AddFaceV(shareEdge.startVertex)
        parcel_2.AddFaceV(startEdge.endVertex)
        
        if startEdge.generation == "Naked" and endEdge.generation == "Naked" and subEdge_2!="invalid":
            parcel_2.edges.append(subEdge_2)
        
        elif startEdge.generation != "Naked" and endEdge.generation != "Naked" and subEdge_c!="invalid":
            parcel_2.edges.append(subEdge_c)
            
        ######################################
        ### from the restIndices
        ######################################
        for i in range(len(restIndices)):
            thisEdge = currEdges[restIndices[i]]
            parcel_2.AddFaceV(VP_Dict[thisEdge.endVertex.ID])
            newEdge = E_Dict[thisEdge.ID]
            parcel_2.edges.append(newEdge)

        ######################################
        ### when it hit startEdge/endEdge
        ######################################

        
        if startEdge.generation == "Naked" and endEdge.generation == "Naked" and subEdge_0!="invalid":
            parcel_2.edges.append(subEdge_0)
        
        elif startEdge.generation != "Naked" and endEdge.generation != "Naked" and subEdge_a!="invalid":
            parcel_2.edges.append(subEdge_a)
        
        ######################################
        ###  from streamline
        ######################################
        ### no need to add vertex
        ### add 1 edge
        
        parcel_2.edges.append(shareEdge_twin)

        parcel_1.identity = "A"
        parcel_2.identity = "B"
        
        p1=parcel_1
        p2=parcel_2
        
        return p1,p2,splitEdges_Special
    
    @staticmethod
    def ExtendCurrVPDict(currDict,newSharedList):
        for i in range(len(newSharedList)):
            currDict[newSharedList[i].ID] = newSharedList[i]
        
    @staticmethod
    def ExtendCurrEDict(currDict,newEdge):
        currDict[newEdge.ID] = newEdge
       
       
       
       
    ######################################
    ####     Streamline Selection     ####
    ######################################    
    @staticmethod   
    def GetCurrentWeight(weight,coefficient,currDepth):

        currentWeight=[]

        for i in range(len(weight)):
            currentWeight.append( round(weight[i] * math.pow(coefficient[i],currDepth),3))

        return currentWeight
    
    @staticmethod
    def StoreStreamlines(PC,DM,SLG,EV,thisNode,weight,pt,idealOrientation,resolution):
        
        ### create processMesh
        
        crv = thisNode.GetGeometry()
        processMesh = PC.ProcessMesh()
        
        ### Get the resoluion processMesh
        if thisNode.parent == None:
            useTriangleSize = resolution
            thisNode.triangleSize = resolution
            
        else:
            useTriangleSize = thisNode.triangleSize
        
        #print " in StoreStreamlines "
        #print "processMesh.InitializeInput: ",useTriangleSize
        #print "StoreStreamlines"
        #print "thisNode Vertices"
#        for v in thisNode.vertices:
#            if abs(v.geometry.X - -12.1437911977  ) <0.01:
#                for v in thisNode.vertices:
#                    print v.ID, v.geometry.X,v.geometry.Y,0
#        
#                print "thisNode id" , id(thisNode)
#                for i in range(len(thisNode.edges)):
#                    print "edge:",i
#                    for v in thisNode.edges[i].betweenPoints:
#                        print v.geometry.X,v.geometry.Y,0
        #print "this node edge length",len(thisNode.edges)
        processMesh.InitializeInput(crv,useTriangleSize)   #length 
        
        
        ### create dataMapping
        mappingGrid = DM.MappingGrid()
        mappingGrid.CreateMappingGrid(crv,20,5)    #rows,columns 
        mappingGrid.GetOverlappedTriangleIndex(processMesh,2)  #detectRadius 
        ### create seedPoint
        
        seedpointList = SLG.SeedpointList()
        seedpointList.CreateSeedpointList(processMesh,1,1)  #reduce points onEdge, on MA
    
        ### creat streamline network instance with score
        
        newTriangleSize = processMesh.length
        
        dL = newTriangleSize
        disableDistance=newTriangleSize* 0.7
        
        streamlineNetwork=SLG.StreamlineNetwork()
    
        if weight!=None and pt == None:
            #print ("【Free】using TOP N Streamlines")
            streamlineNetwork=SLG.StreamlineNetwork()
            streamlines = streamlineNetwork.GetStreamlineNetwork(mappingGrid,processMesh,seedpointList,disableDistance,dL)  #disable distance, dL
            EV().GetAllScoreToInstance(SLG,mappingGrid,processMesh,streamlineNetwork,streamlines,dL,weight,idealOrientation)
            
            if rg.AreaMassProperties.Compute(crv.ToPolylineCurve()).Area >300:  
                sortStreamlines = EV.SortStreamlines_Overall(streamlineNetwork)
                #print "len of streamlines", len(sortStreamlines)
                #print ("area:"), rg.AreaMassProperties.Compute(crv.ToPolylineCurve()).Area, "sorted by Overall Score "
            else:
                sortStreamlines = EV.SortStreamlines_Parcel(streamlineNetwork)
                #print ("area:"), rg.AreaMassProperties.Compute(crv.ToPolylineCurve()).Area, "sorted by Parcel Score "
            thisNode.sortedSL = sortStreamlines
            
        elif weight == None and pt != None:
            #print ("【Constrained】using Streamline On Specific Point ")
            streamline=streamlineNetwork.GetStreamlineOnSpecificPoint(pt,mappingGrid,processMesh,dL)
            
            if streamline!=None:
                sl = SLG.Streamline()
                sl.CreateStreamlineInstance(streamline)
                thisNode.specificStreamline = sl
            else:
                thisNode.specificStreamline = None
        
        else:
            print ("input error")
        
        ### Optional, for debug
        thisNode.processMesh = processMesh
        
        #document the triangle size
        return newTriangleSize
    
    @staticmethod
    def TryStreamlineOptions(thisNode,minArea,minElongation,minConvexity,minCompactness,tolerance):
        if minElongation == None:
            for i in range(len(thisNode.sortedSL)):
                elongation_a = thisNode.sortedSL[i].elongationPair[0]
                elongation_b = thisNode.sortedSL[i].elongationPair[1]
                area_a = thisNode.sortedSL[i].areaPair[0]
                area_b = thisNode.sortedSL[i].areaPair[1]
                convexity_a = thisNode.sortedSL[i].convexityPair[0]
                convexity_b = thisNode.sortedSL[i].convexityPair[1]
                compactness_a = thisNode.sortedSL[i].compactnessPair[0]
                compactness_b = thisNode.sortedSL[i].compactnessPair[1]
                orientation_a = thisNode.sortedSL[i].orientationPair[0]  # not used currently
                orientation_b = thisNode.sortedSL[i].orientationPair[1]  # not used currently
                
                if area_a >= minArea and area_b >= minArea :
                    streamline = thisNode.sortedSL[i]
                    #print ("Get a streamline!"), i, "elongation: ",elongation_a, elongation_b,"area: ",area_a,area_b,"orientation: ",orientation_a,orientation_b
                    
                elif  area_a < minArea or  area_b < minArea :
                    if i!=len(thisNode.sortedSL)-1:
                        #print ("track back!"), "elongation: ",elongation_a, elongation_b,"area: ",area_a,area_b,"orientation: ",orientation_a,orientation_b
                        streamline = None
                    elif i ==len(thisNode.sortedSL)-1:
                        #print ("【stop here!】"),"elongation: ",elongation_a, elongation_b,"area: ",area_a,area_b,"orientation: ",orientation_a,orientation_b
                        streamline = None

            ### if it fails to use the strict condition,try another round
            if streamline == None:
                for i in range(len(thisNode.sortedSL)):
                    elongation_a = thisNode.sortedSL[i].elongationPair[0]
                    elongation_b = thisNode.sortedSL[i].elongationPair[1]
                    area_a = thisNode.sortedSL[i].areaPair[0]
                    area_b = thisNode.sortedSL[i].areaPair[1]
                    convexity_a = thisNode.sortedSL[i].convexityPair[0]
                    convexity_b = thisNode.sortedSL[i].convexityPair[1]
                    compactness_a = thisNode.sortedSL[i].compactnessPair[0]
                    compactness_b = thisNode.sortedSL[i].compactnessPair[1]
                    orientation_a = thisNode.sortedSL[i].orientationPair[0]  
                    orientation_b = thisNode.sortedSL[i].orientationPair[1]  
                    if area_a >= minArea and area_b < minArea and area_b>=tolerance*minArea:
                        streamline = thisNode.sortedSL[i]
                        #print ("Get a streamline with tolerance!"), "elongation: ",elongation_a, elongation_b,"area: ",area_a,area_b,"orientation: ",orientation_a,orientation_b
                    elif area_a < minArea and area_b >=  minArea and area_a>=tolerance*minArea:
                        streamline = thisNode.sortedSL[i]
                        #print ("Get a streamline with tolerance!"), "elongation: ",elongation_a, elongation_b,"area: ",area_a,area_b,"orientation: ",orientation_a,orientation_b   
                
                
                
        elif minElongation != None:
            for i in range(len(thisNode.sortedSL)):
                elongation_a = thisNode.sortedSL[i].elongationPair[0]
                elongation_b = thisNode.sortedSL[i].elongationPair[1]
                area_a = thisNode.sortedSL[i].areaPair[0]
                area_b = thisNode.sortedSL[i].areaPair[1]

                convexity_a = thisNode.sortedSL[i].convexityPair[0]
                convexity_b = thisNode.sortedSL[i].convexityPair[1]
                compactness_a = thisNode.sortedSL[i].compactnessPair[0]
                compactness_b = thisNode.sortedSL[i].compactnessPair[1]

                orientation_a = thisNode.sortedSL[i].orientationPair[0]
                orientation_b = thisNode.sortedSL[i].orientationPair[1]
                
                if (area_a >= minArea and  area_b >= minArea 
                    and elongation_a <= minElongation and elongation_b <= minElongation
                    and convexity_a >= minConvexity and convexity_b >= minConvexity
                    and compactness_a >= minCompactness and compactness_b >= minCompactness):
                    
                    streamline = thisNode.sortedSL[i]
                    #print ("Get a streamline! Its index is %d,Elongation: %f,%f,Area: %f,%f, Convexity: %f,%f, Compactness: %f,%f,"%(i, elongation_a,elongation_b,area_a,area_b,convexity_a,convexity_b,compactness_a,compactness_b))
                    #ra.WriteLine("Get a streamline! Its index is %d,Elongation: %f,%f,Area: %f,%f, Convexity: %f,%f, Compactness: %f,%f,orientation: %f,%f,"%(i, elongation_a,elongation_b,area_a,area_b,convexity_a,convexity_b,compactness_a,compactness_b,orientation_a,orientation_b))                        
                    break

                elif(area_a < minArea or  area_b < minArea 
                    or elongation_a > minElongation or elongation_b > minElongation
                    or convexity_a< minConvexity or convexity_b< minConvexity
                    or compactness_a < minCompactness or compactness_b < minCompactness):
                    if i!=len(thisNode.sortedSL)-1:
                        #print ("track back!"), i, "elongation: ",elongation_a, elongation_b,"area: ",area_a,area_b,"convexity:",convexity_a,convexity_b,"compactness",compactness_a,compactness_b            
                        #ra.WriteLine("track back! Tried No.%d streamline, Elongation: %f,%f,Area: %f,%f, Convexity: %f,%f, Compactness: %f,%f,orientation: %f,%f,"%(i, elongation_a,elongation_b,area_a,area_b,convexity_a,convexity_b,compactness_a,compactness_b,orientation_a,orientation_b))       
                        pass
                    elif i ==len(thisNode.sortedSL)-1:
                        streamline = None
                        #print ("【stop here!】"), i, "elongation: ",elongation_a, elongation_b,"area: ",area_a,area_b,"convexity:",convexity_a,convexity_b,"compactness",compactness_a,compactness_b   
                        #ra.WriteLine("stop here! Tried No.%d streamline, Elongation: %f,%f,Area: %f,%f, Convexity: %f,%f, Compactness: %f,%f,orientation: %f,%f,"%(i, elongation_a,elongation_b,area_a,area_b,convexity_a,convexity_b,compactness_a,compactness_b,orientation_a,orientation_b))   
                        
            ### if it fails to use the strict condition,try another round            
            if streamline == None:
                for i in range(len(thisNode.sortedSL)):
                    elongation_a = thisNode.sortedSL[i].elongationPair[0]
                    elongation_b = thisNode.sortedSL[i].elongationPair[1]
                    area_a = thisNode.sortedSL[i].areaPair[0]
                    area_b = thisNode.sortedSL[i].areaPair[1]
                    convexity_a = thisNode.sortedSL[i].convexityPair[0]
                    convexity_b = thisNode.sortedSL[i].convexityPair[1]
                    compactness_a = thisNode.sortedSL[i].compactnessPair[0]
                    compactness_b = thisNode.sortedSL[i].compactnessPair[1]
                    orientation_a = thisNode.sortedSL[i].orientationPair[0]  
                    orientation_b = thisNode.sortedSL[i].orientationPair[1]  
                    
                    if (convexity_a >= minConvexity and convexity_b >= minConvexity
                    and compactness_a >= minCompactness and compactness_b >= minCompactness
                    and elongation_a<=minElongation and elongation_b<=minElongation):
                    
                        if (area_a >= minArea and area_b < minArea and area_b>=tolerance*minArea) or (area_a < minArea and area_b >=  minArea and area_a>=tolerance*minArea):
                            streamline = thisNode.sortedSL[i]
                            #ra.WriteLine("Get No.%d streamline with tolerance!Elongation: %f,%f,Area: %f,%f, Convexity: %f,%f, Compactness: %f,%f,orientation: %f,%f,"%(i, elongation_a,elongation_b,area_a,area_b,convexity_a,convexity_b,compactness_a,compactness_b,orientation_a,orientation_b))               
                            #print ("Get a streamline with tolerance!"), "elongation: ",elongation_a, elongation_b,"area: ",area_a,area_b,"orientation: ",orientation_a,orientation_b
                            break

        
        return streamline
    
    @staticmethod
    def TrySpecificStreamline(EV,thisNode,minArea,minElongation,minConvexity,minCompactness,tolerance):
        if thisNode.specificStreamline == None:
            return None
        streamline = thisNode.specificStreamline.GetGeometry()
        boundary = thisNode.GetGeometry()
        
        splitResult = EV.SplitPolygon(streamline,boundary)
        
        if splitResult == None:
            return None
        
        parc_a = splitResult[0]
        parc_b = splitResult[1]
        try:
            area_a =rg.AreaMassProperties.Compute(parc_a).Area
            area_b =rg.AreaMassProperties.Compute(parc_b).Area
            ### record score
            if area_a>= area_b:
                evenAreaValue = area_b/area_a
            else:
                evenAreaValue = area_a/area_b
        except:
            print ("SplitPolygon fails")
            print ("FAIL boundary:")
            for pt in boundary:
                print (pt.X), "," , pt.Y, "," , pt.Z
                
            print ("FAIL streamline:")
            for pt in streamline:
                print (pt.X), "," , pt.Y, "," , pt.Z
        
        elongation_a = EV.EvaluateElongation(parc_a) 
        elongation_b = EV.EvaluateElongation(parc_b)
        convexity_a = EV.EvaluateConvexity(parc_a)
        convexity_b = EV.EvaluateConvexity(parc_b)
        compactness_a = EV.EvaluateCompactness(parc_a)
        compactness_b = EV.EvaluateCompactness(parc_b)
    
        orientation_a = EV.EvaluateOrientation(parc_a,0)
        orientation_b = EV.EvaluateOrientation(parc_b,0)

        if minElongation == None:
            if area_a >= minArea and area_b >= minArea :
                #print ("Get a streamline!"), "elongation: ",elongation_a, elongation_b,"area: ",area_a,area_b
                streamline = thisNode.specificStreamline

            
            elif   area_a < minArea or area_b < minArea :
                #print ("should stop here, but its converted to FREE"), "elongation: ",elongation_a, elongation_b,"area: ",area_a,area_b
                streamline = None

            ### if it fails to use the strict condition,try another round
            if streamline == None:
                
                if (area_a >= minArea and area_b < minArea and area_b>=tolerance*minArea) or (area_a < minArea and area_b >=  minArea and area_a>=tolerance*minArea):
                    streamline = thisNode.specificStreamline
                    #print ("Get a streamline with tolerance!"), "elongation: ",elongation_a, elongation_b,"area: ",area_a,area_b


            
        elif minElongation != None:
            if (area_a >= minArea and area_b >= minArea and elongation_a<=minElongation and elongation_b<=minElongation
                and convexity_a >= minConvexity and convexity_b >= minConvexity
                and compactness_a >= minCompactness and compactness_b >= minCompactness):
                
                streamline = thisNode.specificStreamline    
                #print ("Get a streamline! Elongation: %f,%f,Area: %f,%f, Convexity: %f,%f, Compactness: %f,%f,"%(elongation_a,elongation_b,area_a,area_b,convexity_a,convexity_b,compactness_a,compactness_b))
                #ra.WriteLine("Get a streamline! Elongation: %f,%f,Area: %f,%f, Convexity: %f,%f, Compactness: %f,%f,"%( elongation_a,elongation_b,area_a,area_b,convexity_a,convexity_b,compactness_a,compactness_b))
                

            elif(area_a < minArea or  area_b < minArea 
                or elongation_a > minElongation or elongation_b > minElongation
                or convexity_a< minConvexity or convexity_b< minConvexity
                or compactness_a < minCompactness or compactness_b < minCompactness):
                    
                streamline = None

            ### if it fails to use the strict condition,try another round
            if streamline == None:
                if (convexity_a >= minConvexity and convexity_b >= minConvexity
                and compactness_a >= minCompactness and compactness_b >= minCompactness
                and elongation_a<=minElongation and elongation_b<=minElongation):
                    
                    if (area_a >= minArea and area_b < minArea and area_b>=tolerance*minArea) or (area_a < minArea and area_b >=  minArea and area_a>=tolerance*minArea):
                        streamline = thisNode.specificStreamline
                        #print ("Get a streamline with tolerance! Elongation: %f,%f,Area: %f,%f, Convexity: %f,%f, Compactness: %f,%f,"%(elongation_a,elongation_b,area_a,area_b,convexity_a,convexity_b,compactness_a,compactness_b))
                        #ra.WriteLine("Get a streamline with tolerance! Elongation: %f,%f,Area: %f,%f, Convexity: %f,%f, Compactness: %f,%f,"%( elongation_a,elongation_b,area_a,area_b,convexity_a,convexity_b,compactness_a,compactness_b))


        
        if streamline == None:
            #print ("should stop here, but its converted to 【 FREE 】"), "elongation: ",elongation_a, elongation_b,"area: ",area_a,area_b
            #ra.WriteLine("should stop here, but its converted to 【 FREE 】 ! Elongation: %f,%f,Area: %f,%f, Convexity: %f,%f, Compactness: %f,%f,"%( elongation_a,elongation_b,area_a,area_b,convexity_a,convexity_b,compactness_a,compactness_b))
            pass
        thisNode.specificStreamline.evenAreaValue = evenAreaValue
        thisNode.specificStreamline.elongationPair = [elongation_a,elongation_b]
        thisNode.specificStreamline.compactnessPair=[compactness_a,compactness_b]
        thisNode.specificStreamline.convexityPair=[convexity_a,convexity_b]
        thisNode.specificStreamline.orientationPair=[orientation_a,orientation_b]
        return streamline
# ---------- end ghpython_script_7 ----------
ghpython_script_8 = GhPythonScript()  # -> out, PP
# ---------- ghpython_script_8: Python ----------
###########################
####    Import Libs    ####
###########################
import Rhino.Geometry as rg
#import Rhino.RhinoDoc as rd
import Rhino.RhinoMath as rm

# import clr
# clr.AddReference("CGAL.Wrapper.dll")
# import CGAL.Wrapper
# from System.Collections.Generic import List

# import clr
# clr.AddReferenceToFile("KangarooSolver.dll")
# import KangarooSolver as ks


######################################
####       Post Processing        ####
######################################
class PP:
    
    
    ####################################
    ########Assign road hierarchy#######
    ####################################
    #region
    @staticmethod
    def GetDepthList(currDepth):
        depths = []
        for i in range(currDepth):
            depths.append(i)
        depthCount = len(depths)
        return depths,depthCount
    
    
    @staticmethod
    def GetInteger(value):
        ### make sure it is 1 at least
        if value<1:
            value = 1
        else:
            value = int(value)
        
        return value
    
     
    @staticmethod
    def CheckSum_Validity(countList,depthCount):
        sum = 0
        for count in countList:
            sum+=count
        
        if sum < depthCount:
            pass
        elif sum == depthCount:
            pass
        elif sum > depthCount:
            theRest = depthCount
            for i in range(len(countList)-1):
                theRest = theRest - countList[i]
            countList[-1] = theRest
        
        return countList

    @staticmethod
    def GetListSlices(depths,countList_Final):
        collection = []
        for i in range(len(countList_Final)):
            collection.append([])
        
        currIndex = 0
        for i in range(len(collection)):
            if i == 0 :
                collection[i] = depths[0:countList_Final[i]]
                
            elif i!= 0 and i != len(collection)-1 :
                sum = 0
                for index in range(i):
                    sum+=countList_Final[index]
                collection[i] = depths[sum:sum+countList_Final[i]]
                
            elif i == len(collection)-1:
                sum = 0
                for index in range(i):
                    sum+=countList_Final[index]
                collection[i] = depths[sum:sum+countList_Final[i]]
        
        return collection

    @staticmethod
    def CheckSum_Rest(depths,countList,slices,roadPercentage):
        sum = 0
        for count in countList:
            sum+=count
        
        
        depthCount = len(depths)
        if sum < depthCount:
            percentageSum = 0
            for percentage in roadPercentage:
                percentageSum += percentage
            if percentageSum ==1: ### if user wants to include all
                slices[-1].extend(depths[sum:])
            else:
                slices.append([])
                slices[-1] = depths[sum:]
        elif sum == depthCount:
            pass
        
        return slices
    
    @staticmethod
    def AssignRoadHierarchyAndOffsetDist(roadPercentage,roadWidth,currQ,currEDict,scale):
        
        depths,depthCount = PP.GetDepthList(currQ[0].depth)

        ### User Desicion (sum should be <= 1, e.g. 0.1+0.2+0.7 = 1)
        firstPercentage = roadPercentage[0]
        secondPercentage = roadPercentage[1]
        thirdPercentage = roadPercentage[2]

        ### In Reality values
        firstOffset = roadWidth[0]/2/scale
        secondOffset = roadWidth[1]/2/scale
        thirdOffset = roadWidth[2]/2/scale
        offsetDistanceList = [firstOffset,secondOffset,thirdOffset]
       
        ### Compute the road assignment
        firstCount = depthCount*firstPercentage
        secondCount = depthCount*secondPercentage
        thirdCount = depthCount*thirdPercentage
        firstCount = PP.GetInteger(firstCount)
        secondCount = PP.GetInteger(secondCount)
        thirdCount = PP.GetInteger(thirdCount)

        countList = [firstCount,secondCount,thirdCount]
        print "countList:",countList
        countList_Final = PP.CheckSum_Validity(countList,depthCount)

        slices = PP.GetListSlices(depths,countList_Final)
        print slices
        slices = PP.CheckSum_Rest(depths,countList,slices,roadPercentage)
        print slices
        # validSlicesCount = 0
        # for slice in slices:
        #     if slice != []:
        #         validSlicesCount+=1
        
  
        
        ### Treat the edges
        allEdges = currEDict.values()
        ### reset offsetDist to 0
        for edge in allEdges:
            edge.offsetDistance = 0

        for edge in allEdges:
            for sliceIndex in range(len(roadPercentage)):
                if roadPercentage[sliceIndex]!=0:
                    if edge.generation in slices[sliceIndex]:
                        edge.hierarchy = sliceIndex
                        edge.offsetDistance = offsetDistanceList[sliceIndex]
                        break
                else:
                    pass 

    
    
    #endregion
    
    
    ###########################################
    ########  Offset and get parcel     #######
    ###########################################
    #region
    @staticmethod
    def InnerOffsetLine(line,center,offsetDistance):
        lineCrv = line.ToNurbsCurve()
        
        wxy_Plane=rg.Plane.WorldXY
        
        offset1 = lineCrv.Offset(wxy_Plane,offsetDistance,0.001,rg.CurveOffsetCornerStyle.Sharp)[0]
        offset2 = lineCrv.Offset(wxy_Plane,offsetDistance * -1,0.001,rg.CurveOffsetCornerStyle.Sharp)[0]
        
        newLine1 = rg.Line(offset1.PointAtStart,offset1.PointAtEnd)
        newLine2 = rg.Line(offset2.PointAtStart,offset2.PointAtEnd)
        
        distance1  = newLine1.DistanceTo(center,True)
        distance2  = newLine2.DistanceTo(center,True)
        
        if distance1<distance2:
            chosenLine = newLine1
        else:
            chosenLine = newLine2
        
        return chosenLine
    
    @staticmethod
    def GetOffsetEdges_Old_Old_Old(parcel):
        ### Global
        parcel_Geo = parcel.GetGeometry()
        
        ### Final result collection
        offsetEdges = []
        
        ### Collect Offset distances
        offsetDistances = []
        for i in range(len(parcel.edges)):
            offsetDistances.append(parcel.edges[i].offsetDistance)
          
        for i in range(len(parcel.edges)):
            currEdge = parcel.edges[i]
            currEdgeGeo = currEdge.GetGeometry()
            currOffsetDist = offsetDistances[i]


            if currOffsetDist != 0:
                #regions = currEdge.straightSkeletonEach
                currRegion = currEdge.straightSkeletonUnion
                wxy_Plane=rg.Plane.WorldXY
                offset1= parcel_Geo.ToPolylineCurve().Offset(wxy_Plane,currOffsetDist,0.001,rg.CurveOffsetCornerStyle.Sharp)[0]
                offset2= parcel_Geo.ToPolylineCurve().Offset(wxy_Plane,-currOffsetDist,0.001,rg.CurveOffsetCornerStyle.Sharp)[0]
                
                
                if offset1.GetLength() < offset2.GetLength() :
                    currOffset = offset1
                else:
                    currOffset = offset2
                    
                
                t1 =  rg.Intersect.Intersection.CurveCurve(currOffset, currRegion,0.001,0.001)[0].ParameterA
                t2 =  rg.Intersect.Intersection.CurveCurve(currOffset, currRegion,0.001,0.001)[1].ParameterA
                
                
                splitCrvs = currOffset.Split ([t1,t2])
                for splitCrv in splitCrvs:
                    midT = splitCrv.Domain.Mid
                    midPt = splitCrv.PointAt(midT)
                    if int(currRegion.Contains(midPt))==1:
                        chosenSplit = splitCrv
                offsetEdges.append(chosenSplit)

            else:
                currEdgeGeo = currEdgeGeo.ToPolylineCurve()
                offsetEdges.append(currEdgeGeo)            

        return offsetEdges
    
    @staticmethod
    def GetOffsetEdges_Old_Old(parcel):
        offsetEdgeCollection = []
        polyL = parcel.GetGeometry()
        center = rg.AreaMassProperties.Compute(polyL.ToPolylineCurve()).Centroid
        for index in range(len(parcel.edges)):
            
            currEdge=parcel.edges[index]
            
            if currEdge.offsetDistance == 0:
                finalEdge = currEdge.GetGeometry()
                
            else: 
                if currEdge.betweenPoints != []:
                    allPts = currEdge.GetGeometry()
                    
                    movingVecs = currEdge.movingVecs
                    
                    newPoints = [] 
                    
                    for i in range(len(allPts)):
                        newPoints.append(rg.Point3d.Add(allPts[i],movingVecs[i]*currEdge.offsetDistance))
                        
                    #newPolyline = rg.Polyline(newPoints)
                    
                    
                    ### check if the newPts out of region
                    
                    finalNewPoints = []
                    
                    validPtCount = 0
                    for point in newPoints:
                        if int(currEdge.straightSkeletonUnion.Contains(point))==1 or int(currEdge.straightSkeletonUnion.Contains(point))==3: #1:Inside , 3:Coincident
                            validPtCount+=1
                            finalNewPoints.append(point)
                        
                    #finalNewPoints.insert(0,newStart)
                    #finalNewPoints.append(newEnd)
                    
                    #for i in range(len(allPts)):
                        #print movingVecs[i].X,movingVecs[i].Y,0
                    
                    if validPtCount!=1:
                        finalEdge = rg.Polyline(finalNewPoints)
                    else:
                        thisPolyline = rg.Polyline(newPoints)
            
                        
                        intersection_Start =  rg.Intersect.Intersection.CurveCurve(thisPolyline.ToPolylineCurve(), currEdge.straightSkeletonUnion,0.001,0.001)[0].PointA
                        intersection_End =  rg.Intersect.Intersection.CurveCurve(thisPolyline.ToPolylineCurve(), currEdge.straightSkeletonUnion,0.001,0.001)[1].PointA
                        
                        
                        finalNewPoints = [intersection_Start, finalNewPoints[0],intersection_End]
                        finalEdge = rg.Polyline(finalNewPoints)

                        
                        ###### 

                else:
                    if currEdge.offsetDistance == 0:
                            finalEdge = currEdge.GetGeometry()
                            
                    else:
                        finalEdge = PP.InnerOffsetLine(currEdge.GetGeometry(),center,currEdge.offsetDistance)

            if isinstance(finalEdge,rg.Polyline):
                #print "before",finalEdge,len(currEdge.GetGeometry()),currEdge.offsetDistance
                finalEdge = finalEdge.ToPolylineCurve()
                #print "after",finalEdge
                #if finalEdge==None:
                    #for point in currEdge.GetGeometry():
                        #print point.X,point.Y,point.Z
                
            #print finalEdge
                
            offsetEdgeCollection.append(finalEdge)
        
        return  offsetEdgeCollection
    
    @staticmethod
    def GetOffsetEdges(parcel):
        parcel_Geo = parcel.GetGeometry()
        edges = parcel.edges
        edges_geo = []
        # vecs = []
        for edge in edges:
            edges_geo.append(edge.GetGeometry())
        offsetEdges = []
        for i in range(len(edges_geo)):
            wxy_Plane=rg.Plane.WorldXY
            if edges[i].offsetDistance !=0:
                offset1= edges_geo[i].ToPolylineCurve().Offset(wxy_Plane,edges[i].offsetDistance,0.001,rg.CurveOffsetCornerStyle.Sharp)[0]
                offset2= edges_geo[i].ToPolylineCurve().Offset(wxy_Plane,-edges[i].offsetDistance,0.001,rg.CurveOffsetCornerStyle.Sharp)[0]
                midT1 = offset1.Domain.Mid
                #midT2 = offset2.Domain.Mid
                midPt1 = offset1.PointAt(midT1)
                #midPt2 = offset1.PointAt(midT2)
                                    
                if int(parcel_Geo.Contains(midPt1))==1:
                    choice = offset1
                else :
                    choice = offset2
                offsetEdges.append(choice)
            else:
                offsetEdges.append(edges_geo[i].ToPolylineCurve())
        
        return offsetEdges
    
    @staticmethod
    def GetOffsetEdges_SimplifiedWithTurningPoints(parcel):
        parcel_Geo = parcel.GetGeometry_SimplifiedWithTurningPoints()
      
        edges = parcel.edges
        edges_geo = []
        # vecs = []
        for edge in edges:
            edges_geo.append(edge.GetGeometry_SimplifiedWithTurningPoints())
        
     
        offsetEdges = []
        for i in range(len(edges_geo)):
            
            wxy_Plane=rg.Plane.WorldXY
            if edges[i].offsetDistance !=0:
                offset1= edges_geo[i].ToPolylineCurve().Offset(wxy_Plane,edges[i].offsetDistance,0.001,rg.CurveOffsetCornerStyle.Sharp)[0]
                offset2= edges_geo[i].ToPolylineCurve().Offset(wxy_Plane,-edges[i].offsetDistance,0.001,rg.CurveOffsetCornerStyle.Sharp)[0]
                midT1 = offset1.Domain.Mid
                #midT2 = offset2.Domain.Mid
                midPt1 = offset1.PointAt(midT1)
                #midPt2 = offset1.PointAt(midT2)
                                    
                if int(parcel_Geo.Contains(midPt1))==1:
                    choice = offset1
                else :
                    choice = offset2
                offsetEdges.append(choice)
            else:
                offsetEdges.append(edges_geo[i].ToPolylineCurve())
      
        return offsetEdges
    
    
    @staticmethod
    def ExtendedEdges(offsetEdges,extension=5):
        extendedOffsetEdges = []

        for i in range(len(offsetEdges)):
            currEdge = offsetEdges[i]
            #if isinstance(currEdge,rg.Curve):
            #if isinstance(currEdge,rg.Curve):
            newEdge_Extend = currEdge.Extend(rg.CurveEnd.Both,extension,rg.CurveExtensionStyle.Line) 
            #elif isinstance(currEdge,rg.Polyline):
                #newStartPt = rg.Point3d.Add(currEdge[0],rg.Vector3d(currEdge[0]-currEdge[1])*extension)
                #newEndPt = rg.Point3d.Add(currEdge[len(currEdge)-1],rg.Vector3d(currEdge[len(currEdge)-1]-currEdge[len(currEdge)-2])*extension)
                #newPts = [newStartPt]
                #for point in currEdge:
                    #newPts.append(point)
                #newPts.append(newEndPt)
                #newEdge_Extend = rg.Polyline(newPts)
                
            extendedOffsetEdges.append(newEdge_Extend)

        return extendedOffsetEdges
    
    @staticmethod
    def CheckIntersectionWithAllEdges(currE,edges):
        intersectionCount = 0
        for edge in edges:
            if edge!=currE:
                intersectionCount+=rg.Intersect.Intersection.CurveCurve(currE,edge,0.001,0.001).Count
        return intersectionCount
    
    @staticmethod
    def ExtendToGetIntersections(edges,extension,iteration):
        
        for i in range(len(edges)):  
                                 
            for time in range(iteration):
                if i != len(edges)-1 and i !=0:
                    prevE = edges[i-1]
                    currE = edges[i]
                    nextE= edges[i+1]
                    
                    prevIndex = i-1
                    currIndex = i
                    nextIndex = i+1
                    
                elif i == 0:
                    prevE = edges[-1]
                    currE = edges[i]
                    nextE= edges[i+1]
                    
                    prevIndex = len(edges)-1
                    currIndex = i
                    nextIndex = i+1
                    
                elif i == len(edges)-1:
                    prevE = edges[i-1]
                    currE = edges[i]
                    nextE = edges[0]
                    
                    prevIndex = i-1
                    currIndex = i
                    nextIndex = 0
                    

                
                intersectionCount = PP.CheckIntersectionWithAllEdges(currE,edges)
                #print ("prevIndex: "),prevIndex , ("currIndex: "),currIndex, ("nextIndex"),nextIndex ,"intersectionCount:",intersectionCount,"time:",time
                #if prevIndex == 8 and currIndex == 0 and nextIndex == 1:
                   #print ("currIndex",currIndex,"time:",time,intersectionCount,"intersectionCount:",PP.CheckIntersectionWithAllEdges(currE,edges))
                if intersectionCount == 0:
                    currE = currE.Extend(rg.CurveEnd.Both,extension,rg.CurveExtensionStyle.Line) 
                    prevE = prevE.Extend(rg.CurveEnd.End,extension,rg.CurveExtensionStyle.Line) 
                    nextE = nextE.Extend(rg.CurveEnd.Start,extension,rg.CurveExtensionStyle.Line) 
                    edges[prevIndex] = prevE
                    edges[currIndex] = currE
                    edges[nextIndex] = nextE 
                
                elif intersectionCount == 1:
                    ### check prev-curr
                    if rg.Intersect.Intersection.CurveCurve(prevE,currE,0.001,0.001).Count!=0:
                        prev_curr_Pt = rg.Intersect.Intersection.CurveCurve(prevE,currE,0.001,0.001).Item[0].PointA
                    else:
                        prev_curr_Pt = None
                    
                    ### check next-curr
                    if rg.Intersect.Intersection.CurveCurve(nextE,currE,0.001,0.001).Count!=0:
                        next_curr_Pt = rg.Intersect.Intersection.CurveCurve(nextE,currE,0.001,0.001).Item[0].PointA
                    else:
                        next_curr_Pt = None
                    
                    #print (prev_curr_Pt), next_curr_Pt
                    ###### different cases
                    if prev_curr_Pt != None and next_curr_Pt == None:
                        ######### check with end to extend currE
                        #startPt_currE = currE.PointAtStart
                        #endPt_currE = currE.PointAtEnd
                        #distStart = nextE.PointAt(nextE.ClosestPoint(startPt_currE)[1]).DistanceTo(startPt_currE)
                        #distEnd = nextE.PointAt(nextE.ClosestPoint(endPt_currE)[1]).DistanceTo(endPt_currE)
                        
                        #if distStart<distEnd:
                            #chosenSide = rg.CurveEnd.Start
                        #else:
                            #chosenSide = rg.CurveEnd.End
                        
                        currE = currE.Extend(rg.CurveEnd.End,extension,rg.CurveExtensionStyle.Line) 
                        
                        ######### check with end to extend nextE
                        #print ("checkings")
                        #print ("prevIndex: "),prevIndex , ("currIndex: "),currIndex, ("nextIndex"),nextIndex ,"intersectionCount:",intersectionCount,"time:",time
                        endPt_currE = currE.PointAtEnd
                        
                        closestTOnNextE = nextE.ClosestPoint(endPt_currE)[1]
                        
                        nextDomain =  nextE.Domain
                        startT = nextDomain.T0
                        endT = nextDomain.T1
                        
                        tDistToStart = abs(closestTOnNextE-startT)
                        tDistToEnd = abs(closestTOnNextE-endT)
                        
                        if tDistToStart<tDistToEnd:
                            nextE = nextE.Extend(rg.CurveEnd.Start,extension,rg.CurveExtensionStyle.Line)
                        elif tDistToStart>tDistToEnd:
                            nextE = nextE.Extend(rg.CurveEnd.End,extension,rg.CurveExtensionStyle.Line)

                    elif prev_curr_Pt == None and next_curr_Pt != None:
                        currE = currE.Extend(rg.CurveEnd.Start,extension,rg.CurveExtensionStyle.Line) 
                        
                        ######### check with end to extend prevE
                        #print ("checkings")
                        #print ("prevIndex: "),prevIndex , ("currIndex: "),currIndex, ("nextIndex"),nextIndex ,"intersectionCount:",intersectionCount,"time:",time
                        startPt_currE = currE.PointAtStart
                        
                        closestTOnPrevE = prevE.ClosestPoint(startPt_currE)[1]
                        
                        prevDomain =  prevE.Domain
                        startT = prevDomain.T0
                        endT = prevDomain.T1
                        
                        tDistToStart = abs(closestTOnPrevE-startT)
                        tDistToEnd = abs(closestTOnPrevE-endT)
                        
                        if tDistToStart<tDistToEnd:
                            prevE = prevE.Extend(rg.CurveEnd.Start,extension,rg.CurveExtensionStyle.Line)
                        elif tDistToStart>tDistToEnd:
                            prevE = prevE.Extend(rg.CurveEnd.End,extension,rg.CurveExtensionStyle.Line)

                    elif prev_curr_Pt == None and next_curr_Pt == None:
                        currE = currE.Extend(rg.CurveEnd.Both,extension,rg.CurveExtensionStyle.Line) 
                        prevE = prevE.Extend(rg.CurveEnd.End,extension,rg.CurveExtensionStyle.Line) 
                        nextE = nextE.Extend(rg.CurveEnd.Start,extension,rg.CurveExtensionStyle.Line) 

                    
                    edges[prevIndex] = prevE
                    edges[currIndex] = currE
                    edges[nextIndex] = nextE 

            
            ### check if it can stop
                if PP.CheckIntersectionWithAllEdges(currE,edges) >= 2:
                    break
        return edges
    
    @staticmethod
    def ExtendToGetIntersections_old_old(crvs,extension,iteration):
    
        for i in range(len(crvs)):
            if i != len(crvs)-1:
                currEdge = crvs[i]
                nextEdge = crvs[i+1]
            else:
                currEdge = crvs[i]
                nextEdge = crvs[0]
           
             
            for time in range(iteration):
                
                intersectionCount = rg.Intersect.Intersection.CurveCurve(currEdge, nextEdge,0.001,0.001).Count

                if intersectionCount == 0:
                    currEdge = currEdge.Extend(rg.CurveEnd.End,extension,rg.CurveExtensionStyle.Line) 
                    nextEdge = nextEdge.Extend(rg.CurveEnd.Start,extension,rg.CurveExtensionStyle.Line) 
                else:
                    break
            
            ### replace 
            if i != len(crvs)-1:
                crvs[i] = currEdge
                crvs[i+1] = nextEdge
            else:
                crvs[i] = currEdge
                crvs[0] = nextEdge
        
        return crvs

    @staticmethod
    def GetBooleanRegion(crvs):

        curveCollection = []
        #print "---------test--------"
        for crv in crvs:

            if isinstance(crv,rg.Curve) == False :
                crv = crv.ToNurbsCurve ()
            if crv.IsValid == True:
                curveCollection.append(crv)
        
        for i in range(len(curveCollection)):
            curveCollection[i] = curveCollection[i].Extend(rg.CurveEnd.Both,0.1,rg.CurveExtensionStyle.Line)
        for crv in curveCollection:
            polyL = crv.TryGetPolyline()[1]
            #for pt in polyL:
                #print pt.X,pt.Y,0
            #print "--"
        wxy_plane=rg.Plane.WorldXY
        result=rg.Curve.CreateBooleanRegions(curveCollection,wxy_plane,False,0.001)
        
        
        if result.RegionCount >1:
            regions = []
            areas = []
            for i in range(result.RegionCount):
                regions.append(result.RegionCurves(i)[0])
                
            for i in range(result.RegionCount):
                areas.append(rg.AreaMassProperties.Compute(result.RegionCurves(i)[0]).Area) 
            maxIndex = areas.index(max(areas))
            finalResult = regions[maxIndex]
            
        else:
            finalResult = result.RegionCurves(0)[0]
        
        
        return finalResult
    
    @staticmethod
    def GetOffsetParcel(thisNode):
        offsetEdges = PP.GetOffsetEdges(thisNode)
        extendedOffsetEdges = PP.ExtendToGetIntersections(offsetEdges,0.1,100)
        finalResult = PP.GetBooleanRegion(extendedOffsetEdges)
        finalResult = PP.ConvertPolylineCurveToPolyline(finalResult)

        return finalResult
    
    @staticmethod
    def GetOffsetParcel_SimplifiedWithTurningPoints(thisNode):
        offsetEdges = PP.GetOffsetEdges_SimplifiedWithTurningPoints(thisNode)
        extendedOffsetEdges = PP.ExtendToGetIntersections(offsetEdges,0.1,100)
        finalResult = PP.GetBooleanRegion(extendedOffsetEdges)
        finalResult = PP.ConvertPolylineCurveToPolyline(finalResult)

        return finalResult
    
    #endregion


    ###########################################
    ########            Fillet          #######
    ###########################################
    #region
    def GetRelevantInfo(regionIndex,boundaryIndex,segmentIndex):
        
        afterSegments =[] 
        resultCrvs = []
        for i in range(result.PlanarCurveCount):
            resultCrvs.append(result.PlanarCurve(i))  

        for segmentIndex in range(result.SegmentCount(0,0)):
            regionIndex = 0

            referCrvIndex = result.SegmentDetails(regionIndex,boundaryIndex,segmentIndex)[0]  #regionIndex,boundaryIndex,segmmentIndex
            thisSegDomain = result.SegmentDetails(regionIndex,boundaryIndex,segmentIndex)[1]
            
            orginalCrv =  result.PlanarCurve(referCrvIndex) 
            
            
            afterSegment = orginalCrv.Trim(thisSegDomain)
            afterSegments.append([referCrvIndex,afterSegment])

        afterSegs = []
        indexSegs = []
        for seg in afterSegments:
            afterSegs.append(seg[1])
            indexSegs.append(seg[0])
    #endregion
    
    ########################################
    ########     StarightSkeleton    #######
    ########################################
    #region
    @staticmethod
    def GetBisectorSegments(ptList):
        ptList = List[rg.Point3d](ptList)
        
        xyzArray = CGAL.Wrapper.GeometryProcessingMethods.CGAL_GetStraightSkeleton(ptList)
        halfEdgeNum = int (len(xyzArray)/3/2)
        
        halfEdges = []
        for i in range(halfEdgeNum):
            startPt = rg.Point3d(xyzArray[6*i+0],xyzArray[6*i+1],xyzArray[6*i+2])
            endPt = rg.Point3d(xyzArray[6*i+3],xyzArray[6*i+4],xyzArray[6*i+5])
            halfEdge = rg.Line(startPt,endPt)
            halfEdges.append(halfEdge)
            
        bisectors = []
        
        for i in range(len(halfEdges)):
            if i%2 !=0:
                bisectors.append(halfEdges[i])
        
        return bisectors
    
    @staticmethod
    def ConvertSkeletonSegmentsToCrvs(segments):

        segCrvs = []
        for seg in segments:
            segCrvs.append(seg.ToNurbsCurve())
        
        return segCrvs
    #endregion
    
    ########################################
    ########       Fill Info         #######
    ########################################
    
    #region
    @staticmethod
    def AssignRegionUnionToEachEdge(parcel,segCrvs):
        wxy_plane=rg.Plane.WorldXY
        
        ### divide are the bisectorSkeleton
        for index in range(len(parcel.edges)):
            currEdge = parcel.edges[index]
            currEdge_geo = currEdge.GetGeometry()
        
            allSegs = []
            for seg in segCrvs:
                allSegs.append(seg)
            allSegs.append(currEdge_geo.ToPolylineCurve())
            result=rg.Curve.CreateBooleanRegions(allSegs,wxy_plane,True,0.001)
            #collect all regions
            regions = []
            for i in range(result.RegionCount):
                regions.append(result.RegionCurves(i)[0])
            if len(regions) == 1:
                regionUnion = regions[0]
            else:
                #if ghc.RegionUnion(regions)!= None:
                #regionUnion = ghc.RegionUnion(regions)
                #else:
                regionUnion = rg.Curve.CreateBooleanUnion(regions,0.001)[0]
        
            currEdge.straightSkeletonUnion = regionUnion
            
            ### collect each region
            eachRegions = []
            result=rg.Curve.CreateBooleanRegions(allSegs,wxy_plane,False,0.001)
            for i in range(result.RegionCount):
                eachRegions.append(result.RegionCurves(i)[0])
                
            currEdge.straightSkeletonEach = eachRegions
    
    @staticmethod
    def FillPrevNextVecInfo(parcel):
        ### record the prev and next Vec
        allInstances = parcel.GetVPInstance()
        
        for i in range(len(allInstances)):
            if i == 0 :
                currVP = allInstances[i]
                prevVP = allInstances[-1]
                nextVP = allInstances[i+1]
            
            elif i == len(allInstances)-1:
                currVP = allInstances[i]
                prevVP = allInstances[i-1]
                nextVP = allInstances[0]
            
            else:
                currVP = allInstances[i]
                prevVP = allInstances[i-1]
                nextVP = allInstances[i+1]
            
            prevVec = rg.Vector3d(prevVP.geometry - currVP.geometry)
            nextVec = rg.Vector3d(nextVP.geometry - currVP.geometry)
            prevVec.Unitize()
            nextVec.Unitize()
            
            currVP.prevVec = prevVec
            currVP.nextVec = nextVec

    @staticmethod
    def AssignMovingVectors(parcel):
        for index in range(len(parcel.edges)):
        
            if index == 0 :
                prevEdge = parcel.edges[-1]
                currEdge = parcel.edges[index]
                nextEdge = parcel.edges[index+1]
            
            elif index!=0 and index != len(parcel.edges)-1:
                prevEdge = parcel.edges[index-1]
                currEdge = parcel.edges[index]
                nextEdge = parcel.edges[index+1]
            
            elif index == len(parcel.edges)-1:
                prevEdge = parcel.edges[index-1]
                currEdge = parcel.edges[index]
                nextEdge = parcel.edges[0]

            ####################################
            ###### betweenPt Vectors
            ####################################
            betweenVecs = []
            allVP = currEdge.GetVPInstance()
            
            for i in range(1,len(allVP)-1,1): 
                
                currVP = allVP[i]
                prevVec = currVP.prevVec
                nextVec = currVP.nextVec
                
                ##### this is to avoid getting vector like (0,0,0)
                if (prevVec + nextVec).Length < 0.001:
                    vertVec = rg.Vector3d(prevVec)
                    wxy_Plane=rg.Plane.WorldXY
                    ZAxis=wxy_Plane.ZAxis
                    vertVec.Rotate(rm.ToRadians(90),ZAxis)
                    if rg.Vector3d.CrossProduct(vertVec,nextVec).Z > 0:
                        vertVec = -vertVec
                    bisectorVec = vertVec
                    
                else:
                    bisectorVec = rg.Vector3d.Add(prevVec,nextVec)

                    if rg.Vector3d.CrossProduct(prevVec,nextVec).Z > 0:
                        bisectorVec = -bisectorVec
                        
                bisectorVec.Unitize()
                #print "(prevVec - nextVec).Length",(prevVec + nextVec).Length
                #print bisectorVec
                betweenVecs.append(bisectorVec)
            ####################################
            ###### start Vector
            ####################################
            currPt = currEdge.startVertex.geometry
            if currEdge.betweenPoints != []:
                nextPt = currEdge.betweenPoints[0].geometry
            else:
                nextPt = currEdge.endVertex.geometry
                
            if prevEdge.betweenPoints == []:
                prevPt = prevEdge.startVertex.geometry
            else:
                prevPt = prevEdge.betweenPoints[-1].geometry
            
            
            prevVec = rg.Vector3d(prevPt-currPt)
            prevVec.Unitize()
            nextVec = rg.Vector3d(nextPt-currPt)
            nextVec.Unitize()
            
            
            ##### this is to avoid getting vector like (0,0,0)
            if (prevVec + nextVec).Length < 0.001:
                vertVec = rg.Vector3d(prevVec)
                wxy_Plane=rg.Plane.WorldXY
                ZAxis=wxy_Plane.ZAxis
                vertVec.Rotate(rm.ToRadians(90),ZAxis)
                if rg.Vector3d.CrossProduct(vertVec,nextVec).Z > 0:
                    vertVec = -vertVec
                bisectorVec = vertVec
                
            else:
                bisectorVec = prevVec + nextVec
        
            startVec = bisectorVec
            if rg.Vector3d.CrossProduct(prevVec,nextVec).Z > 0:
                startVec = -startVec
            
            ####################################
            ###### end Vector
            ####################################
            currPt = currEdge.endVertex.geometry
            if nextEdge.betweenPoints == []:
                nextPt = nextEdge.endVertex.geometry
                
            else:
                nextPt = nextEdge.betweenPoints[0].geometry
                
            if currEdge.betweenPoints == []:
                prevPt = currEdge.startVertex.geometry
            else:
                prevPt = currEdge.betweenPoints[-1].geometry
            
            prevVec = rg.Vector3d(prevPt-currPt)
            prevVec.Unitize()
            nextVec = rg.Vector3d(nextPt-currPt)
            nextVec.Unitize()
            
            ##### this is to avoid getting vector like (0,0,0)
            if (prevVec + nextVec).Length < 0.001:
                vertVec = rg.Vector3d(prevVec)
                wxy_Plane=rg.Plane.WorldXY
                ZAxis=wxy_Plane.ZAxis
                vertVec.Rotate(rm.ToRadians(90),ZAxis)
                if rg.Vector3d.CrossProduct(vertVec,nextVec).Z > 0:
                    vertVec = -vertVec
                bisectorVec = vertVec
            
            else:   
                bisectorVec = prevVec + nextVec
        
            
            endVec = bisectorVec
            if rg.Vector3d.CrossProduct(prevVec,nextVec).Z > 0:
                endVec = -endVec
                
            movingVecs = [startVec]
            
            movingVecs.extend(betweenVecs)
            movingVecs.append(endVec)
            
            
            currEdge.movingVecs = movingVecs

    @staticmethod
    def CorrectVerticesMovingVecs(parcel):
        for index in range(len(parcel.edges)):
            currEdge = parcel.edges[index]
            if currEdge.betweenPoints == []:
                temp = currEdge.movingVecs[0]
                currEdge.movingVecs[0] = currEdge.movingVecs[1]
                currEdge.movingVecs[1] = temp
            else:
                currEdge.movingVecs[0] = currEdge.movingVecs[1]
                currEdge.movingVecs[-1] = currEdge.movingVecs[-2]
    #endregion


    ###########################################
    ########        Utility             #######
    ###########################################
    #region
    @staticmethod
    def ConvertPolylineCurveToPolyline(polyCrv):
        #convert back to polyline
        if isinstance(polyCrv,rg.PolylineCurve):
            pointCount = polyCrv.PointCount

        polyline = rg.Polyline(pointCount)
        for i in range(pointCount):
            polyline.Add(polyCrv.Point(i))
        return polyline
    
    @staticmethod
    def SimplifyVertices(poly):
        if isinstance(poly,rg.Curve):
            polyL = poly.TryGetPolyline()[1]
        elif isinstance(poly,rg.Polyline):
            polyL = poly
        
        newPtList = []
        segments = polyL.GetSegments()
        
        newPtList.append(polyL.First)
        for i in range(len(segments)-1):
            currSeg = segments[i]
            nextSeg = segments[i+1]
        
            vecA = rg.Vector3d(currSeg.To - currSeg.From)
            vecB = rg.Vector3d(nextSeg.To - nextSeg.From)
            
            if rg.Vector3d.VectorAngle(vecA,vecB) > 0.001:
                newPtList.append(nextSeg.From)
                
        newPtList.append(polyL.Last)
        simplifiedPolyL = rg.Polyline(newPtList)
        simplifiedPolyCrv = simplifiedPolyL.ToPolylineCurve()
        
        return simplifiedPolyCrv
    
    @staticmethod
    def SimplifyVertices_ToPolyLine(poly):
        if isinstance(poly,rg.Curve):
            polyL = poly.TryGetPolyline()[1]
        elif isinstance(poly,rg.Polyline):
            polyL = poly
        
        newPtList = []
        segments = polyL.GetSegments()
        
        newPtList.append(polyL.First)
        for i in range(len(segments)-1):
            currSeg = segments[i]
            nextSeg = segments[i+1]
        
            vecA = rg.Vector3d(currSeg.To - currSeg.From)
            vecB = rg.Vector3d(nextSeg.To - nextSeg.From)
            
            if rg.Vector3d.VectorAngle(vecA,vecB) > 0.001:
                newPtList.append(nextSeg.From)
                
        newPtList.append(polyL.Last)
        simplifiedPolyL = rg.Polyline(newPtList)
 
        
        return simplifiedPolyL
        
    @staticmethod
    def SimplifyPolyCrvs(polyCrvList):
        simplifyPolyCrvs = []
        for polyCrv in polyCrvList:
            simplifyPolyCrvs.append(PP.SimplifyVertices(polyCrv))
        
        return simplifyPolyCrvs
    #endregion    
    
    
    ###########################################
    ########       Optimization         #######
    ###########################################
    #region
    
    @staticmethod
    def GetAllParcelGeometry_Simplified(collection): 
        parcels = []
        for pFace in collection:
            vertices = pFace.vertices
            v_Geo = [v.geometry for v in vertices]
            v_Geo.append(v_Geo[0])
            parcels.append(rg.Polyline(v_Geo))
        return parcels
    
    @staticmethod
    def GetParcelGeometry_Simplified(pFace): 

        vertices = pFace.vertices
        v_Geo = [v.geometry for v in vertices]
        v_Geo.append(v_Geo[0])
        
        return rg.Polyline(v_Geo)
    
    
    @staticmethod
    def GetParcelGeometry_SimplifiedWithTurningPoints(pFace): 
        v_Geo = []
        for edge in pFace.edges:
            
            v_Geo.append(edge.startVertex.geometry)
            if edge.turningPoints!=[]:
                for tPt in edge.turningPoints:
                        
                    v_Geo.append(tPt.geometry)
        
        v_Geo.append(v_Geo[0])
        
        return rg.Polyline(v_Geo)
    
    
    @staticmethod
    def GetAllParcelGeometry_SimplifiedWithTurningPoints(collection): 
         
        parcels = []
        for pFace in collection:
            
            v_Geo = []
            for edge in pFace.edges:
                
                v_Geo.append(edge.startVertex.geometry)
                if edge.turningPoints!=[]:
                    for tPt in edge.turningPoints:
                         
                        v_Geo.append(tPt.geometry)
            
            v_Geo.append(v_Geo[0])
            
            parcels.append(rg.Polyline(v_Geo))
        return parcels
    
    
    @staticmethod
    def GetParcelGeometry(collection): 
        parcels = []
        for pFace in collection:
            parcels.append(pFace.GetGeometry())
        return parcels
    
    @staticmethod
    def GetEdgeGeometry(targetEdges):
        targetEdges_Geo = []
        for edge in targetEdges:
            targetEdges_Geo.append(edge.GetGeometry())
        return targetEdges_Geo
    
    @staticmethod
    def GetAllEdgeGeoAndIDFromDict(currE_Dict):
        edges = []
        edges_indices = []
        for edge in currE_Dict.values():
            edges.append(edge.GetGeometry())
            edges_indices.append(edge.ID)
        return edges,edges_indices
    
    ### checkInfo
    @staticmethod
    def PrintParcelAddress(collection):
        for pF in collection:
            print ("selected orginal Ids：") ,id(pF)

    
    ### Create a partial collection 
    @staticmethod
    def MakePartialCopy(selectedParcFace):
        currVP_Dict = {}
        for parcFace in selectedParcFace:
            thisVPInstances = parcFace.GetVPInstance()
            for VPInstance in thisVPInstances:
                if VPInstance.ID not in currVP_Dict.keys():
                    currVP_Dict[VPInstance.ID] = VPInstance.DeepCopy()

        currE_Dict = {}

        for parcFace in selectedParcFace:
            thisEInstances = parcFace.edges
            for EInstance in thisEInstances:
                if EInstance.ID not in currE_Dict.keys():
                    newE =  EInstance.DeepCopy(currVP_Dict)
                    currE_Dict[EInstance.ID] = newE
                    #E_Redirect[newE] = EInstance

        copiedParcFace = []
        for parcFace in selectedParcFace:
            
            copiedParcFace.append(parcFace.DeepCopy(currVP_Dict,currE_Dict))
            #print ("before:"),len(parcFace.vertices),("after:"),len(copiedParcFace[-1].vertices)

        ########## build redirectMap
        redirectMap = {}
        for i in range(len(selectedParcFace)):
            redirectMap[selectedParcFace[i]] = copiedParcFace[i]
            redirectMap[copiedParcFace[i]] = selectedParcFace[i]
    

        return copiedParcFace,currVP_Dict,currE_Dict,redirectMap
    
    @staticmethod
    def RedirectNeighbors_Temp(currQ,prevQ,newEDict,redirectMap):

        for parcFace in currQ:
            # update the "neighbors" 
            for i in range(len(parcFace.neighbors)):
                thisNeighbor = parcFace.neighbors[i]
                if thisNeighbor in prevQ:
                    parcFace.neighbors[i] = redirectMap[thisNeighbor]
        
        #print "-----------------------before"
        for parcFace in currQ:
            NIDs = []
            for N in parcFace.neighbors:
                NIDs.append(id(N))
            #print id(parcFace),"NIDs:", NIDs
            
        for parcFace in currQ:
            #print "-----parcFace",id(parcFace)
            thisNs = parcFace.neighbors
            #print (len(thisNs))
            newNs = []
            for thisN in thisNs:
                
                if thisN  in currQ:
                    newNs.append(thisN)
            parcFace.neighbors=newNs
                    

        # update the "mutualP_E" 
        for parcFace in currQ:
            thisNeighbors = parcFace.neighbors
            parcFace.mutualP_E = {}
            parcFace.mutualE_P = {}
            
            for thisN in thisNeighbors:
                
                parcFace_prev = redirectMap[parcFace]
                thisN_prev = redirectMap[thisN]
                
                eID = thisN_prev.mutualP_E[parcFace_prev].twinID
                
                parcFace.mutualP_E[thisN] = newEDict[eID]
                parcFace.mutualE_P[newEDict[eID]] = thisN
                

    ### Reduce T-Junctions
    @staticmethod
    def GetTargetEdgeFromDict(dict,minLength):
        targetEdges = []
        for edge in dict.values():
            if edge.GetGeometry().Length < minLength and edge.generation!="Naked":
                targetEdges.append(edge)
        return targetEdges
    
    @staticmethod
    def CleanTwinEdgeInTargetEdges(targetEdges):
        allTargetEdgeID = [targetEdge.ID for targetEdge in targetEdges]
        targetEdges_Clean = []
        
        for targetEdge in targetEdges:
            targetEdges_Clean_ID = [edge.ID for edge in targetEdges_Clean]
            thisId = targetEdge.ID
            twinID = targetEdge.twinID
            if thisId not in targetEdges_Clean_ID and twinID not in targetEdges_Clean_ID:
                targetEdges_Clean.append(targetEdge)

        return targetEdges_Clean
        
    @staticmethod
    def CleanAdjacencyTargetEdges(targetEdges):
        targetEdges_Clean = []
        vRecord = []
        for edge in targetEdges:
            if edge.startVertex not in vRecord and edge.endVertex not in vRecord:
                targetEdges_Clean.append(edge)
                vRecord.append(edge.startVertex)
                vRecord.append(edge.endVertex)
        return targetEdges_Clean   
    
    @staticmethod
    def CheckIfOneOfFourEdges(targetEdge,currQ):
        ### This func is to aviod triangle shape
        #Get Relevant parcels
        relevantParcels = []
        tag = False
        for parcF in currQ:
            edges = parcF.edges
            edgeIDs = [edge.ID for edge in edges]
            if targetEdge.ID in edgeIDs or targetEdge.twinID in edgeIDs:
                relevantParcels.append(parcF)
            
        for parcF in relevantParcels:
            edges = parcF.edges
            num = len(edges)
            if num == 4:
                tag = True
                break
        
        return tag  
        
    @staticmethod
    def CleanPotentialTriangleCauses(targetEdges,currQ):
        targetEdges_Clean = []
        for targetEdge in targetEdges:
            checkTag = PP.CheckIfOneOfFourEdges(targetEdge,currQ)

            if checkTag:
                pass
            else:
                targetEdges_Clean.append(targetEdge)
        
        return targetEdges_Clean
        
    @staticmethod
    def ReduceMinEdge(PL,selectedEdge,copiedParcFace,Edict,VP_Dict):
        
        startV = selectedEdge.startVertex   ### store here, later I cant get this by selected edge
        endV = selectedEdge.endVertex       ### store here, later I cant get this by selected edge

        ### create a new vertex, if on the boundary , merge it to the boundary
        if startV.onBoundary == True:
            newV = startV
            #print "startV.onBoundary "
            finalSelectedGeo = newV.geometry
        elif endV.onBoundary == True: 
            newV = endV 
            #print "endV.onBoundary "
            finalSelectedGeo = newV.geometry
        else:
            startPt =  selectedEdge.GetGeometry().First
            EndPt =  selectedEdge.GetGeometry().Last
            avePt = (startPt+EndPt)/2
            currMaxVPID = max(VP_Dict.Keys)
            newV = PL.ParcVertex(avePt,currMaxVPID+1)
            #print "avePt "
            finalSelectedGeo = newV.geometry
        
        #print finalSelectedGeo.X,finalSelectedGeo.Y,finalSelectedGeo.Z
        ### find the parcels to treat with
        twinEdge = Edict[selectedEdge.twinID]
        for parcel in copiedParcFace:
            edges = parcel.edges
            if selectedEdge in edges:
                targetParcel = parcel

            if twinEdge in edges:
                nbParcel = parcel


        ### check if its going to be a triangle
        testTriPts = []
        for i in range(len(targetParcel.edges)):
            currEdge = targetParcel.edges[i]
            if currEdge!= selectedEdge:
                testTriPts.append(currEdge.startVertex.geometry)
            else:
                testTriPts.append(finalSelectedGeo)

        testPolyL = rg.Polyline(testTriPts)

        testTriPts_Twin = []
        for i in range(len(nbParcel.edges)):
            currEdge = nbParcel.edges[i]
            if currEdge!= selectedEdge:
                testTriPts_Twin.append(currEdge.startVertex.geometry)
            else:
                testTriPts_Twin.append(finalSelectedGeo)

        testPolyL_Twin = rg.Polyline(testTriPts_Twin)

        testPolyL_Sim = PP.ConvertPolylineCurveToPolyline(PP.SimplifyVertices(testPolyL))
        testPolyL_Twin_Sim = PP.ConvertPolylineCurveToPolyline(PP.SimplifyVertices(testPolyL_Twin))

        if len(testPolyL_Sim) == 3 or len(testPolyL_Twin_Sim) ==3:
            return 
    
               



        ### replace the edge startVertex and endVertex  /  this treatment for all parcels / this will change the selected edge

        for parcel in copiedParcFace:
            if parcel != targetParcel and parcel != nbParcel:
                edges = parcel.edges
                for edge in edges:
                    if edge.startVertex == startV:
                        edge.startVertex = newV
                    if edge.endVertex == startV:
                        edge.endVertex = newV
                    if edge.startVertex == endV:
                        edge.startVertex = newV
                    if edge.endVertex == endV:
                        edge.endVertex = newV

                for i in range(len(parcel.vertices)):
                    vertex = parcel.vertices[i]
                    if vertex == startV or vertex == endV:
                        parcel.vertices[i] = newV

        ### targetParcel: remove the edge， change affected edge vertices  
        targetParcel.edges.remove(selectedEdge)

        edges = targetParcel.edges
        for edge in edges:
            if edge.endVertex == startV:
                edge.endVertex = newV
            if edge.startVertex == endV:
                edge.startVertex = newV
                
        ### targetParcel: remove 2 orginal V and insert new V

        v_TargetParcel = targetParcel.vertices
        index_Start = v_TargetParcel.index(startV)
        index_End = v_TargetParcel.index(endV)

        newVertices = v_TargetParcel[:index_Start]+[newV]+v_TargetParcel[index_Start+1:]    
        newVertices.pop(index_End)    

        if index_End == 0:    ### to sort the vertices order
            newVertices = [newVertices[-1]]+ newVertices[0:-1]
        targetParcel.vertices = newVertices

        #print "------------"
        ### nbParcel: remove the twinedge  
        #print nbParcel.ID
        nbParcel.edges.remove(twinEdge)

        nbEdges = nbParcel.edges
        for edge in nbEdges:
            if edge.endVertex == endV:
                edge.endVertex = newV
            if edge.startVertex == startV:
                edge.startVertex = newV
                
        ### nbParcel: remove 2 orginal V and insert new V
        v_nbParcel = nbParcel.vertices
        index_Start_nb = v_nbParcel.index(endV)    #twin, end->start
        index_End_nb = v_nbParcel.index(startV)
        #print "index_Start_nb,index_End_nb:",index_Start_nb,index_End_nb
        #print "v_nbParcel",len(v_nbParcel)
        newVertices_nb = v_nbParcel[:index_Start_nb]+[newV]+v_nbParcel[index_Start_nb+1:] 
        newVertices_nb.pop(index_End_nb)
        
        if index_End_nb == 0:    ### to sort the vertices order
            
            newVertices_nb = [newVertices_nb[-1]]+ newVertices_nb[0:-1]
        nbParcel.vertices = newVertices_nb

        
 
        
        ### remove from Edict
        if selectedEdge.ID in Edict.keys():
            Edict.pop(selectedEdge.ID)
        if selectedEdge.twinID in Edict.keys():
            Edict.pop(selectedEdge.twinID)
    
    
    @staticmethod
    def ReduceAllMinEdges(PL,allParcFaces,targetEdges,currVP_Dict,currE_Dict):
        for index in range(len(targetEdges)):
            selectedEdge = targetEdges[index]
            PP.ReduceMinEdge(PL,selectedEdge,allParcFaces,currE_Dict,currVP_Dict)
            
    
    ### Turning Points
    @staticmethod
    def FindTurningPoint(polyL,detectAngle):
        segments = polyL.GetSegments()
        
        turningPts = []
        turningPtIndices = []
        for i in range(len(segments)-1):
            currSeg = segments[i]
            nextSeg = segments[i+1]
            currVec = rg.Vector3d(currSeg.To - currSeg.From)
            nextVec = rg.Vector3d(nextSeg.To - nextSeg.From)
            angle = rg.Vector3d.VectorAngle(currVec,nextVec)
            detectAngle_R = rm.ToRadians(detectAngle)
            if  angle>detectAngle_R:
                #print angle
                turningPts.append(currSeg.To)
                turningPtIndices.append(i+1)
        
        return turningPtIndices,turningPts
    
    @staticmethod
    def FindTurningPointsForParcel_BeforeMerge(parcel):

        edges = parcel.edges
        ### collect turningPoint indices
        turningPtCollection = []
        for i in range(len(edges)):
            turningPtCollection.append([])
            
        for i in range(len(edges)):
            currEdge = edges[i]
            turningPtIndices,turningPts = PP.FindTurningPoint(currEdge.GetGeometry())
            turningPtCollection[i].append(i)
            turningPtCollection[i].append(turningPtIndices)
            turningPtCollection[i].append(turningPts)
        return turningPtCollection
    
    @staticmethod
    def FindTurningPointsForParcel_AfterMerge(parcel,detectAngle):
        allVP = parcel.GetVPInstance()
        edges = parcel.edges
        ### collect turningPoint indices
        turningPtInfo = []
        for i in range(len(edges)):
            turningPtInfo.append([])
            
        for i in range(len(edges)):
            currEdge = edges[i]
            allVP = currEdge.GetVPInstance()
            
            turningPtIndices,turningPts = PP.FindTurningPoint(currEdge.GetGeometry(),detectAngle)
            
 
            turningPtIndices_Clean = []
            turningPts_Clean = []
            #print "now treating edge ",i
            for ptIndex in turningPtIndices:
                #print "ptIndex:",ptIndex, "len(allVP)",len(allVP)
                
                if ptIndex != 1 and ptIndex!= len(allVP)-2:  #betweenPt[0] or betweenPt[-1],dont consider
                    #print "before :",turningPtIndices_Clean
                    turningPtIndices_Clean.append(ptIndex)
                    turningPts_Clean.append(turningPts[turningPtIndices.index(ptIndex)])
                    #print "after :",turningPtIndices_Clean
            turningParcPoints_Clean = []
            for index in turningPtIndices_Clean:
                turningParcPoints_Clean.append(allVP[index])
                    
            turningPtInfo[i].append(i)
            
            turningPtInfo[i].append(turningPtIndices_Clean)
            turningPtInfo[i].append(turningPts_Clean)
            turningPtInfo[i].append(turningParcPoints_Clean)
            
            # [(edgeIndex,[turningPtIndices],[Point3d],[ParcPoint])
        return turningPtInfo
    
    @staticmethod
    def GetTurningPtInfoCollection(allParcel,detectAngle):
        turningPtCollection = []
        for parcel in allParcel:
            turningPtInfo =  PP.FindTurningPointsForParcel_AfterMerge(parcel,detectAngle)
            turningPtCollection.append([parcel,turningPtInfo])
            
        return turningPtCollection
        
    @staticmethod
    def ExtractTurningPtInfo(turningPtCollection):
        turningParcPts = []
        turningParcFs = []
        
        for parcelIndex in range(len(turningPtCollection)): 
            turningPtInfo = turningPtCollection[parcelIndex][1]
            thisParcel = turningPtCollection[parcelIndex][0]
        
            for egdeIndex in range(len(turningPtInfo)):

                for parcPt in turningPtInfo[egdeIndex][3]:
                    turningParcPts.append(parcPt)
                    turningParcFs.append(thisParcel)  
                     
        return turningParcPts,turningParcFs


    
    @staticmethod
    def CreateTurningPointModifyList(turningParcPts,turningParcFs):
        ###### Clean repeated ParcPoint becasue of twin
        newParcPtList = []
        newIndexList = []
        newParcFaceList = []
        for i in range(len(turningParcPts)):
            pt = turningParcPts[i]

            if pt not in newParcPtList:
                newParcPtList.append(pt)
                newIndexList.append(i)
                newParcFaceList.append(turningParcFs[i])
                

        modifyList = []
        ##### Create a dict to store which parcFace should be updated  format: {parcPoint, parcels}
        for i in range(len(newParcPtList)):
            parcPoint = newParcPtList[i]
            parcel = newParcFaceList[i]
            newDict = {parcPoint:parcel}
            modifyList.append(newDict)
            
        return  modifyList

    
    @staticmethod
    def ModifyAllTurningPoints(PL,modifyList,currVP_Dict,currE_Dict):
        for modifyIndex in range(len(modifyList)):
    
            targetModifyList = modifyList[modifyIndex]
            

            targetParcF= targetModifyList.values()[0]
            targetParcPt = targetModifyList.keys()[0]
            print ("now doing targetParcF:"),targetParcF.ID, "targetParcPt:",targetParcPt.geometry
        
            edges = targetParcF.edges 
            for edge in edges:
                allVP = edge.GetVPInstance()
                if targetParcPt in allVP:
                    targetEdge = edge

            print ("now doing targetEdge:"),targetEdge.ID
            #print ("targetEdge:"), targetEdge,"targetEdgeID:", targetEdge.ID 
            targetEdge_Geo = targetEdge.GetGeometry()
            targetPF_Geo = targetParcF.GetGeometry()
            targetPF_V_Geo = [v.geometry for v in targetParcF.vertices]


            #for key in mutualE_P.keys():
                #print key.ID,mutualE_P[key].ID
            
            #print targetParcPt.geometry
            nbParcF = targetParcF.mutualE_P[targetEdge]         ### need to define here, otherwise the key will disapper
            nbEdge = currE_Dict[targetEdge.twinID]  
            

            betweenPts = targetEdge.betweenPoints
            betweenPtIndex = betweenPts.index(targetParcPt)
            first_part = betweenPts[:betweenPtIndex]
            second_part = betweenPts[betweenPtIndex+1:]

            #Convert the old parcPoint to parcVertex, and
            currVPMaxID = max(currVP_Dict.keys())
            newV = PL.ParcVertex(targetParcPt.geometry,currVPMaxID+1)
            currVP_Dict[newV.ID] = newV

            #create New Edges
            currMaxID = max(currE_Dict.keys())
            newEdge_1 = PL.ParcEdge(currMaxID+1)
            newEdge_2 = PL.ParcEdge(currMaxID+3)

            #fill info for newEdge_1
            newEdge_1.startVertex = targetEdge.startVertex
            newEdge_1.endVertex = newV
            newEdge_1.betweenPts = first_part

            #fill info for newEdge_2
            newEdge_2.startVertex = newV
            newEdge_2.endVertex = targetEdge.endVertex
            newEdge_2.betweenPts = second_part

            #create twins
            newEdge_1_twin = newEdge_1.CreateTwin(currMaxID+2)
            newEdge_2_twin = newEdge_2.CreateTwin(currMaxID+4)

            #####################################################
            ######### this parcel
            ### insert vertex/ replace and insert edges
            vertices_ThisPF = targetParcF.vertices
            #print "old vertices_ThisPF:",len(vertices_ThisPF)
            start_ThisPE  = targetEdge.startVertex 
            end_ThisPE =targetEdge.endVertex 

            index_Start = vertices_ThisPF.index(start_ThisPE)
            index_End = vertices_ThisPF.index(end_ThisPE)
            #print index_Start,index_End
            newVertices_ThisPF  = vertices_ThisPF[:index_Start+1] + [newV] + vertices_ThisPF[index_Start+1:]
            edges_ThisPF = targetParcF.edges
            index_TargetEdge = edges_ThisPF.index(targetEdge)
            newEdges_ThisPF  = edges_ThisPF[:index_TargetEdge] + [newEdge_1,newEdge_2] + edges_ThisPF[index_TargetEdge+1:]

            targetParcF.vertices = newVertices_ThisPF
            targetParcF.edges = newEdges_ThisPF
            #print "new vertices_ThisPF:",len(newVertices_ThisPF)
            #print "-------------"
            ######### theNeighbor parcel
            vertices_NeighborPF = nbParcF.vertices
            #print "old vertices_NeighborPF:",len(vertices_NeighborPF)
            start_nbEdge = nbEdge.startVertex
            end_nbEdge = nbEdge.endVertex
            index_nbEdge_Start = vertices_NeighborPF.index(start_nbEdge)
            index_nbEdge_End = vertices_NeighborPF.index(end_nbEdge)
            #print index_nbEdge_Start,index_nbEdge_End
            newVertices_nbParcF = vertices_NeighborPF[:index_nbEdge_Start+1] + [newV] + vertices_NeighborPF[index_nbEdge_Start+1:]

            edges_nbParcF = nbParcF.edges
            index_nbEdge = edges_nbParcF.index(nbEdge)
            newEdges_nbParcF = edges_nbParcF[:index_nbEdge] + [newEdge_2_twin,newEdge_1_twin] + edges_nbParcF[index_nbEdge+1:]

            nbParcF.vertices = newVertices_nbParcF
            nbParcF.edges = newEdges_nbParcF

            ### change E_P Dict and P_E Dict
            #targetParcF
            targetParcF.mutualE_P.pop(targetEdge)
            targetParcF.mutualP_E.pop(nbParcF)
            
            targetParcF.mutualE_P[newEdge_1] = nbParcF
            targetParcF.mutualE_P[newEdge_2] = nbParcF
            targetParcF.mutualP_E[nbParcF] = [newEdge_1,newEdge_2]

            #nbParcF
            nbParcF.mutualE_P[newEdge_1_twin] = targetParcF
            nbParcF.mutualE_P[newEdge_2_twin] = targetParcF
            nbParcF.mutualP_E[targetParcF] = [newEdge_1_twin,newEdge_2_twin]

            # Store other info  
            newEdge_1.generation = targetEdge.generation
            newEdge_1_twin.generation = targetEdge.generation
            newEdge_2.generation = targetEdge.generation
            newEdge_2_twin.generation = targetEdge.generation

            newEdge_1.accessibility = targetEdge.accessibility
            newEdge_1_twin.accessibility = targetEdge.accessibility
            newEdge_2.accessibility = targetEdge.accessibility
            newEdge_2_twin.accessibility = targetEdge.accessibility


            #remove the split edge
            currE_Dict.pop(targetEdge.ID)
            currE_Dict.pop(nbEdge.ID)

            #add the split edge
            currE_Dict[newEdge_1.ID] = newEdge_1    
            currE_Dict[newEdge_2.ID] = newEdge_2 
            currE_Dict[newEdge_1_twin.ID] = newEdge_1_twin 
            currE_Dict[newEdge_2_twin.ID] = newEdge_2_twin 
            #print ("------------------done once-------------------"  ) 

    @staticmethod
    def ModifyAllTurningPointsWithNewType(PL,turningPtCollection,allParcF,currVP_Dict,currE_Dict):
        finishedEdge_Record = []
        for i in range(len(turningPtCollection)):
            thisParcF = allParcF[i]
            turningPtInfo_ThisParcel = turningPtCollection[i][1]
            
            for edgeIndex  in range(len(turningPtInfo_ThisParcel)):
                turningPtInfo_ThisEdge = turningPtInfo_ThisParcel[edgeIndex]
                thisEdge = thisParcF.edges[edgeIndex]
                thisEdgeID = thisEdge.ID
                
                if thisEdgeID not in finishedEdge_Record:
                    
                    turningPoint3d = turningPtInfo_ThisEdge[2]
                    for pt3d in turningPoint3d:
                        
                        thisEdge.turningPoints.append(PL.ParcTurningPoint(pt3d,max(currVP_Dict.keys())+1))

                    finishedEdge_Record.append(thisEdgeID)
                    # treat the twinEdge, if any
                    thisTwinEdgeID = thisEdge.twinID
                    if thisTwinEdgeID != None :
                        thisTwinEdge = currE_Dict[thisTwinEdgeID]
                        for turingPt in thisEdge.turningPoints:
                            thisTwinEdge.turningPoints.append(turingPt)
                        thisTwinEdge.turningPoints.reverse()
                        finishedEdge_Record.append(thisTwinEdgeID)
                
            
            #print ("------------------done once-------------------"  ) 
        
    @staticmethod
    def CheckTurningPointSegmentLength(currE_Dict,minDist):
        allEdges = currE_Dict.values()
        for edge in allEdges:
            if edge.turningPoints!=[]:
                edgeWithTurningPt = edge.GetGeometry_SimplifiedWithTurningPoints()
                segs = edgeWithTurningPt.GetSegments()
                oldTurningPts = edge.turningPoints
                newTurningPts = []
                for i in range(len(segs)-1):
                    thisSeg = segs[i]
                    length  = thisSeg.Length
                    if length>minDist:
                        newTurningPts.append(oldTurningPts[i])
                if  segs[-1].Length < minDist and newTurningPts!=[]:
                    newTurningPts.pop()
                
                edge.turningPoints = newTurningPts
            
    ### Kangaroo Optimization
    @staticmethod
    def OptimizeToStraightLine(polyL):
        # Make solver system and goals list
        ps = ks.PhysicalSystem()
        goals = List[ks.IGoal]()
        tol = 0.0001 # points closer than this will get combined into a single particle
        ### collect all points 
        allPts = []
        for point in polyL:
            allPts.append(point)
        
        ### collect segements
        segments = polyL.GetSegments()
        
        
        VPAnchor_Constrains = []
        vAnchorStrength = 10000
        #tAnchorStrength = 2
        pAnchorStrength = 0
        
        for i in range(0,len(allPts),1):
            currObj = allPts[i]
            if i == 0 or i == len(allPts)-1:
                VPAnchor_Constrains.append(ks.Goals.Anchor(currObj, vAnchorStrength))

            else:
                VPAnchor_Constrains.append(ks.Goals.Anchor(currObj, pAnchorStrength))
                
        # Segment angle constrain 
        lineA = segments
        lineB = lineA[-1:] + lineA[:-1]
        restAngle = 0
        angleStrength = 2
        
        angle_Constrains = []
        for i in range(len(lineA)):
            angle_Constrains.append(ks.Goals.Angle(lineA[i],lineB[i],restAngle,angleStrength))
            
        # Orginal Length constrain
        orginalLength_Constrains = []
        orginalLengthStrength = 0.000
        for segment in segments:
            orginalLength_Constrains.append(ks.Goals.LengthMultiple(segment.From,segment.To,1,orginalLengthStrength))
        
        # Equal Length constrain
        equalLength_Constrains = []
        equalLengthStrength = 10
        segmentsCrv = List[rg.Curve]()
        
        for segment in segments:
            segmentsCrv.Add(segment.ToNurbsCurve())
        equalLength_Constrains.append(ks.Goals.EqualLength(segmentsCrv,equalLengthStrength))
        
        ##### Assign to PhysicalSystem
        allConstrains = []
        
        
        allConstrains.extend(VPAnchor_Constrains)
        allConstrains.extend(angle_Constrains)
        allConstrains.extend(equalLength_Constrains)
        
        
        for g in allConstrains:
            ps.AssignPIndex(g,0.001)
            goals.Add(g)
            
        # Solve zombie style i.e. max N iterations, break when system kinetic energy drops below threshold
        counter = 0
        threshold = 0.001
        #threshold = 1e-10
        while counter < 100:
            ps.Step(goals,True,threshold)
            counter += 1
            #print ps.GetvSum()
            if ps.GetvSum() < threshold:
                break
        
        
        A = ps.GetOutput(goals)
        B = counter
        C = ps.GetPositionArray()
        
        ptList = []
        for pt in C:
            ptList.append(pt)

        return ptList
    #endregion
    
    
    
    ###########################################
    ########          Preview           #######
    ###########################################
    @staticmethod
    def PreviewAllParcVertexAndParcPoint(allParcF):
        allV = []
        allP = []
        for pF in allParcF:
            Vs = pF.vertices
            for v in Vs:
                if v not in allV:
                    allV.append(v)
            
            edges = pF.edges
            for e in edges:
                allP.extend(e.betweenPoints)

        allV_Geo = [v.geometry for v in allV]
        allP_Geo = [pt.geometry for pt in allP]
        
        return  allV_Geo,allP_Geo
    
    
    ###########################################
    ########           Data             #######
    ###########################################
    @staticmethod
    def ArrangeParcelID(allParcF):
        for thisID in range(len(allParcF)):
            allParcF[thisID].ID = thisID
    
    
    
    ###########################################
    ########  Offset and get parcel     #######
    ###########################################
    

    @staticmethod
    def FindTheOffsetEdge(copiedParcFace):
        edgeWithOffset = []
        for parcF in copiedParcFace:
            
            for edge in parcF.edges:
                if edge.offsetDistance !=0:
                    
                    edgeWithOffset.append(edge)
    
        ### clean TwinEdge
        edgeWithOffset_Clean = []
        twinEdgeRecord = []
        for edge in edgeWithOffset:
            if edge.ID not in twinEdgeRecord:
                twinEdgeRecord.append(edge.ID)
                twinEdgeRecord.append(edge.twinID)
                edgeWithOffset_Clean.append(edge)
        
        edgeWithOffset_Clean_Geo = [edge.GetGeometry_SimplifiedWithTurningPoints() for edge in edgeWithOffset_Clean]
        
        return edgeWithOffset_Clean,edgeWithOffset_Clean_Geo
    
    @staticmethod
    def GetTartgetStartV(edgeWithOffset_Clean,copiedParcFace,currE_Dict):
        allStartVertices = []
    
        for edge in edgeWithOffset_Clean:
            allStartVertices.append(edge.startVertex)
    
    
        startEdges = []
        counts = []
        allCounts = []
        tartgetStartV = []
        for startV in allStartVertices:
            
            for pF in copiedParcFace:
            
                startEdges = startV.GetAllEdges_AsStartV(currE_Dict)
            
            count = 0
            for edge in startEdges:
                if edge.offsetDistance == 0 :
                    count+=1
            if count >=2:
                tartgetStartV.append(startV)
            counts.append(count)
            allCounts.append(len(startEdges))
            
            
        tartgetStartV_Geo = [v.geometry for v in tartgetStartV]
        
        return tartgetStartV,tartgetStartV_Geo
    
    @staticmethod
    def GetCorrectInfoCollection(tartgetStartV,copiedParcFace,currE_Dict):
        correctInfoCollection = []
    
        for j in range(len(tartgetStartV)):
            v = tartgetStartV[j]
            startEdges = v.GetAllEdges_AsStartV(currE_Dict)
            nonOffsetEdges = []
            offsetEdges = []
            for edge in startEdges:
                if edge.offsetDistance == 0 :
                    nonOffsetEdges.append(edge)
                else:
                    offsetEdges.append(edge)
            
            for i in range(len(copiedParcFace)):
                pF  = copiedParcFace[i]
                
                nonCount = 0
                for edge in pF.edges:
                    #print "this",id(edge)
                    if edge in nonOffsetEdges:
                        nonCount+=1
                    if  edge.generation!= "Naked" and currE_Dict[edge.twinID] in nonOffsetEdges:
                        nonCount+=1
                        #print "nonCount +1 !", id(edge)
                
                #print "now nonCount = ",nonCount
        #        if j ==1 and i==4:
        #            for edge in nonOffsetEdges:
        #                print "nonOffsetEdges",id(edge)
        #            for edge in offsetEdges:
        #                print "offsetEdges", id(edge)
        #                
        #            print  "this is ", nonCount 
        #            for edge in pF.edges:
        #                print id(edge)
                
                
                if nonCount==2:
                    correctInfoCollection.append([v,pF,i,offsetEdges])
                    
    
        return correctInfoCollection
    
    @staticmethod
    def GetTrimRegions(correctInfoCollection):
        trimRegions = []
    
        for i in range(len(correctInfoCollection)):
            list = correctInfoCollection[i]
            targetParcel = list[1]
            possibleEdges= list[3]
            targetParcel_Geo = targetParcel.GetGeometry_SimplifiedWithTurningPoints() 
            useEdgeGeos = []
            for edge in possibleEdges:
                
                offset1= edge.GetGeometry_SimplifiedWithTurningPoints().ToPolylineCurve().Offset(rg.Plane.WorldXY,edge.offsetDistance,0.001,rg.CurveOffsetCornerStyle.Sharp)[0]
                offset2= edge.GetGeometry_SimplifiedWithTurningPoints().ToPolylineCurve().Offset(rg.Plane.WorldXY,-edge.offsetDistance,0.001,rg.CurveOffsetCornerStyle.Sharp)[0]
                offset1 = offset1.Extend(rg.CurveEnd.Both,edge.offsetDistance,rg.CurveExtensionStyle.Line)
                offset2 = offset2.Extend(rg.CurveEnd.Both,edge.offsetDistance,rg.CurveExtensionStyle.Line)
                offset1_PolyL = offset1.TryGetPolyline()[1]
                offset2_PolyL = offset2.TryGetPolyline()[1]
            
                ptList1 =  [pt  for pt in offset1_PolyL]
                ptList2 =  [pt  for pt in offset2_PolyL]
                ptList2.reverse()
                ptList1.extend(ptList2)
                ptList1.append(ptList1[0])
                offsetRegion = rg.Polyline(ptList1)
       
                
                parcelCenter = rg.AreaMassProperties.Compute(targetParcel_Geo.ToPolylineCurve()).Centroid
                mid1 = offset1.PointAt(offset1.Domain.Mid)
                mid2 = offset2.PointAt(offset2.Domain.Mid)
                
                dist1 = mid1.DistanceTo(parcelCenter)
                dist2 = mid2.DistanceTo(parcelCenter)
                
                if dist1<dist2:
                    useEdgeGeo = offset1
                else:
                    useEdgeGeo = offset2
                
                useEdgeGeo = useEdgeGeo.Extend(rg.CurveEnd.Both,edge.offsetDistance,rg.CurveExtensionStyle.Line)
                useEdgeGeos.append(useEdgeGeo)
            
            all = [geo for geo in useEdgeGeos]
            
            all.append(targetParcel_Geo.ToPolylineCurve())
            result=rg.Curve.CreateBooleanRegions(all,rg.Plane.WorldXY,False,0.001)
            
            #collect all regions
            regions = []
            for i in range(result.RegionCount):
                regions.append(result.RegionCurves(i)[0])
            
       
            if len(regions) != 1:
                regions_Clean = []
                for region in regions:
                    thisRegionCenter = rg.AreaMassProperties.Compute(region).Centroid
                    if int(offsetRegion.ToPolylineCurve().Contains(thisRegionCenter))!=1:
                        regions_Clean.append(region) ### exclude outside region 
                            
                areas = []
                for i in range(len(regions_Clean)):
                    areas.append(rg.AreaMassProperties.Compute(regions_Clean[i]).Area)
            
                maxID = areas.index(max(areas))
            
                chosenRegion = regions_Clean[maxID]
                    
            else:
                chosenRegion = regions[0]
            
            
            trimRegions.append(chosenRegion)
        
        return trimRegions

    @staticmethod
    def ReplaceOffsetParcelS(parcels_Offset_Simplified_Before,trimRegions,correctInfoCollection):
        # replace
        for i in range(len(correctInfoCollection)):
            list = correctInfoCollection[i]
            changIndex = list[2]
            parcels_Offset_Simplified_Before[changIndex] = trimRegions[i]
    
    @staticmethod
    def FixOffsetDiscrepency(copiedParcFace,currE_Dict,parcels_Offset_Simplified_Before):
        edgeWithOffset_Clean,edgeWithOffset_Clean_Geo = PP.FindTheOffsetEdge(copiedParcFace)
        tartgetStartV,tartgetStartV_Geo = PP.GetTartgetStartV(edgeWithOffset_Clean,copiedParcFace,currE_Dict)
        correctInfoCollection = PP.GetCorrectInfoCollection(tartgetStartV,copiedParcFace,currE_Dict)
        trimRegions = PP.GetTrimRegions(correctInfoCollection)
        PP.ReplaceOffsetParcelS(parcels_Offset_Simplified_Before,trimRegions,correctInfoCollection)
# ---------- end ghpython_script_8 ----------
ghpython_script_9 = GhPythonScript()  # -> out, EV_AccessPoint
# ---------- ghpython_script_9: Python ----------
###########################
####    Import Libs    ####
###########################
import Rhino.Geometry as rg
#import Rhino.RhinoDoc as rd
import Rhino.RhinoMath as rm

import ghpythonlib.components as ghc




class EV_AccessPoint:
    ###########################
    ####       Class       ####
    ###########################
    class AccessPoint:
        def __init__(self,geometry,t):
            self.geometry = geometry
            self.t = t
            self.edgeIndex = None
            self.is_Vertex = False
            self.normal = None
            
    class AccessVertex:
        def __init__(self,geometry,t):
            self.geometry = geometry
            self.t = t
            self.edgeIndex = None
            self.is_Vertex = True
            self.normal = None
            
    class Splitline:
        def __init__(self,geometry):
            self.geometry = geometry
            
            self.scoreEvenArea = None
            self.scoreElongation = None
            self.scoreCompactness = None
            self.scoreConvexity = None
            self.scoreOrientation = None
            
            self.scoreParcelLevel = None

            self.elongationPair = None
            self.areaPair = None
            self.convexityPair  = None
            self.compactnessPair = None
            self.orientationPair = None


    ###########################
    ####     HelpFunc      ####
    ###########################
    @staticmethod
    def EnsureCounterClockwise(inputPolyline):
        inputPolylineCurve = inputPolyline.ToPolylineCurve()
        if inputPolylineCurve.ClosedCurveOrientation().ToString() == "Clockwise":
            inputPolyline.Reverse()
            #print ("reverse it from Clockwise to CounterClockwise")
        else:
            #print ("its CounterClockwise originally")
            pass

    @staticmethod
    def InitializeNodes(inputPolyline,segments,divNum):

        ### get vertices position
        vertices = []
        for point3d in inputPolyline:
            vertices.append(point3d)
            
        ### remove the seam point
        vertices.pop()

        vertices_t =[]
        for v in vertices:
            vertices_t.append(inputPolyline.ClosestParameter(v))
        
        ### get betweenPts position
        inputPolylineCurve= inputPolyline.ToPolylineCurve()
        divPts_t = inputPolylineCurve.DivideByCount(divNum,False)
        divPts=[]

        for t in divPts_t:
            divPts.append(inputPolylineCurve.PointAt(t))

        ### Join all the t , sort the order
        all_t = []
        for t in vertices_t:
            all_t.append(t)
        for t in divPts_t:
            all_t.append(t)

        all_t.sort()

        ### Retrieve the geometry in order
        accessPt_All = []
        for t in all_t:
            accessPt_All.append(inputPolylineCurve.PointAt(t))

        ### Initialize the nodes in orders. fill edge info for vertices first
        nodes=[]
        for i in range(len(all_t)):
            if all_t[i] in vertices_t:
                for j in range(len(vertices_t)):
                    if all_t[i] == vertices_t[j]:
                        temp = EV_AccessPoint.AccessVertex(inputPolylineCurve.PointAt(all_t[i]),all_t[i])
                        if j == 0:
                            temp.edgeIndex=[len(vertices_t)-1,j]
                        else:
                            temp.edgeIndex=[j-1,j]
            
                        nodes.append(temp)
                        

            else:
                nodes.append(EV_AccessPoint.AccessPoint(inputPolylineCurve.PointAt(all_t[i]),all_t[i]))
        
        
        ### extract the AccessPoint node to fill edge info        
        nodes_Pt=[]

        for node in nodes:
            if node.edgeIndex==None:
                nodes_Pt.append(node)


        for node in nodes_Pt:
            for i in range(len(vertices_t)):
                if node.t >= vertices_t[i]:
                    node.edgeIndex = i

        ### extract the AccessPoint node to fill edge info 
        

        for i in range(len(nodes)):
            if nodes[i].is_Vertex == True:
                nodes[i].normal = EV_AccessPoint.GetTheBisectorVec(nodes,i,segments)
            else:
                nodes[i].normal = EV_AccessPoint.GetThePerpendicularVec(nodes,i,segments)
                
        return nodes

    @staticmethod
    def CheckNodesNormal(nodes,inputPolyline):
        inputPolylineCrv = inputPolyline.ToPolylineCurve()
        for node in nodes:
            pt = node.geometry
            newPt = rg.Point3d.Add(pt,node.normal)
            if int(inputPolylineCrv.Contains(newPt)) != 1:
                node.normal = - node.normal
        
    @staticmethod
    def GetThePerpendicularVec(nodes,index,segments):
        edgeIndex = nodes[index].edgeIndex
        normal = segments[edgeIndex].To - segments[edgeIndex].From
        Zaxis = rg.Plane.WorldXY.Normal
        rg.Vector3d.Rotate(normal,rm.ToRadians(90),Zaxis)
        normal.Unitize()
        normal =  normal
        return normal

    @staticmethod   
    def GetTheBisectorVec(nodes,index,segments):
        
        edgeIndices = nodes[index].edgeIndex
        index_a = edgeIndices[0]
        index_b = edgeIndices[1]
        
        vc_a = segments[index_a].From - segments[index_a].To 
        vc_b = segments[index_b].To - segments[index_b].From
        vc_a.Unitize()
        vc_b.Unitize()
        normal = vc_a + vc_b
        normal.Unitize()
        normal =  normal
        return normal

    ### Not in use currently
    @staticmethod 
    def GetThePerpendicularLine(nodes,index,distance):
        
        newPt = rg.Point3d.Add(nodes[index].geometry,nodes[index].normal * distance)
        line = rg.Line(nodes[index].geometry,newPt)
        return line

    ### Not in use currently
    @staticmethod 
    def GetTheBisectorLine(nodes,index,distance):
        
        newPt = rg.Point3d.Add(nodes[index].geometry,nodes[index].normal * distance)
        line = rg.Line(nodes[index].geometry,newPt)
        return line

    ### Not in use currently
    @staticmethod 
    def CheckVaildBezierCurve(userInputPair,inputPolyline,nodes,segments,distance,minL,maxL):
        pt_intersected = None
        streamline = None
        
        lines = []
        for index in userInputPair:
            if nodes[index].is_Vertex == True:
                line = GetTheBisectorLine(nodes,index,segments,distance)
                lines.append(line)
            else:
                
                line = GetThePerpendicularLine(nodes,index,segments,distance)
                lines.append(line)

        rc, a, b = rg.Intersect.Intersection.LineLine(lines[0],lines[1])
        pt_a = nodes[userInputPair[0]].geometry
        pt_b = nodes[userInputPair[1]].geometry
        
        ### check if there is an intersection point  
        if (not rc) or a<0 or b<0:
            print ("No intersection found.")
            

        ### check if the intersection point inside
        else:
            pt_intersected = lines[0].PointAt(a)
            
            inputPolylineCurve = inputPolyline.ToPolylineCurve()
            if inputPolylineCurve.Contains(pt_intersected).ToString() == "Inside":
                ptList= [pt_a, pt_intersected,pt_b]
                streamline = rg.NurbsCurve.Create(False,2,ptList)
                mtol = 0.001
                atol = 0.001
                streamline = streamline.ToPolyline(mtol,atol,minL,maxL)
            
            else:
                print ("The intersetion point is outside.")
        
        return pt_intersected,streamline

    @staticmethod 
    def GetStrightLine(userInputPair,nodes):
        
        pt_a = nodes[userInputPair[0]].geometry
        pt_b = nodes[userInputPair[1]].geometry
        line = rg.Line(pt_a,pt_b)
        
        return line
   
            
    @staticmethod
    def CheckStrightLineValidity(line,inputPolyline):
        tol=0.001
        
        if rg.Intersect.Intersection.CurveLine(inputPolyline.ToPolylineCurve(),line,tol,tol).Count==2:
            return "valid"
        else:
            return "invalid"
        
    
    @staticmethod 
    def GetDetectRegion(line,moveDist):
        direction = rg.Vector3d(line.To - line.From)
        direction2 = rg.Vector3d(direction)

        wxy_Plane=rg.Plane.WorldXY
        ZAxis=wxy_Plane.ZAxis
        direction2.Rotate(rm.ToRadians(90),ZAxis)
        direction2.Unitize()

        
        pt1 = rg.Point3d.Add(line.From,direction2*moveDist)
        pt2 = rg.Point3d.Add(line.From,-direction2*moveDist)
        pt3 = rg.Point3d.Add(line.To,-direction2*moveDist)
        pt4 = rg.Point3d.Add(line.To,direction2*moveDist)
        detectRegion= rg.Polyline([pt1,pt2,pt3,pt4,pt1])

        newPlane = rg.Plane(rg.Point3d(0,0,0),direction2,direction)

        detectRegion = rg.Rectangle3d(newPlane,pt1,pt3)
        
        return detectRegion

    @staticmethod 
    def GetBezierCrvOptions_Old(detectRegion,inputPolyline,nodes,userInputPair,populateNum):
        points = ghc.Populate2D(detectRegion,populateNum,1)

        bCurveList = []
        bCurveList_Valid = []
        mtol = 0.001
        atol = 0.01745329

        ### bCrv 
        pt_a = nodes[userInputPair[0]].geometry
        pt_b = nodes[userInputPair[1]].geometry

        ### generate valid bCrvs
        for pt in points:
            ptList= [pt_a, pt,pt_b]
            streamline = rg.NurbsCurve.Create(False,2,ptList)
            bCurveList.append(streamline)

        inputPolylineCurve = inputPolyline.ToPolylineCurve()

        ### select valid bCrvs
        for bCurve in bCurveList:
            
            if rg.Intersect.Intersection.CurveCurve(bCurve,inputPolylineCurve,mtol,mtol).Count ==2 and int(inputPolylineCurve.Contains(bCurve.PointAt(bCurve.Domain.Mid))) == 1:
                bCurveList_Valid.append(bCurve)

        return bCurveList_Valid

    @staticmethod 
    def GetBezierCrvOptions(detectRegion,inputPolyline,closestPoint_A,closestPoint_B,populateNum):
        points = ghc.Populate2D(detectRegion,populateNum,1)

        bCurveList = []
        bCurveList_Valid = []
        mtol = 0.001
        atol = 0.01745329

        ### bCrv 
        pt_a = closestPoint_A
        pt_b = closestPoint_B

        ### generate valid bCrvs
        for pt in points:
            ptList= [pt_a, pt,pt_b]
            streamline = rg.NurbsCurve.Create(False,2,ptList)
            bCurveList.append(streamline)

        inputPolylineCurve = inputPolyline.ToPolylineCurve()

        ### select valid bCrvs
        for bCurve in bCurveList:
            
            if rg.Intersect.Intersection.CurveCurve(bCurve,inputPolylineCurve,mtol,mtol).Count ==2 and int(inputPolylineCurve.Contains(bCurve.PointAt(bCurve.Domain.Mid))) == 1:
                bCurveList_Valid.append(bCurve)

        return bCurveList_Valid
        
        
    @staticmethod 
    def InitializeSplitlines(bCrvOptions,score_EvenArea,score_Elongation,score_Compactness,score_Convexity,score_Orientation,score_Overall,elongationPairCollection,areaPairCollection,convexityPairCollection,compactnessPairCollection,orientationPairCollection):
        sls = []
        for i in range(len(bCrvOptions)):
            sl = EV_AccessPoint.Splitline(bCrvOptions[i])
            
            sl.scoreEvenArea = score_EvenArea[i]
            sl.scoreElongation = score_Elongation[i]
            sl.scoreCompactness = score_Compactness[i]
            sl.scoreConvexity = score_Convexity[i]
            sl.scoreOrientation = score_Orientation[i]
            
            sl.scoreParcelLevel = score_Overall[i]

            sl.elongationPair = elongationPairCollection[i]
            sl.areaPair = areaPairCollection[i]
            sl.convexityPair  = convexityPairCollection[i]
            sl.compactnessPair = compactnessPairCollection[i]
            sl.orientationPair = orientationPairCollection[i]
            
            sls.append(sl)
        
        return sls

    @staticmethod 
    def SelectBestSplitline(sls):
        scores=[]
        for sl in sls:
        
            scores.append(sl.scoreParcelLevel)

        index = scores.index(max(scores))
        bestSl = sls[index].geometry
        
        return bestSl

    @staticmethod 
    def ConvertNurbcurveToPolyline(nCrv,divNum):
        ts = nCrv.DivideByCount(divNum,True)
        divPts = [] 
        for t in ts:
            divPts.append(nCrv.PointAt(t))
        
        polyL = rg.Polyline(divPts)
        
        return polyL
    ### for streamline compute
    @staticmethod 
    def CheckPositionIndex(inputPolyline,pt):
        tol = 0.001
        #### Method 1 : didnt simplify 
        numSegment = inputPolyline.SegmentCount
        for i in range(numSegment):
            thisSeg =  inputPolyline.SegmentAt(i)
            if thisSeg.DistanceTo(pt,True) < tol:
                position = i
        return position
    
    @staticmethod 
    def CheckPositionIndex_Simplified(newedges,pt):
        tol = 0.001
        
        ##### Method 2 : didnt simplified
        distances = []
        numedge= len(newedges)
        for i in range(numedge):
            thisEdge= newedges[i]
            closestPt_t = thisEdge.ClosestParameter (pt)
            closestPt = thisEdge.PointAt(closestPt_t)
            
            distances.append(closestPt.DistanceTo(pt))

        position = distances.index(min(distances))
        return position
    
    @staticmethod 
    def CheckStreamLineValidity_Old (PC,inputPolyline,streamline,nodes,userInputPair):  
        newedges = PC.ProcessMesh.GetNewEdges(inputPolyline)
        nodePosition_0 = EV_AccessPoint.CheckPositionIndex_Simplified(newedges,nodes[userInputPair[0]].geometry)
        nodePosition_1 = EV_AccessPoint.CheckPositionIndex_Simplified(newedges,nodes[userInputPair[1]].geometry)
        streamline_StartPosition = EV_AccessPoint.CheckPositionIndex_Simplified(newedges,streamline.First)
        streamline_EndPosition = EV_AccessPoint.CheckPositionIndex_Simplified(newedges,streamline.Last)
        #print ("nodePosition_0:",nodePosition_0,"nodePosition_1:",nodePosition_1,streamline_StartPosition,streamline_EndPosition)
        if (streamline_StartPosition == nodePosition_0 and streamline_EndPosition == nodePosition_1) or (streamline_StartPosition == nodePosition_1 and streamline_EndPosition == nodePosition_0):
            return "valid"
        else:
            return "invalid"
    
    @staticmethod 
    def CheckStreamLineValidity (PC,inputPolyline,streamline,closestPoint_A,closestPoint_B):  
        newedges = PC.ProcessMesh.GetNewEdges(inputPolyline)
        nodePosition_0 = EV_AccessPoint.CheckPositionIndex_Simplified(newedges,closestPoint_A)
        nodePosition_1 = EV_AccessPoint.CheckPositionIndex_Simplified(newedges,closestPoint_B)
        streamline_StartPosition = EV_AccessPoint.CheckPositionIndex_Simplified(newedges,streamline.First)
        streamline_EndPosition = EV_AccessPoint.CheckPositionIndex_Simplified(newedges,streamline.Last)
        print ("nodePosition_0:",nodePosition_0,"nodePosition_1:",nodePosition_1,streamline_StartPosition,streamline_EndPosition)
        if (streamline_StartPosition == nodePosition_0 and streamline_EndPosition == nodePosition_1) or (streamline_StartPosition == nodePosition_1 and streamline_EndPosition == nodePosition_0):
            return "valid"
        else:
            return "invalid"
            
    ### for desicion making
    @staticmethod
    def CompareStreamlineCloseToNode(streamlineA,streamlineB,closestPoint_A,closestPoint_B):
         
        distA =  streamlineA.Last.DistanceTo(closestPoint_A)
        distB =  streamlineB.Last.DistanceTo(closestPoint_B)
        
        if distA <= distB:
            return streamlineA
        else:
            return streamlineB
    
    @staticmethod
    def DecideFinalStreamline(streamlineA,validity_A,streamlineB,validity_B,strightLine,validity_Straight,closestPoint_A,closestPoint_B,preference,bestSl):
        finalDesicion = []

        if validity_A == "valid" and validity_B == "invalid":
            finalDesicion = streamlineA
            
        elif validity_A == "invalid" and validity_B == "valid":
            finalDesicion = streamlineB
            
        elif validity_A == "valid" and validity_B == "valid":
            
            finalDesicion = EV_AccessPoint.CompareStreamlineCloseToNode(streamlineA,streamlineB,closestPoint_A,closestPoint_B)
        
         
        elif validity_A == "invalid" and validity_B == "invalid":
            
            if preference == "straight":   
                if validity_Straight == "valid":
                    finalDesicion = strightLine
                elif validity_Straight == "invalid":
                    finalDesicion = bestSl
                    
            elif preference == "bcrv":
                 finalDesicion = bestSl
            
        return [finalDesicion]
        
    
    
    ###########################
    ####     PreView       ####
    ###########################
    @staticmethod 
    def PreviewNodeInfo(nodes):
        anchors=[]
        edgeLabel=[]
        normals=[]

        for node in nodes:
            anchors.append(node.geometry)
            edgeLabel.append(node.edgeIndex)
            normals.append(node.normal)

        return anchors,edgeLabel,normals
# ---------- end ghpython_script_9 ----------
panel_7 = Panel(ghpython_script_4.out)
min_area = Slider(10000, range=5000..60000)

# ----
# Need to match the number of vertices.
# Either clockwise or anticlockwise is fine as long as they match.
panel_8 = Panel("99,98,97,96")

# ----
# 0：prefer N-S
# 1：prefer W-E
idealorientation = Slider(0, range=0..1)

# ----
# Open to users
# Weight
# score_Divergence,
# score_Continuity,
# score_Singularity,
# score_EvenArea,
# score_Elongation,
# score_Compactness,
# score_Convexity
# score_Orientation
gene_pool = GenePool(Decimals=1, Maximum=1, Minimum=0, Value=[0.1, 0.1, 0.8, 0.8, 0.5, 1, 0.5, 0.8])

# ----
# first%
# second%
# third%
road_percentage = Panel("""0.1
0.4
0.5""")

pointay = GetNumber("150939.35299853625", AtLeast=1, AtMost=1, Maximum=1.797693135e+308, Minimum=-1.797693135e+308, TreeAccess=False)
pointbx = GetNumber("11570196.371628454", AtLeast=1, AtMost=1, Maximum=1.797693135e+308, Minimum=-1.797693135e+308, TreeAccess=False)
pointax = GetNumber("11570201.782766964", AtLeast=1, AtMost=1, Maximum=1.797693135e+308, Minimum=-1.797693135e+308, TreeAccess=False)
minarea = GetInteger(min_area, AtLeast=1, AtMost=1, Maximum=2147483647, Minimum=-2147483648, TreeAccess=False)
orientation = GetNumber(idealorientation, AtLeast=1, AtMost=1, Maximum=1.797693135e+308, Minimum=-1.797693135e+308, TreeAccess=False)
weights = GetNumber(gene_pool, AtLeast=1, AtMost=1, Maximum=1.797693135e+308, Minimum=-1.797693135e+308, TreeAccess=False)
roads = GetNumber(road_percentage, AtLeast=1, AtMost=1, Maximum=1.797693135e+308, Minimum=-1.797693135e+308, TreeAccess=False)
pointby = GetNumber("150734.29595800838", AtLeast=1, AtMost=1, Maximum=1.797693135e+308, Minimum=-1.797693135e+308, TreeAccess=False)
edgecat = GetString(panel_8, AtLeast=1, AtMost=1, TreeAccess=False)
coords = GetString(panel_6, AtLeast=1, AtMost=1, TreeAccess=False)

# ----
# GIS_INPUT
ghpython_script_10 = GhPythonScript(input_string=coords)  # -> out, inputPolyline
# ---------- ghpython_script_10: Python ----------
import Rhino.Geometry as rg
#import Rhino.RhinoDoc as rd
import Rhino.RhinoMath as rm

# Added by Anna vvv
x_val = []
y_val = []
inputGIS = []
items = input_string.split(',')

for i in range(len(items)):
    if i%2 == 0:
        x_val.append(float(items[i]))
    else:
        y_val.append(float(items[i]))

for i in range(len(x_val)):
    inputGIS.append([x_val[i], y_val[i]])
# Added by Anna ^^^

"""
inputGIS = [ [11572150.257125726,150540.92751019588],
          [11572293.031019911,150415.32117484743],
          [11572368.605708903,150244.4983472939],
          [11571811.542666271,149810.67580068656],
          [11571493.165541334,150216.41114526242],
          [11571905.981938206,150348.29488085952],
          [11572150.257125726,150540.92751019588]]
"""

inputVertices = []

for list in inputGIS:
    inputVertices.append(rg.Point3d(list[0],list[1],0))

inputPolyline = [rg.Polyline(inputVertices)]
# ---------- end ghpython_script_10 ----------
construct_point = ConstructPoint(XCoordinate=pointbx, YCoordinate=pointby, ZCoordinate=0)
construct_point_2 = ConstructPoint(XCoordinate=pointax, YCoordinate=pointay, ZCoordinate=0)

ghpython_script_11 = GhPythonScript(input_string=edgecat)  # -> out, catList
# ---------- ghpython_script_11: Python ----------
__author__ = "Anna Yenardi"
__version__ = "2023.03.30"

import rhinoscriptsyntax as rs
catList = input_string.split(',')
# ---------- end ghpython_script_11 ----------

# ----
# For WebAPP
# Move to Origin and Scale
ghpython_script_12 = GhPythonScript(
    EV=ghpython_script_4.EV,
    WebApp_Func=ghpython_script_5.WebApp_Func,
    inputPolyline=ghpython_script_10.inputPolyline,
    userInput_A=construct_point_2,
    userInput_B=construct_point)  # -> out, inputPolyline_New, userInputPair, scale, sourceCenter; inputs inputPolyline: Polyline, userInput_A: Point3d, userInput_B: Point3d
# ---------- ghpython_script_12: Python ----------
import Rhino.Geometry as rg
import Rhino.RhinoDoc as rd
import Rhino.RhinoMath as rm
import ghpythonlib.components as ghc
import math

### Prepare
closestPoint_A_t = inputPolyline.ClosestParameter(userInput_A)
closestPoint_B_t = inputPolyline.ClosestParameter (userInput_B)

Xs = []
Ys =[]
for i in range(len(inputPolyline)):
    Xs.append(inputPolyline[i].X)
    Ys.append(inputPolyline[i].Y)

maxPt = rg.Point3d(max(Xs),max(Ys),0)
minPt = rg.Point3d(min(Xs),min(Ys),0)


obbFlat = rg.Rectangle3d(rg.Plane.WorldXY,maxPt,minPt)
#obb = EV.GetOBB(inputPolyline.ToPolylineCurve(),5)
area = obbFlat.Area
scale = math.sqrt(area/10000)
print area

### move to origin
sourceCenter = rg.AreaMassProperties.Compute(inputPolyline.ToPolylineCurve()).Centroid
inputPolyline_New = WebApp_Func.RelocateGeoToOrigin(inputPolyline,sourceCenter)   

### scale to 100x100
sourceCenter_New = rg.AreaMassProperties.Compute(inputPolyline_New.ToPolylineCurve()).Centroid
transform = rg.Transform.Scale(sourceCenter_New,1/scale)
inputPolyline_New.Transform(transform)

userInput_A_New = inputPolyline_New.PointAt(closestPoint_A_t)
userInput_B_New = inputPolyline_New.PointAt(closestPoint_B_t)

userInputPair = [userInput_A_New,userInput_B_New]     # output
inputPolyline_New = [inputPolyline_New] # output
# ---------- end ghpython_script_12 ----------

panel_9 = Panel(ghpython_script_12.out)

get_90_degree_fixed = Slider(0.5, range=0..1)
# Dont open to users
minorientation = Slider(0.5, range=0..10)
pi = Pi(Factor=get_90_degree_fixed)
multiplication = Multiplication(A=minorientation, B=pi)

mincompactness = Slider(0.4, range=0..10)
min_elongation = Slider(8, range=0..10)
minconvexity = Slider(0.4, range=0..10)

max_depth = Slider(15, range=0..100)
issurance = Slider(500, range=0..1000)

# ----
# EvenArea
# Elongation
# Compactness
# Convexity
# Orientation
movedist = Slider(80, range=0..500)
populatenum = Slider(40, range=0..100)
idealelongation = Slider(1.5, range=0..10)
idealcompactness = Slider(1, range=0..10)
idealconvexity = Slider(1, range=0..10)
idealorientation_2 = Slider(1, range=0..10)
gene_pool_2 = GenePool(Decimals=2, Maximum=2, Minimum=0, Value=[0.59, 0.05, 0.27, 0.47, 0])

# ----
# For WebAPP
# Scale the minArea
ghpython_script_13 = GhPythonScript(minArea=minarea, scale=ghpython_script_12.scale)  # -> out, minArea
# ---------- ghpython_script_13: Python ----------
minArea = minArea/(scale**2)
# ---------- end ghpython_script_13 ----------

resolution = Slider(5, range=0..10)

# ----
# Dont open to users
# co_Divergence,
# co_Continuity,
# co_Singularity,
# co_EvenArea,
# co_Elongation,
# co_Compactness,
# co_Convexity
# co_Orientation
# Coefficient
gene_pool_3 = GenePool(Decimals=2, Maximum=5, Minimum=0, Value=[0, 0.8, 0.8, 1.2, 1.2, 1, 1, 3])

curve = Curve(ghpython_script_12.inputPolyline_New)
areatoleranceslider = Slider(0.7, range=0..1)
ghpython_script_14 = GhPythonScript(
    PC=ghpython_script.PC,
    DM=ghpython_script_2.DM,
    SLG=ghpython_script_3.SLG,
    EV=ghpython_script_4.EV,
    EV_AccessPoint=ghpython_script_9.EV_AccessPoint,
    resolution=resolution,
    inputPolyline=curve,
    userInputPair=ghpython_script_12.userInputPair,
    moveDist=movedist,
    populateNum=populatenum,
    idealElongation=idealelongation,
    idealCompactness=idealcompactness,
    idealConvexity=idealconvexity,
    idealOrientation=idealorientation_2,
    weight=gene_pool_2)  # -> out, Initialize_nodes, nodes, segments, Try_Compute_streamline, streamlineA, validity_A, streamlineB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; inputs inputPolyline: Polyline, divNum: Int32, userInputPair: list of Point3d, weight: list
# ---------- ghpython_script_14: Python ----------
import Rhino.Geometry as rg
import Rhino.RhinoDoc as rd
import Rhino.RhinoMath as rm

toggle_A = False
### Sort the input order
EV_AccessPoint.EnsureCounterClockwise(inputPolyline)

### Initialize nodes
#segments = inputPolyline.GetSegments()
#nodes = EV_AccessPoint.InitializeNodes(inputPolyline,segments,divNum)
#EV_AccessPoint.CheckNodesNormal(nodes,inputPolyline)

### Try Compute streamline
processMesh = PC.ProcessMesh()
processMesh.InitializeInput(inputPolyline,resolution)  

mappingGrid = DM.MappingGrid()
mappingGrid.CreateMappingGrid(inputPolyline,20,5)  #rows,columns 
mappingGrid.GetOverlappedTriangleIndex(processMesh,2)  #detectRadius 


seedpointList = SLG.SeedpointList()
seedpointList.CreateSeedpointList(processMesh,1,1)  #reduce points onEdge, on MA

streamlineNetwork=SLG.StreamlineNetwork()

closestPoint_A = inputPolyline.ClosestPoint (userInputPair[0])
closestPoint_B = inputPolyline.ClosestPoint (userInputPair[1])

dL=2
streamlineA = streamlineNetwork.GetStreamlineOnSpecificPoint(closestPoint_A,mappingGrid,processMesh,dL)
streamlineB = streamlineNetwork.GetStreamlineOnSpecificPoint(closestPoint_B,mappingGrid,processMesh,dL)


### Detect Location 
validity_A = EV_AccessPoint.CheckStreamLineValidity (PC,inputPolyline,streamlineA,closestPoint_A,closestPoint_B)
validity_B = EV_AccessPoint.CheckStreamLineValidity (PC,inputPolyline,streamlineB,closestPoint_A,closestPoint_B)

### Connect point to get a straight line 
strightLine = rg.Line(closestPoint_A,closestPoint_B)

### Check if straight line valid
validity_Straight = EV_AccessPoint.CheckStrightLineValidity(strightLine,inputPolyline)

### Check if the user is satisfied with this straight line
 
### Create A detect Region and Populate random points to form BezierCrvs
detectRegion = EV_AccessPoint.GetDetectRegion(strightLine,moveDist)
bCurveList_Valid = EV_AccessPoint.GetBezierCrvOptions(detectRegion,inputPolyline,closestPoint_A,closestPoint_B,populateNum)

### Evaluate streamline Parcel Level Score
scoreResult = EV.Score_ParcelLevel(bCurveList_Valid,inputPolyline,idealElongation,idealCompactness,idealConvexity,idealOrientation)
score_EvenArea = scoreResult[0]
score_Elongation = scoreResult[1]
score_Compactness = scoreResult[2]
score_Convexity = scoreResult[3]
score_Orientation = scoreResult[4]

elongationPairCollection = scoreResult[5]
areaPairCollection = scoreResult[6]
convexityPairCollection  = scoreResult[7]
compactnessPairCollection = scoreResult[8]
orientationPairCollection = scoreResult[9]

### Remap the scores 
score_EvenArea = EV.RemapRange(score_EvenArea,1,0)
score_Elongation = EV.RemapRange(score_Elongation,1,0)
score_Compactness = EV.RemapRange(score_Compactness,1,0)
score_Convexity = EV.RemapRange(score_Convexity,1,0)
score_Orientation = EV.RemapRange(score_Orientation,1,0) 
score_Overall = EV.GetScore_ParcelLevel(score_EvenArea,score_Elongation,score_Compactness,score_Convexity,score_Orientation,weight)

### Store in instances
sls = EV_AccessPoint.InitializeSplitlines(bCurveList_Valid,score_EvenArea,score_Elongation,score_Compactness,score_Convexity,score_Orientation,score_Overall,elongationPairCollection,areaPairCollection,convexityPairCollection,compactnessPairCollection,orientationPairCollection)

### Select the best
bestSl = EV_AccessPoint.SelectBestSplitline(sls)
bestSl = EV_AccessPoint.ConvertNurbcurveToPolyline(bestSl,10)

### Do the desicion and pass to next step
finalDesicion = EV_AccessPoint.DecideFinalStreamline(streamlineA,validity_A,streamlineB,validity_B,strightLine,validity_Straight,closestPoint_A,closestPoint_B,"bcrv",bestSl)

### Preview
#anchors,edgeLabel,normals = EV_AccessPoint.PreviewNodeInfo(nodes)
closestPoint_A=closestPoint_A
closestPoint_B=closestPoint_B


### Check If need to reverse finalDesicion

startPt = finalDesicion[0].First
endPt = finalDesicion[0].Last

startPt_Close = finalDesicion[0].ClosestPoint(startPt)
endPt_Close = finalDesicion[0].ClosestPoint(endPt)

startDistances = []
endDistances = []

for edge in inputPolyline.GetSegments ():
    startDistances.append(edge.DistanceTo(startPt_Close,True))
    endDistances.append(edge.DistanceTo(endPt_Close,True))

startIndex = startDistances.index(min(startDistances))
endIndex = endDistances.index(min(endDistances))

#print startIndex,endIndex
if startIndex<endIndex:
    pass
else:
    newPts = []
    for i in range(len(finalDesicion[0])):
        newPts.append(finalDesicion[0][i])
    newPts.reverse()
    finalDesicion = [rg.Polyline(newPts)]
    
    
newedges = PC.ProcessMesh.GetNewEdges(inputPolyline)

toggle_A = True
# ---------- end ghpython_script_14 ----------

# ----
# Pass the Desicion
geometry = Geometry(ghpython_script_14.finalDesicion)

ghpython_script_15 = GhPythonScript(
    PC=ghpython_script.PC,
    DM=ghpython_script_2.DM,
    SLG=ghpython_script_3.SLG,
    SPF=ghpython_script_7.SPF,
    PL=ghpython_script_6.PL,
    EV=ghpython_script_4.EV,
    crv=curve,
    hierarchy=ghpython_script_11.catList,
    toggle_A=ghpython_script_14.toggle_A,
    finalDesicion=geometry,
    resolution=resolution,
    minArea=ghpython_script_13.minArea,
    minElongation=min_elongation,
    minConvexity=minconvexity,
    minCompactness=mincompactness,
    minOrientation=multiplication,
    maxDepth=max_depth,
    maxIssurance=issurance,
    idealOrientation=orientation,
    weight=weights,
    coefficient=gene_pool_3,
    areaTolerance=areatoleranceslider)  # -> out, parcels, toggle_B, Collection_Space, p0, collection_VP, collection_E, collection_F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; inputs crv: Polyline, hierarchy: list, toggle_A: Boolean, finalDesicion: list of Polyline, maxDepth: Int32, maxIssurance: Int32, weight: list, coefficient: list
# ---------- ghpython_script_15: Python ----------
import Rhino.Geometry as rg
import Rhino.RhinoDoc as rd
import Rhino.RhinoMath as rm
import Rhino.RhinoApp as ra

import scriptcontext
from collections import deque 

import Queue
import math

import gc
gc.collect()

if toggle_A == True:
    toggle_B = False
    ##################
    ######Remap area
    ##################
    
    
    ##################
    ######Store for debug
    ##################
    parcels=[]
    streamlines = []
    
    
    ##################
    ######Create Tree
    ##################
    
    
    tol = 0.001
    # Initialize Collection Space (for Vertex&Point,Edge,Face)
    collection_VP= [] 
    collection_E= [] 
    collection_F= [] 
    
    # For redirection
    redirectMap = {}
    
    # Initialize Root
    
    
    p0 = PL.ParcFace()
    p0.FormParcFace_First(crv,hierarchy)
    p0.name = 0
    p0.depth=0
    
    
    
    # Create Global Dict
    VP_Dict_L0 = {}
    VP_Istance_L0 =p0.GetVPInstance()
    for instance in VP_Istance_L0:
        VP_Dict_L0[instance.ID] = instance
        
    E_Dict_L0 = {}
    E_Istance_L0 = p0.GetEInstance()
    for instance in E_Istance_L0:
        E_Dict_L0[instance.ID] = instance
        
    # store into collection
    currQ = [p0]
    
    
    
    collection_VP.append(VP_Dict_L0)
    collection_E.append(E_Dict_L0)
    collection_F.append(currQ)
    
    
    ##### Start Loop
    ### Prepare 
    
    issurance = 0
    lastDepth = 0
    currDepth = 0
    currVP_Dict = SPF.GetDeepCopyDict_VP(currQ)
    currE_Dict = SPF.GetDeepCopyDict_E(currQ,currVP_Dict,collection_E)
    currQ = SPF.GetDeepCopyParcFace_Q(currQ,currVP_Dict,currE_Dict,redirectMap)
    
    #print ("【【【【【【【【【【【【【【--- Moving to next depth %d---】】】】】】】】】】】】】】】】" %currDepth)
    #ra.WriteLine("【【【【【【【【【【【【【【--- Moving to next depth %d---】】】】】】】】】】】】】】】】" %currDepth)
    
    ### append when it end/ or finish this depth
    # collection_VP.append(currVP_Dict)
    # collection_E.append(currE_Dict)
    # collection_F.append(currQ)
    
    #maxDepth = 10
    while currQ[0].depth <= maxDepth:
    #iterationTime = 6
    #for time in range(iterationTime):
        #region Stop Condition Checking 
        ######################################
        #####  Stop Condition Checking   #####
        ######################################
        if issurance > maxIssurance:
            #print ("End: Hit max issurance")
            #ra.WriteLine("End: Hit max issurance")
            break
        
        #if scriptcontext.escape_test(False):
        #    print ("ESC pressed ")
        #    break 
        
        allDeadTag = SPF.CheckIfAllNodesDead(currQ)
        if allDeadTag == True:
            #print ("End: All nodes are dead")
            break
        #endregion
        
        #region Important address checking
        ######################################
        ##### Important address checking #####
        ######################################
        
    #    print ("Important address checking")
    #    
    #    Echecktag = SPF.CheckIfEdgeCorrect(currQ,currE_Dict)
    #    if Echecktag==False:
    #        print ("CurrQ Edge and Edict are same: No")
    #        break
    #    else:
    #        print ("CurrQ Edge and Edict are same")
    #        
    #    PcheckTag = SPF. CheckIfCurrQNeighborsInCurrQ(currQ)
    #    if PcheckTag ==False:
    #        print ("CurrQ Neighbors are In CurrQ: No")
    #        break
    #    else:
    #        print ("CurrQ Neighbors are In CurrQ")
    #        
    #    PEEPCheckTag = SPF.CheckIfP_EAndE_PCorrect(currQ)
    #    
    #    if PEEPCheckTag ==False:
    #        print ("CurrQ P_E And E_P are correct: No")
    #        print ("quit because of PEEPCheckTag")
    #        break
    #    else:
    #        print ("CurrQ P_E And E_P are correct")
        #endregion    
    
        #region Status info checking    
        ######################################
        #####     Status info checking   #####
        ######################################
    #    print ("Status info checking ")
    #    print ("All nodes in tree"),
    #    SPF.PrintAllNodesAddress(p0)
    #    
    #    print ("curr nodes depth"), 
    #    SPF.CheckCurrQDepth(currQ)
    #    
    #    print ("curr nodes alive"),
    #    SPF.CheckCurrQAlives(currQ)
    #    
    #    print ("RedirectMap"),
    #    SPF.PrintDictionaryAddress(redirectMap)
        #endregion 
    
        #region Check If need Collection and DeepCopy  
        #####################################################
        #####   Check If need Collection and DeepCopy   #####
        #####################################################
        currNode = currQ[0]
        #print ("CurrNode.depth"),currNode.depth ,("CurrNode address"),id(currNode)
        currDepth=max(currDepth,currNode.depth)
        
        if lastDepth != currDepth:
            #print ("【【【【【【【【【【【【【【--- Moving to next depth %d---】】】】】】】】】】】】】】】】" %currDepth)
            #ra.WriteLine("【【【【【【【【【【【【【【--- Moving to next depth %d---】】】】】】】】】】】】】】】】" %currDepth)
            #SPF.PrintCurrQAddress(currQ)
            
            #ra.WriteLine("RedirectParentChildren")
            SPF.RedirectParentChildren(currQ,redirectMap)
            
            #ra.WriteLine("FindTheBottomElements_LevelOrder_Q")
            currQ = SPF.FindTheBottomElements_LevelOrder_Q(p0)
            collection_VP.append(currVP_Dict)
            collection_E.append(currE_Dict)
            collection_F.append(currQ)
    
            ### New Instances for next depth
            currVP_Dict = SPF.GetDeepCopyDict_VP(currQ)
            currE_Dict = SPF.GetDeepCopyDict_E(currQ,currVP_Dict,collection_E)
    
    
            currQ = SPF.GetDeepCopyParcFace_Q(currQ,currVP_Dict,currE_Dict,redirectMap)  # new Instance
            
            ### remember update the currNode
            currNode = currQ[0]
    
            SPF.RedirectNeighbors(currQ,currE_Dict,redirectMap)
    
            ### Update the depth 
            lastDepth = currDepth
            
            ### Speed Up
            SPF.KillNodesInAdvance(currQ,minArea)
            
        #endregion 
        
        #region TryStreamline
        ##########################
        #####TryStreamline########
        ##########################
        if finalDesicion == []:     ### accessPt create a streamline
            if currNode.situation==0:
                if currNode.alive == True:
                    currentWeight=SPF.GetCurrentWeight(weight,coefficient,currDepth)
                    #ra.WriteLine("StoreStreamlines")
                    newTriangleSize = SPF.StoreStreamlines(PC,DM,SLG,EV,currNode,weight,None,idealOrientation,resolution)
                    #print ("length of sortedSL:"),len(currNode.sortedSL)
                    
                    ### for preview , show the streamline network
                    #for sl in currNode.sortedSL:
                        #streamlines.append(sl.GetGeometry())
                    #ra.WriteLine("TryStreamlineOptions")
                    streamline = SPF.TryStreamlineOptions(currNode,minArea,minElongation,minConvexity,minCompactness,areaTolerance)
                
                else:
                    if currNode.alive == False:  ### just skip the caculation
                        streamline = None
                        
                if streamline ==None:
                    #Fail and pop  
                    #currNode.alive = False
                    currQ.popleft()
                    
                    ### Important, Since this node fail to split
                    ### In order to move it to root and dont conflict with the exsiting 
                    ### Copy a new one
                    newCurrNode = currNode.DeepCopy(currVP_Dict,currE_Dict)
                    newCurrNode.alive = False    ### to avoid depth+2
                    newCurrNode.depth+=1
                    #print ("the old working node, "),id(currNode), ("copy to a new node "),id(newCurrNode)
                    #print ("shitttt!!!!!!!!!!") ,currNode.depth, id(currNode),currNode.alive
                    
                    ### After Copying a new one, we need to make the new node replace the old one in their neighbors position
                    ### Mainly check "neighbors","mutualE_P","mutualP_E"
                    for node in currQ:
                        if currNode in node.neighbors:
                            ### update neighbors info
                            node.neighbors.remove(currNode)
                            node.neighbors.append(newCurrNode)
                            
                            ### update neighbors info
                            popParcFace = currNode
                            popEdge = node.mutualP_E[currNode]   ### will still keep it
    
                            ### Remove
                            
                            node.mutualE_P.pop(popEdge)             
                            node.mutualP_E.pop(popParcFace)
                            
                            ### Add it back
                            node.mutualE_P[popEdge] = newCurrNode
                            node.mutualP_E[newCurrNode] = popEdge
    
                    currQ.append(newCurrNode)
                    
                    
                    #edgeIds_debug = []
                    #for edge in newCurrNode.edges:
                        #edgeIds_debug.append(edge.ID)
                    #print (edgeIds_debug)
                    #print ("abondoned node address:"), id(currNode)
                    #print ("abondoned node's neighbor address:"), SPF.PrintCurrNodeNeighbors(currNode)
                    #print ("new node address:"), id(newCurrNode)
                    #print ("new node's neighbor address:"), SPF.PrintCurrNodeNeighbors(newCurrNode)
                            
            elif currNode.situation==1:    
                #streamlines store inside, return the used triangleSize 
                #ra.WriteLine("StoreStreamlines")
                newTriangleSize = SPF.StoreStreamlines(PC,DM,SLG,EV,currNode,None,currNode.startPt.geometry,idealOrientation,resolution)
                #ra.WriteLine("TrySpecificStreamline")
                streamline = SPF.TrySpecificStreamline(EV,currNode,minArea,minElongation,minConvexity,minCompactness,areaTolerance)
    
                
                if streamline == None:
                    #dont pop here , give another chance
                    currNode.situation=0
                
                else:
                    pass
                
        elif finalDesicion!= []:
            ### select streamline
            newTriangleSize = resolution
            streamline = SLG.Streamline()
            streamline.CreateStreamlineInstance(finalDesicion[0])
            finalDesicion.pop(0)
    
            
            
        
        #endregion
        
        #region Split it with streamline
        #####################################
        ##### Split it with streamline ######
        #####################################
    
        if streamline != None:    
            if currNode.situation == 0 :
                # store the final chosen streamline into this instance
                currNode.chosenSL = streamline
                
                #ra.WriteLine("DetectLocation")
                startEdge,endEdge,startEdgeIndex,endEdgeIndex,startSplitPointPair,endSplitPointPair,flag =SPF.DetectLocation(currNode,streamline)
                
                #print "startEdge,endEdge,startEdgeIndex,endEdgeIndex"
                #print startEdge,endEdge,startEdgeIndex,endEdgeIndex
                    
                ##### SplitParcFace : Normal Case and Speical Case
                #ra.WriteLine("GetNewShare")
                shareResult = SPF.GetNewShare(PL,currNode,streamline,currVP_Dict,currE_Dict,startEdge,endEdge)
                shareEdge = shareResult[0]
                shareEdge_twin = shareResult[1]
          
                ### for Normal case
                if startEdge != endEdge:
                    ### split the parcFace and return the new split edges
                    #ra.WriteLine("ConstructNewParcel_Normal")
                    splitResult = SPF.ConstructNewParcel_Normal(PL,currNode,currVP_Dict,currE_Dict,shareEdge,shareEdge_twin,startEdge,endEdge,startEdgeIndex,endEdgeIndex,startSplitPointPair,endSplitPointPair)
                    splitEdges_Start = splitResult[2]
                    splitEdges_End = splitResult[3]
                    
                    ### Insert into tree and redirect the parent-children based on redirectMap
                    #ra.WriteLine("InsertValue")
                    SPF.InsertValue(splitResult,newTriangleSize,currQ)
                    #SPF.RedirectParentChildren(currQ,redirectMap)
    
                    ### Check affected parcFace, the affected Edge(twin edge) will be split
                    #if currNode.neighbors!=[]:
                        #print currNode.neighbors
                        
                        #neighbor  = currNode.neighbors[0]
                        #print "thisNeighbor: " ,neighbor, id(neighbor)
                        #print  "thisNode: ",currNode, id(currNode)
                        #print neighbor.mutualP_E
                        #print currNode.mutualP_E
                    
                    
                    #SPF.PrintAllNodesAddress(p0)
                    #ra.WriteLine("GetAffectedParcFace")
                    start_PF,end_PF = SPF.GetAffectedParcFace(currNode,startEdge,endEdge,p0,collection_F,currQ,redirectMap) 
                    #print ("start_PF,end_PF"),start_PF,end_PF
                    if start_PF!= None:
                        start_PF.startPt = shareEdge.startVertex
                        #SPF.StoreAffectedPoint(start_PF,streamline)
                        affectedEdge = startEdge
                        #ra.WriteLine("start_PF.UpdateAffectedInfo_Normal")
                        start_PF.UpdateAffectedInfo_Normal(shareEdge,affectedEdge,splitEdges_Start,currE_Dict,"start")
                        
                    
                    if end_PF!= None:
                        end_PF.startPt = shareEdge.endVertex
                        #SPF.StoreAffectedPoint(end_PF,streamline)
                        affectedEdge = endEdge
                        #ra.WriteLine("end_PF.UpdateAffectedInfo_Normal")
                        end_PF.UpdateAffectedInfo_Normal(shareEdge,affectedEdge,splitEdges_End,currE_Dict,"end")
                    
    
                        
                    ### Check Neighbors info by mutual edge, this must be conducted after inserting new edges for the affected parcFace
    
                    #if currNode.neighbors!=[]:
                        #print ("currNode,"),(id(currNode)), "'s neighbor is: " ,id(currNode.neighbors[0])
                        
                    #if currNode.parent!=None and currNode.parent.neighbors!=[]:
                        #print ("currNode's parent,"),(id(currNode.parent)), "'s neighbor is: " ,id(currNode.parent.neighbors[0]) 
                        
                    #print ("!!!!!!!!!!!!!!!!!!!!!!!!!!!!!!!!!!!!!!!!!!!!!!!!!!!!!!!Before")    
                    #SPF.TraversePrintNeighbor(p0)
                    parentNeighbor = currNode.neighbors
                    for pneighbor in parentNeighbor:
                        #ra.WriteLine("CheckNeighbor")
                        SPF.CheckNeighbor(splitResult[0],pneighbor)
                        SPF.CheckNeighbor(splitResult[1],pneighbor)
    
                    #print ("!!!!!!!!!!!!!!!!!!!!!!!!!!!!!!!!!!!!!!!!!!!!!!!!!!!!!!!After")    
                    #SPF.TraversePrintNeighbor(p0)
                    #print ("splitResult[0],"),(id(splitResult[0])), "'s neighbor is: " ,id(splitResult[0].neighbors[0])
                    #print ("splitResult[1],"),(id(splitResult[1])), "'s neighbor is: " ,id(splitResult[1].neighbors[0])
                     
                ### for Special case
                if startEdge == endEdge:
                    ### split the parcFace and return the new split edges
                    
                    splitResult = SPF.ConstructNewParcel_Special(PL,currNode,currVP_Dict,currE_Dict,shareEdge,shareEdge_twin,startEdge,endEdge,startEdgeIndex,endEdgeIndex,startSplitPointPair,endSplitPointPair)
                    splitEdges_Special= splitResult[2]
                    
                    ### Insert into tree and redirect the parent-children based on redirectMap
                    SPF.InsertValue(splitResult,newTriangleSize,currQ)
                    
                    
                    #SPF.RedirectParentChildren(currQ,redirectMap)
                    
                    
                    
                    ### Check affected parcFace, the affected Edge(twin edge) will be split
                    start_PF,end_PF = SPF.GetAffectedParcFace(currNode,startEdge,endEdge,p0,collection_F,currQ,redirectMap) 
                    
                    # its same as end PF so we only do it once
                    if start_PF!= None:
                        
                        start_PF.situation = 0   ### dont bother , just take it as normal case
                        affectedEdge = startEdge
                        start_PF.UpdateAffectedInfo_Special(shareEdge,affectedEdge,splitEdges_Special,startSplitPointPair,endSplitPointPair,currE_Dict)
                        
                        ### Check Neighbors info by mutual edge, this must be conducted after inserting new edges for the affected parcFace
                        parentNeighbor = currNode.neighbors
                        for pneighbor in parentNeighbor:
                            SPF.CheckNeighbor(splitResult[0],pneighbor)
                            SPF.CheckNeighbor(splitResult[1],pneighbor)
    
                
            
            elif currNode.situation == 1 :
                #ra.WriteLine("SPF.GetNewShare_Constrained")
                shareResult = SPF.GetNewShare_Constrained(PL,currNode,streamline,currVP_Dict,currE_Dict)
                shareEdge = shareResult[0]
                shareEdge_twin = shareResult[1]
                endEdge,endEdgeIndex,endSplitPointPair = SPF.DetectLocation_Constrained(currNode,streamline)
                
                #ra.WriteLine("SPF.GetStartPtInfo")
                startIndexPair = SPF.GetStartPtInfo(currNode)
    
                if endEdge.generation == "Naked":
                    shareEdge.endVertex.onBoundary = True  ### pending to relocate
                    splitResult = endEdge.SplitEdge_Naked_Normal(shareEdge,shareEdge.endVertex,currE_Dict,currVP_Dict)
                    subEdge_End_0 = splitResult[0]
                    subEdge_End_1 = splitResult[1]
                    splitEdges_End = [subEdge_End_0,subEdge_End_1]
                    chosenNewEdges = [subEdge_End_0,subEdge_End_1]
                
                elif endEdge.generation != "Naked":
                    splitResult = endEdge.SplitEdge_Shared_Normal(shareEdge,shareEdge.endVertex,currE_Dict,currVP_Dict,endSplitPointPair)
                    subEdge_End_a = splitResult[0]
                    subEdge_End_a_twin = splitResult[1]
                    subEdge_End_b = splitResult[2]
                    subEdge_End_b_twin = splitResult[3]
                    splitEdges_End = [subEdge_End_a,subEdge_End_a_twin,subEdge_End_b, subEdge_End_b_twin]
                    chosenNewEdges = [subEdge_End_a,subEdge_End_b]
                    
                splitResult = SPF.Construct_Constrained(PL,currNode,startIndexPair,endEdgeIndex,shareEdge,shareEdge_twin,chosenNewEdges)
                ### Insert into tree and redirect the parent-children based on redirectMap
                SPF.InsertValue(splitResult,newTriangleSize,currQ)
                #SPF.RedirectParentChildren(currQ,redirectMap)
        
                ### Check affected parcFace, the affected Edge(twin edge) will be split, in this case , only endPF
                end_PF = SPF.GetAffectedParcFace_Constrained(currNode,endEdge,p0 ,collection_F,currQ,redirectMap)
                
                if end_PF!= None:
                    end_PF.startPt = shareEdge.endVertex
                    affectedEdge = endEdge
                    #print endSplitPointPair
                    #print "endEdge"
                    #all = endEdge.GetVPInstance()
                    #for v in all:
                        #print v.geometry.X,v.geometry.Y,0
                    
                    #print "streamline"
                    #for v in streamline.GetGeometry():
                        #print v.X,v.Y,0
                    #print splitEdges_End
                    end_PF.UpdateAffectedInfo_Normal(shareEdge,affectedEdge,splitEdges_End,currE_Dict,"end")
    
                ### Check Neighbors info by mutual edge, this must be conducted after inserting new edges for the affected parcFace
                parentNeighbor = currNode.neighbors
                for pneighbor in parentNeighbor:
                    SPF.CheckNeighbor(splitResult[0],pneighbor)
                    SPF.CheckNeighbor(splitResult[1],pneighbor)
    
            #print ("before RemoveInvalidNeighbor" )
            #print (" currQ:"), SPF.PrintCurrQAddress(currQ)
            SPF.RemoveInvalidNeighbor(currNode,currQ)
        #endregion
            
           
    
    
        #print ("Now, there are %d nodes in currQ  ") %len(currQ)
        #ra.WriteLine("Now, there are %d nodes in currQ " %len(currQ))
        
        
        #print ("********************************************************************************************************************************************")
        #print ("********************************************************************************************************************************************")
        #print ("********************************************************************************************************************************************")
    
        #Collect geometry
        parcels.append(splitResult[0].GetGeometry())  ###just for preview
        parcels.append(splitResult[1].GetGeometry())
        
        issurance+=1    
    
    
    
    
    #if currVP_Dict not in collection_VP:
    #    collection_VP.append(currVP_Dict)
    #
    #if currE_Dict not in collection_E:
    #    collection_E.append(currE_Dict)
    #
    #### Do something here for the case that the alogithm doesnt finish the whole depth, so we need to mannually add the node in currQ into Root Tree
    #allNodes = SPF.TraverseCollectAllNodes(p0)
    
    
    ################ because of the redirect parent ,need to change here, its doesnt work anymore
    ##if currQ[0].depth <= maxDepth:    ### in case we use Depth stop, before hit min Area
    #for node in currQ:
    #    #print ("node: "),id(node), ("node.parent: "),id(node.parent)
    #    #print ("In the end , In RedirectParentChildren:" ,id(node))
    #    #print ("before, this node's parent is :" ,id(node.parent))
    #    #print ("identity: "),node.identity
    #    if node.alive == False:
    #        if node.identity == "A":
    #            node.parent = node.parent.child_A
    #            
    #        if node.identity == "B":
    #            node.parent = node.parent.child_B
    #            
    #        if node.identity == "C":
    #            node.parent = node.parent.child_C
    #            
    #        #print ("after, this node's parent is :" ,id(node.parent))
    #        ### No Matter A or B , just attach to A    
    #        node.parent.child_C = node     
    #
    #    elif node.alive == True:
    #        node.parent  = redirectMap[node.parent]
    #        #rediect children
    #        
    #        if node.identity =="A":
    #            node.parent.child_A = node
    #        elif node.identity =="B":
    #            node.parent.child_B = node
    #
    ##print ("print node in root")
    #
    #
    #
    #bottomElements = SPF.FindTheBottomElements_LevelOrder(p0) 
    #bottomAddress = []
    #for node in bottomElements:
    #    bottomAddress.append(id(node))
    #    
    ##print ("bottom address Aagin: "),bottomAddress
    #
    #finalQ = SPF.FindTheBottomElements_LevelOrder_Q(p0)
    #if finalQ!=collection_F[-1]:
    #    collection_F.append(finalQ)
    
    # print ("last list of collection_F")
    # SPF.PrintCurrQAddress(collection_F[-1])
    # print ("finalQ")
    # SPF.PrintCurrQAddress(finalQ)
    
    
    # ##### PREVIEW #####
    pts_Curr = SPF.ShowCurrPts(currVP_Dict)[0]
    pts_indices_Curr = SPF.ShowCurrPts(currVP_Dict)[1]
    edges_Curr = SPF.ShowCurrEdge(currE_Dict)[0]
    edges_indices_Curr = SPF.ShowCurrEdge(currE_Dict)[1]
    # print (currQ[0]), "its neighbors: ",currQ[0].neighbors
    # print (currQ[1]), "its neighbors: ",currQ[1].neighbors
                
    
                    
                    
    #print ("End: Finish ")
    #ra.WriteLine("End: Finish")

    toggle_B = True
# ---------- end ghpython_script_15 ----------
panel_10 = Panel(ghpython_script_15.out)
panel_11 = Panel(ghpython_script_14.out)
minlength = Slider(30, range=0..100)

# ----
# firstWidth
# secondWidth
# thirdWidth
road_width = Panel("""26
18
0""")

# ----
# - Extract tree data
# 
# - For WebAPP,Move them back and Scale
# 
# - Store Dict
ghpython_script_16 = GhPythonScript(
    SPF=ghpython_script_7.SPF,
    PL=ghpython_script_6.PL,
    EV=ghpython_script_4.EV,
    PP=ghpython_script_8.PP,
    p0=ghpython_script_15.p0,
    toggle_B=ghpython_script_15.toggle_B,
    collection_VP=ghpython_script_15.collection_VP,
    collection_E=ghpython_script_15.collection_E,
    collection_F=ghpython_script_15.collection_F,
    WebApp_Func=ghpython_script_5.WebApp_Func,
    targetPoint=ghpython_script_12.sourceCenter,
    scale=ghpython_script_12.scale,
    roadPercentage=roads,
    roadWidth=road_width,
    minLength=minlength)  # -> out, turningPts, port, Debug, port_2, edges_Geo, edges_Hierarchy, port_3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; inputs toggle_B: Boolean, collection_VP: list, collection_E: list, collection_F: list, targetPoint: Point3d, roadPercentage: list, roadWidth: list
# ---------- ghpython_script_16: Python ----------
###########################
####    Import Libs    ####
###########################
import Rhino.Geometry as rg
#import Rhino.RhinoDoc as rd
import Rhino.RhinoMath as rm
import Rhino.RhinoApp as ra
import ghpythonlib.components as ghc
import ghpythonlib.treehelpers as th
import Rhino as rh
from collections import deque 
import Queue
import math

if toggle_B == True:
    #########################################################
    #################       Offset     ######################
    #########################################################
    wxy_plane=rg.Plane.WorldXY
    ZAxis=wxy_plane.ZAxis
    
    
    currQ = collection_F[-1]
    currEDict = collection_E[-1]
    
    ### assign offset
    
    
    PP.AssignRoadHierarchyAndOffsetDist(roadPercentage,roadWidth,currQ,currEDict,scale)
    
    
    #parcels_Offset_Origin = [PP.GetOffsetParcel_SimplifiedWithTurningPoints(thisNode) for thisNode in currQ]
    parcels_Offset_Origin = [PP.GetOffsetParcel(thisNode) for thisNode in currQ]
    parcels_Mb_Last_Before = parcels_Offset_Origin
        
    #########################################################
    #################  Move and Scale  ######################
    #########################################################
    
    ##### create A flat list of all geometry
    #### Geometry around (0,0,0)
    allNodes = SPF.TraverseCollectAllNodes(p0)
    parcels_Origin = [node.GetGeometry() for node in allNodes ]
    parcels_Origin_Last = [thisNode.GetGeometry() for thisNode in collection_F[-1]]
    
    #### Geometry moved back
    parcels_Mb_All = WebApp_Func.MoveFromOriginAndScaleAllParcels(parcels_Origin,targetPoint,scale)
    parcels_Mb_Last = WebApp_Func.MoveFromOriginAndScaleAllParcels(parcels_Origin_Last,targetPoint,scale)
    parcels_Offset_Mb_Last = WebApp_Func.MoveFromOriginAndScaleAllParcels(parcels_Offset_Origin,targetPoint,scale)
    
    #### Simpify Geometry 
    parcels_Mb_All = PP.SimplifyPolyCrvs(parcels_Mb_All)
    parcels_Mb_Last = PP.SimplifyPolyCrvs(parcels_Mb_Last)
    parcels_Offset_Mb_Last = PP.SimplifyPolyCrvs(parcels_Offset_Mb_Last)
    
    parcels_Mb_All = [PP.ConvertPolylineCurveToPolyline(polyCrv) for polyCrv in parcels_Mb_All]
    parcels_Mb_Last = [PP.ConvertPolylineCurveToPolyline(polyCrv) for polyCrv in parcels_Mb_Last]
    parcels_Offset_Mb_Last = [PP.ConvertPolylineCurveToPolyline(polyCrv) for polyCrv in parcels_Offset_Mb_Last]
    
    #### ConvertBack to Polyline Geometry 
    #########################################################
    #################  Convert to  Draco ####################
    #########################################################
    meshes = []
    ###Get the offset boundary
    wxy_Plane=rg.Plane.WorldXY
    tol = 0.001
    offsetCrvs = []
    
    meshDracos_Mb_All  = [WebApp_Func.DracoCompression_MoveZ(polyL) for polyL in parcels_Mb_All]
    meshDraco_Offset_Mb_Last = [WebApp_Func.DracoCompression_MoveZ(polyL) for polyL in parcels_Offset_Mb_Last]
    
    
    #########################################################
    #################  Store Dict        ####################
    #########################################################
    ##### assign a WebTreeID
    WebApp_Func.AssignWebTreeID(allNodes)
    ##### store info in to a dict
    treeDict = WebApp_Func.StoreInfoIntoDict(allNodes,meshDracos_Mb_All)
    
    
    
    
    ####################################################################
    #################  Store Info Sperately         ####################
    ####################################################################
    IDList,childrenList,parentList,depthList,dracoList = WebApp_Func.ExportToSperateDict(treeDict)
    childrenList = th.list_to_tree(childrenList)
    
    
    ####################################################################
    #################         Evaluation            ####################
    ####################################################################
    areaList_All,orientationList_All,elongationList_All,compactnessList_All,convexityList_All = WebApp_Func.GetEvaluationValueList(EV,parcels_Mb_All)
    areaList_Last,orientationList_Last,elongationList_Last,compactnessList_Last,convexityList_Last = WebApp_Func.GetEvaluationValueList(EV,parcels_Offset_Mb_Last)
    
    
    ####################################################################
    ####################################################################
    #################         Optimization            ##################
    ####################################################################
    ####################################################################
    
    ### Prepare
    collection = collection_F[-1]
    selectedParcFace = [parcel for parcel in collection]
    copiedParcFace,currVP_Dict,currE_Dict,redirectMap = PP.MakePartialCopy(selectedParcFace)
    PP.RedirectNeighbors_Temp(copiedParcFace,selectedParcFace,currE_Dict,redirectMap)
    PP.ArrangeParcelID(copiedParcFace)
    
    
    ### Clean Min edges
    minLength = minLength/scale
    targetEdges = PP.GetTargetEdgeFromDict(currE_Dict,minLength)
    targetEdges = PP.CleanTwinEdgeInTargetEdges(targetEdges)
    
    targetEdges = PP.CleanAdjacencyTargetEdges(targetEdges)      ### to avoid triangle
    targetEdges = PP.CleanPotentialTriangleCauses(targetEdges,copiedParcFace)  ### to avoid triangle
    
    #targetEdges_Geo = [edge.GetGeometry() for edge in targetEdges]
    PP.ReduceAllMinEdges(PL,copiedParcFace,targetEdges,currVP_Dict,currE_Dict)
    
    
    
    ### Turning Point
    turningPtCollection = PP.GetTurningPtInfoCollection(copiedParcFace,20)
    
    turningParcPts,turningParcFs = PP.ExtractTurningPtInfo(turningPtCollection)
    PP.ModifyAllTurningPointsWithNewType(PL,turningPtCollection,copiedParcFace,currVP_Dict,currE_Dict)
    turningPts = [parcPt.geometry for parcPt in turningParcPts]  ### preview
    
    parcels_Simplified = [thisNode.GetGeometry_SimplifiedWithTurningPoints() for thisNode in copiedParcFace]
    
    ### Offset
    
    parcels_Offset_Simplified = [PP.GetOffsetParcel_SimplifiedWithTurningPoints(thisNode) for thisNode in copiedParcFace]
    
    parcels_Offset_Simplified_Before = parcels_Offset_Simplified
    try:
        PP.FixOffsetDiscrepency(copiedParcFace,currE_Dict,parcels_Offset_Simplified_Before)
    except:
        print "FixOffsetDiscrepency failed"
        
    ### Output
    parcels_Offset_Simplified = WebApp_Func.MoveFromOriginAndScaleAllParcels(parcels_Offset_Simplified,targetPoint,scale)
    parcels_Offset_Simplified = PP.SimplifyPolyCrvs(parcels_Offset_Simplified)
    parcels_Offset_Simplified = [PP.ConvertPolylineCurveToPolyline(polyCrv) for polyCrv in parcels_Offset_Simplified]
    
    
    meshDraco_Offset_Simplified = [WebApp_Func.DracoCompression_MoveZ(polyL) for polyL in parcels_Offset_Simplified]
    areaList_Simplified,orientationList_Simplified,elongationList_Simplified,compactnessList_Simplified,convexityList_Simplified = WebApp_Func.GetEvaluationValueList(EV,parcels_Offset_Simplified)
    
    #########################################################
    ###############       edge Info      ####################
    #########################################################
    
    ### Before Offset
    edge_Geos_BeforeOffset = []
    edge_Info_BeforeOffset = []
    for parcF in copiedParcFace:
        for edge in parcF.edges:
            thisEdgeGeo = edge.GetGeometry_SimplifiedWithTurningPoints()
            thisEdgeGeo_Mb = WebApp_Func.MoveFromOriginAndScale(thisEdgeGeo,targetPoint,scale)
            edge_Geos_BeforeOffset.append(thisEdgeGeo_Mb)
            edge_Info_BeforeOffset.append(edge.hierarchy)
            
    edge_InfoByPacel_BeforeOffset = []
    for parcF in copiedParcFace:
        tempList = []
        for edge in parcF.edges:
            thisEdgeGeo = edge.GetGeometry_SimplifiedWithTurningPoints()
            thisEdgeGeo_Mb = WebApp_Func.MoveFromOriginAndScale(thisEdgeGeo,targetPoint,scale)
        
            tempList.append([[thisEdgeGeo_Mb.First.X,thisEdgeGeo_Mb.First.Y,0],[thisEdgeGeo_Mb.Last.X,thisEdgeGeo_Mb.Last.Y,0],edge.hierarchy])
        edge_InfoByPacel_BeforeOffset.append(tempList)
        
   
        
    
    
    parcels_Offset_Simplified = []
    
    ### After Offset
    edge_Geos_AfterOffset = []
    edge_Info_AfterOffset = []
    edge_InfoByPacel_AffterOffset = []


    for pF in copiedParcFace:
        tempList = []
        tempList_StartPts = []
        offsetEdges = PP.GetOffsetEdges_SimplifiedWithTurningPoints(pF)
    
        curveCollection = PP.ExtendToGetIntersections(offsetEdges,0.1,100)
        result=rg.Curve.CreateBooleanRegions(curveCollection,rg.Plane.WorldXY,False,0.001)
        
        if result.RegionCount >1:
            regions = []
            areas = []
            for i in range(result.RegionCount):
                regions.append(result.RegionCurves(i)[0])
                
            for i in range(result.RegionCount):
                areas.append(rg.AreaMassProperties.Compute(result.RegionCurves(i)[0]).Area) 
            maxIndex = areas.index(max(areas))
            selectRegionIndex = maxIndex
        
            
        else:
            selectRegionIndex = 0
        finalResult = result.RegionCurves(0)[0]
        
        
        originalHierarchy = [edge.hierarchy for edge in pF.edges]
        referCrvIndex = []
        referCrvDomain = []
        for orginalIndex in range(len(curveCollection)):
            referCrvIndex.append(result.SegmentDetails(selectRegionIndex,0,orginalIndex)[0])    #regionIndex,boundaryIndex,segmmentIndex
            referCrvDomain.append(result.SegmentDetails(selectRegionIndex,0,orginalIndex)[1]) 

        
        for i in range(len(referCrvIndex)):
            currReferIndex = referCrvIndex[i]
            currReferDomain = referCrvDomain[i]
            if currReferIndex!=-1:
                thisEdgeGeo = curveCollection[currReferIndex].Trim(currReferDomain.T0, currReferDomain.T1)
                
                thisEdgeGeo_Mb = WebApp_Func.MoveFromOriginAndScale(thisEdgeGeo,targetPoint,scale)
                edge_Geos_AfterOffset.append(thisEdgeGeo_Mb)
                edge_Info_AfterOffset.append(originalHierarchy[currReferIndex])
            
            thisPolyL =  thisEdgeGeo_Mb.TryGetPolyline()[1]
           
            count = thisPolyL.Count 
            if count!=2:
                thisPolyL = PP.SimplifyVertices_ToPolyLine(thisPolyL)
                segments = thisPolyL.GetSegments()
                for segIndex in range(len(segments)):
                    tempList_StartPts.append(segments[segIndex].From)
                    tempList.append([[segments[segIndex].From .X,segments[segIndex].From .Y,0],[segments[segIndex].To.X,segments[segIndex].To.Y,0],originalHierarchy[currReferIndex]])
              
                
            else:
                
                tempList_StartPts.append(thisEdgeGeo_Mb.PointAtStart)
                tempList.append([[thisEdgeGeo_Mb.PointAtStart.X,thisEdgeGeo_Mb.PointAtStart.Y,0],[thisEdgeGeo_Mb.PointAtEnd.X,thisEdgeGeo_Mb.PointAtEnd.Y,0],originalHierarchy[currReferIndex]])
        
        tempList_StartPts.append(tempList_StartPts[0])
        parcels_Offset_Simplified.append(rg.Polyline(tempList_StartPts))
        edge_InfoByPacel_AffterOffset.append(tempList)
        
                
    edgeInfoList = []
    for i in range(len(edge_Geos_AfterOffset)):
        geo = edge_Geos_AfterOffset[i]
        edgeInfoList.append([[geo.PointAtStart.X,geo.PointAtStart.Y,0],[geo.PointAtEnd.X,geo.PointAtEnd.Y,0],edge_Info_AfterOffset[i]])
        
        
#    for list in edgeInfoList:
#        print edgeInfoList
#      
#nums = []  
#print edge_InfoByPacel_AffterOffset[1]
#for list in edge_InfoByPacel_AffterOffset:
#    nums.append( len(list))
# ---------- end ghpython_script_16 ----------

panel_12 = Panel(ghpython_script_16.edge_Info_BeforeOffset)
geometry_2 = Geometry(ghpython_script_16.parcels_Offset_Simplified)
geometry_3 = Geometry(ghpython_script_16.parcels_Mb_All)

unit_z = UnitZ(Factor=0.02)
negative = Negative(Value=unit_z)
curve_2 = Curve(ghpython_script_10.inputPolyline)
move = Move(Geometry=curve_2, Motion=negative)  # -> Geometry, Transform
ghpython_script_17 = GhPythonScript(x=move.Geometry)  # -> out, a; inputs x: Curve
# ---------- ghpython_script_17: Python ----------
__author__ = "Anna Yenardi"
__version__ = "2023.05.17"

import rhinoscriptsyntax as rs
import ghpythonlib.components as gh
import ghpythonlib.treehelpers as tr

a = []
vertices = gh.Explode(x, True)[1]
retStr = ""
for i in range(len(vertices)):
    coords = gh.Deconstruct(vertices[i])
    retStr = retStr + str(coords[0]) + "," + str(coords[1]) + "," + str(coords[2]) + ";"
a.append(retStr[0:len(retStr) - 1])
a.append(retStr[0:len(retStr) - 1])
a = tr.list_to_tree(a)
# ---------- end ghpython_script_17 ----------

number = Number(simplify(graft(ghpython_script_16.convexityList_Simplified)))
number_2 = Number(simplify(graft(ghpython_script_16.compactnessList_Simplified)))
number_3 = Number(simplify(graft(ghpython_script_16.orientationList_Simplified)))
number_4 = Number(simplify(graft(ghpython_script_16.elongationList_Simplified)))
number_5 = Number(simplify(graft(ghpython_script_16.areaList_Simplified)))

ghpython_script_18 = GhPythonScript(
    dracomeshes=flatten(ghpython_script_16.meshDraco_Offset_Simplified),
    area=ghpython_script_16.areaList_Simplified,
    orientation=ghpython_script_16.orientationList_Simplified,
    elongation=ghpython_script_16.elongationList_Simplified,
    compactness=ghpython_script_16.compactnessList_Simplified,
    convexity=ghpython_script_16.convexityList_Simplified,
    edge_InfoByPacel_AffterOffset=ghpython_script_16.edge_InfoByPacel_AffterOffset)  # -> out, ParcelBoundaryPolyline, ParcelCategories, ParcelJSON; inputs dracomeshes: list, area: list, orientation: list, elongation: list, compactness: list, convexity: list, edge_InfoByPacel_AffterOffset: list
# ---------- ghpython_script_18: Python ----------
__author__ = "jingz"
__version__ = "2023.03.24"

import rhinoscriptsyntax as rs
import ghpythonlib.components as gh
import ghpythonlib.treehelpers as th
import json

print("This script extracts parcel polylines and assign road category from edge category.")
print("Cat 3 = Major Arterial, Cat 4 = Minor Arterial, Cat 6 = Adjacent to Parcel")

ParcelBoundaryPolyline = []
ParcelCategories = []
ParcelJSON = {}

for datapoints in edge_InfoByPacel_AffterOffset:

    points = [gh.ConstructPoint(sp[0],sp[1],sp[2]) for sp,ep,cat in datapoints]
    polyline = gh.PolyLine(points,True)
    ParcelBoundaryPolyline.append([polyline])

    category = []
    for sp,ep,cat in datapoints:
        if cat == None:
            category.append(3)
        if cat == 0:
            category.append(3)
        if cat == 1:
            category.append(4)
        if cat == 2:
            category.append(6)
        else:
            category.append(cat)

    ParcelCategories.append(category)

for i,(polyline, categories) in enumerate(zip(ParcelBoundaryPolyline,ParcelCategories)):
    parcelKey = str(i)
    
    ParcelJSON[parcelKey] = {}
    ParcelJSON[parcelKey]["EdgeCategory"] = categories
    ParcelJSON[parcelKey]["ParcelCoordinates"] = [[pt[0],pt[1],pt[2]] for pt in gh.ControlPoints(polyline)[0]]
    ParcelJSON[parcelKey]["Draco"] = dracomeshes[i]
    ParcelJSON[parcelKey]["Area"] = area[i]
    ParcelJSON[parcelKey]["Scores"] = [orientation[i], elongation[i], compactness[i], convexity[i]]

ParcelBoundaryPolyline = th.list_to_tree(ParcelBoundaryPolyline)
ParcelCategories = th.list_to_tree(ParcelCategories)
ParcelJSON = json.dumps(ParcelJSON)
# ---------- end ghpython_script_18 ----------
panel_13 = Panel(ghpython_script_18.out)
explode = Explode(Curve=ghpython_script_18.ParcelBoundaryPolyline, Recursive=True)  # -> Segments, Vertices
trim_tree = TrimTree(Tree=explode.Segments, Depth=1)
curve_middle = CurveMiddle(Curve=trim_tree)
colour_swatch = ColourSwatch(SwatchColor=RGB(184, 33, 153))
text_tag_3d = TextTag3D(Location=curve_middle, Text=ghpython_script_18.ParcelCategories, Size=10, Colour=colour_swatch, Justification=5)
custom_preview = CustomPreview(Geometry=trim_tree, Material=colour_swatch)

ghpython_script_19 = GhPythonScript(
    edge_Geos_BeforeOffset=ghpython_script_16.edge_Geos_BeforeOffset,
    edge_Info_BeforeOffset=ghpython_script_16.edge_Info_BeforeOffset)  # -> out, RoadLines, RoadCategories, RoadJSON; inputs edge_Geos_BeforeOffset: list of Curve, edge_Info_BeforeOffset: list
# ---------- ghpython_script_19: Python ----------
__author__ = "jingz"
__version__ = "2023.03.24"

import rhinoscriptsyntax as rs
import ghpythonlib.components as gh
import ghpythonlib.treehelpers as th
import json

print("This script extracts road category from edge category, explode curves, removes duplicate roads.")
print("Cat 3 = Major Arterial, Cat 4 = Minor Arterial")

RoadLines = []
RoadCategories = []
RoadMidPt = []

RoadJSON = {}
RoadVertices = []
RoadEdgeConnectivity = []


for roadGeo,roadCat in zip(edge_Geos_BeforeOffset,edge_Info_BeforeOffset):
    
    if len(gh.ControlPoints(roadGeo)[0]) == 2:
        roadSegments = [roadGeo]
    else:
        roadSegments = gh.Explode(roadGeo,True)[0]
    
    for roadSegment in roadSegments:
        
        startpt,endpt = gh.EndPoints(roadSegment)
        midpt = gh.CurveMiddle(roadSegment)
        
        if roadCat != None and roadCat < 2 and midpt not in RoadMidPt:
            RoadLines.append(roadSegment)
            RoadCategories.append(roadCat + 3)
            RoadMidPt.append(gh.CurveMiddle(roadSegment))
            
            if startpt not in RoadVertices:
                RoadVertices.append(startpt)
            if endpt not in RoadVertices:
                RoadVertices.append(endpt)
            startptIndex = RoadVertices.index(startpt)
            endptIndex = RoadVertices.index(endpt)
            RoadEdgeConnectivity.append([startptIndex,endptIndex])

RoadJSON['Vertices'] = [[pt[0],pt[1],pt[2]]for pt in RoadVertices]
RoadJSON['EdgeConnectivity'] = RoadEdgeConnectivity
RoadJSON['EdgeCategory'] = RoadCategories
RoadJSON = json.dumps(RoadJSON)
# ---------- end ghpython_script_19 ----------
panel_14 = Panel(ghpython_script_19.out)
curve_middle_2 = CurveMiddle(Curve=ghpython_script_19.RoadLines)
dash_pattern = DashPattern(Curve=ghpython_script_19.RoadLines, Pattern=7)  # -> Dashes, Gaps
colour_swatch_2 = ColourSwatch(SwatchColor=RGB(33, 184, 128))
text_tag_3d_2 = TextTag3D(Location=curve_middle_2, Text=ghpython_script_19.RoadCategories, Size=14, Colour=colour_swatch_2, Justification=5)
custom_preview_2 = CustomPreview(Geometry=dash_pattern.Dashes, Material=colour_swatch_2)

# ----
# average
average = Average(Input=ghpython_script_16.areaList_Simplified)
average_2 = Average(Input=ghpython_script_16.orientationList_Simplified)
average_3 = Average(Input=ghpython_script_16.elongationList_Simplified)
average_4 = Average(Input=ghpython_script_16.convexityList_Simplified)
average_5 = Average(Input=ghpython_script_16.compactnessList_Simplified)

curve_3 = Curve(simplify(graft(geometry_3)))
number_6 = Number(simplify(graft(ghpython_script_16.convexityList_All)))
number_7 = Number(simplify(graft(ghpython_script_16.compactnessList_All)))
number_8 = Number(simplify(graft(ghpython_script_16.orientationList_All)))
number_9 = Number(simplify(graft(ghpython_script_16.elongationList_All)))
number_10 = Number(simplify(graft(ghpython_script_16.areaList_All)))
curve_4 = Curve(simplify(graft(geometry_2)))
ghpython_script_20 = GhPythonScript(area=number_5, orientation=number_3, elongation=number_4, compactness=number_2, convexity=number)  # -> out, simplify(graft(eva)); inputs area: tree, orientation: tree, elongation: tree, compactness: tree, convexity: tree
# ---------- ghpython_script_20: Python ----------
__author__ = "Anna Yenardi"
__version__ = "2023.02.08"

import rhinoscriptsyntax as rs
import ghpythonlib.treehelpers as th

eva = []
for i in range(area.BranchCount):
    eva.append(str(area.Branch(i)[0])+','+str(orientation.Branch(i)[0])+','+str(elongation.Branch(i)[0])+','+str(compactness.Branch(i)[0])+','+str(convexity.Branch(i)[0]))

eva = th.list_to_tree(eva)
# ---------- end ghpython_script_20 ----------
curve_to_polyline = CurveToPolyline(Curve=curve_3, ToleranceDistance=0, ToleranceAngle=0)  # -> Polyline, Segments
curve_to_polyline_2 = CurveToPolyline(Curve=curve_4, ToleranceDistance=0, ToleranceAngle=0)  # -> Polyline, Segments
ghpython_script_21 = GhPythonScript(area=number_10, orientation=number_8, elongation=number_9, compactness=number_7, convexity=number_6)  # -> out, simplify(graft(eva)); inputs area: tree, orientation: tree, elongation: tree, compactness: tree, convexity: tree; same code as ghpython_script_20
ghpython_script_22 = GhPythonScript(x=average, y=average_2, z=average_3, u=average_5, v=average_4)  # -> out, simplify(graft(a))
# ---------- ghpython_script_22: Python ----------
__author__ = "Anna Yenardi"
__version__ = "2023.02.16"

import rhinoscriptsyntax as rs
import ghpythonlib.treehelpers as th

arr = [x,y,z,u,v]
a = th.list_to_tree(arr)
# ---------- end ghpython_script_22 ----------
ghpython_script_23 = GhPythonScript(poly=flatten(curve_to_polyline_2.Polyline))  # -> out, simplify(res); inputs poly: tree of Polyline
# ---------- ghpython_script_23: Python ----------
__author__ = "Anna Yenardi"
__version__ = "2023.02.06"

import rhinoscriptsyntax as rs
import ghpythonlib.components as gh
import ghpythonlib.treehelpers as th

res =[]
arr = th.tree_to_list(poly)
for i in range(len(arr)):
    verts = gh.Explode(arr[i], True)[1]
    coords = ""
    for j in range(len(verts)):
        curr = (gh.Deconstruct(verts[j]))
        coords = coords + str(curr[0])+","+str(curr[1])+","+str(curr[2])+";"
    coords = coords[0:len(coords)-1]
    res.append(coords)

res = th.list_to_tree(res)
# ---------- end ghpython_script_23 ----------
ghpython_script_24 = GhPythonScript(x=ghpython_script_16.childrenList)  # -> out, a; inputs x: tree of Int32
# ---------- ghpython_script_24: Python ----------
__author__ = "Anna Yenardi"
__version__ = "2023.02.01"

import rhinoscriptsyntax as rs
import ghpythonlib.treehelpers as th
import ghpythonlib.components as gh

arr = th.tree_to_list(x)
resArr = []

for i in range(len(arr)):
    if arr[i] == []:
        resArr.append("empty")
    else:
        newStr = ""
        for k in range(len(arr[i])):
            newStr = newStr + str(arr[i][k]) + ","
        resArr.append(newStr[0:len(newStr) - 1])

a = th.list_to_tree(resArr)
# ---------- end ghpython_script_24 ----------
ghpython_script_25 = GhPythonScript(poly=flatten(curve_to_polyline.Polyline))  # -> out, simplify(res); inputs poly: tree of Polyline; same code as ghpython_script_23

# ---- group: RH_OUT:RoadGenerationJSON
text = Text(ghpython_script_19.RoadJSON)

# ----
path_mapper = PathMapper(ghpython_script_21.eva, source="{i}", target="{0;0;0;0;0;0}")
# Tree Data
path_mapper_2 = PathMapper(ghpython_script_24.a, source="{i}", target="{0}")
path_mapper_3 = PathMapper(ghpython_script_25.res, source="{i}", target="{0;0;0;0;0}")
path_mapper_4 = PathMapper(ghpython_script_16.parentList, source="{i}", target="{0;0}")
path_mapper_5 = PathMapper(ghpython_script_16.depthList, source="{i}", target="{0;0;0}")
path_mapper_6 = PathMapper(ghpython_script_20.eva, source="{i}", target="{0;0;0;0;0;0}")
# Final Offset Data
path_mapper_7 = PathMapper(ghpython_script_23.res, source="{i}", target="{0;0;0;0;0}")
path_mapper_8 = PathMapper(ghpython_script_17.a, source="{i}", target="{1}")
path_mapper_9 = PathMapper(ghpython_script_16.dracoList, source="{i}", target="{0;0;0;0;0;0;0}")
path_mapper_10 = PathMapper(ghpython_script_22.a, source="{i}", target="{0;0;0;0;0;0;0;0}")
merge = Merge(Data1=path_mapper_2, Data2=path_mapper_4, Data3=path_mapper_5, Data4=path_mapper_3, Data5=path_mapper)
merge_2 = Merge(Data1=path_mapper_7, Data2=path_mapper_6, Data3=path_mapper_9, Data4=path_mapper_10, Data5=path_mapper_8)
path_mapper_11 = PathMapper(ghpython_script_18.ParcelJSON, source="{0;0;0;0}", target="{0}")
path_mapper_12 = PathMapper(ghpython_script_22.a, source="{i}", target="{2}")
path_mapper_13 = PathMapper(ghpython_script_16.dracoList, source="{i}", target="{1}")

# ---- group: RH_OUT:Tree
text_2 = Text(merge)

# ---- group: RH_OUT:Offset
text_3 = Text(merge_2)

# ----
merge_3 = Merge(Data1=path_mapper_11, Data2=path_mapper_13, Data3=path_mapper_12)

# ---- group: RH_OUT:ParcelGenerationJSON
text_4 = Text(merge_3)
